# Grasshopper definition 280921_RhinoCommonIntro_PA.ghx (Grasshopper 1.0.7)

move_and_rotate_rectangles = GhPythonScript()  # -> rectangles, debug_pts, debug_vecs, a
# ---------- move_and_rotate_rectangles: Python ----------
import Rhino.Geometry as rg
import math as m
import random
import ghpythonlib as gh
        
        
class Rectangle(object):
    def __init__(self, pt_bottom_left, pt_top_right):        
        """Rectangle contains the geometry (four Rhino.Geometry.Point3d() and
        a move method and a rotate method.
        
        Parameters
        ----------
        pt_bottom_left : Rhino.Geometry.Point3d()
        this point describes the bottom left corner of the rectangle
                
        pt_top_right : Rhino.Geometry.Point3d()
        this point describes the top right corner of the rectangle
        
        """
                
        self.pt_0 = pt_bottom_left
        self.pt_2 = pt_top_right
                
        self.pt_1 = rg.Point3d(pt_bottom_left.X, pt_top_right.Y, 0)
        self.pt_3 = rg.Point3d(pt_top_right.X, pt_bottom_left.Y, 0)
                
        self.rectangle_pts = [self.pt_0, self.pt_1, self.pt_2, self.pt_3]
                
        centre_pt_x  = (self.pt_0.X + self.pt_1.X + self.pt_2.X + self.pt_3.X)/4
        centre_pt_y  = (self.pt_0.Y + self.pt_1.Y + self.pt_2.Y + self.pt_3.Y)/4
        centre_pt_z = 0
        self.centre_pt = rg.Point3d(centre_pt_x, centre_pt_y, centre_pt_z)
            
    def move(self, vector):
        """Moves the rectangle according a vector-
                
        Parameters
        ----------
        vector : Rhino.Gepometry.Vector3d() 
                
                
        Returns
        ----------
        [pt_0 : Rhino.Geometry.Point3d(), pt_1 : Rhino.Geometry.Point3d(), 
        pt_2 : Rhino.Geometry.Point3d(), pt_3 : Rhino.Geometry.Point3d()]
        """
        moved_pts = []
                
        for pt in self.rectangle_pts:
            moved_pt = pt + vector 
            moved_pts.append(moved_pt)
                    
        self.rectangle_pts = moved_pts
                
                
    def rotate(self, angle):
        """Rotates the rectangle according a vector-
                
        Parameters
        ----------
        angle : float
                
                
        Returns
        ----------
        [pt_0 : Rhino.Geometry.Point3d(), pt_1 : Rhino.Geometry.Point3d(), 
        pt_2 : Rhino.Geometry.Point3d(), pt_3 : Rhino.Geometry.Point3d()]
        """
        rotated_pts = []
                
        
                
        for pt in self.rectangle_pts:
                    
                    
            direction_vector =  self.centre_pt - pt
                    
                    
            direction_vector.Rotate(angle, rg.Vector3d(0,0,1))
                    
            rotated_pt = self.centre_pt + direction_vector
            rotated_pts.append(rotated_pt)
                    
        self.rectangle_pts = rotated_pts
        print self.rectangle_pts
                
    def draw(self):
        return rg.NurbsCurve.Create(True, 1, self.rectangle_pts)
                
rectangles = []
gap = 0
        
debug_pts = []
debug_vecs = []
        
for x in range(7):
    for y in range(20):
                
        point_bottom_left = rg.Point3d(x*10 + x*gap, y*10+ y*gap, 0)
        point_top_right = rg.Point3d((x+1)*10+ x*gap, (y+1)*10+ y*gap, 0)
                
        r = Rectangle(point_bottom_left, point_top_right)
                
        degree = random.randint(-r.centre_pt.Y,r.centre_pt.Y) * 0.3 
        distance = random.randint(0,r.centre_pt.Y) * 0.05
                
        r.rotate(m.radians(0.75+degree))
        r.move(rg.Point3d(distance, -distance, 0))
                
        rectangles.append(r.draw())
                
        
#a = gh.treehelpers.list_to_tree(debug_vecs)
# ---------- end move_and_rotate_rectangles ----------
translate_rectangles = GhPythonScript()  # -> out, rectangles, debug_pts, debug_vecs, a
# ---------- translate_rectangles: Python ----------
import Rhino.Geometry as rg
import math as m
import random
import ghpythonlib as gh



class Rectangle(object):
    def __init__(self, plane, dimensions):        
        """Rectangle contains the geometry (four Rhino.Geometry.Point3d() and
        a move method and a rotate method.

        Parameters
        ----------
        plane : Rhino.Geometry.Plane()
        
        this plane describes centre of the rectangle
        
        dimensions,
        

        """
        self.plane = plane
        self.dimension = dimensions
        
        self.bottom_left_pt = self.plane.Origin
        
        x_vec = rg.Vector3d(1,0,0) * dimensions
        y_vec = rg.Vector3d(0,1,0) * dimensions
        
        self.pt_0 = self.bottom_left_pt
        self.pt_1 = self.pt_0 + x_vec
        self.pt_2 = self.pt_1 + y_vec
        self.pt_3 = self.pt_0 + y_vec
        
        
        self.rectangle_pts = [self.pt_0, self.pt_1, self.pt_2, self.pt_3]
        
        centre_pt_x  = (self.pt_0.X + self.pt_1.X + self.pt_2.X + self.pt_3.X)/4
        centre_pt_y  = (self.pt_0.Y + self.pt_1.Y + self.pt_2.Y + self.pt_3.Y)/4
        centre_pt_z = 0
        self.centre_pt = rg.Point3d(centre_pt_x, centre_pt_y, centre_pt_z)
    
    def move(self, vector):
        """Moves the rectangle according a vector-
        
        Parameters
        ----------
        vector : Rhino.Gepometry.Vector3d() 
        
        
        Returns
        ----------
        [pt_0 : Rhino.Geometry.Point3d(), pt_1 : Rhino.Geometry.Point3d(), 
        pt_2 : Rhino.Geometry.Point3d(), pt_3 : Rhino.Geometry.Point3d()]
        """
        moved_pts = []
        
        
    def rotate(self, angle):
        """Rotates the rectangle according a vector-
        
        Parameters
        ----------
        angle : float
        
        
        Returns
        ----------
        [pt_0 : Rhino.Geometry.Point3d(), pt_1 : Rhino.Geometry.Point3d(), 
        pt_2 : Rhino.Geometry.Point3d(), pt_3 : Rhino.Geometry.Point3d()]
        """

    def draw(self):
        return rg.NurbsCurve.Create(True, 1, self.rectangle_pts)
        
rectangles = []
gap = 0

debug_pts = []
debug_vecs = []

for x in range(7):
    for y in range(20):
        
        point_bottom_left = rg.Point3d(x*10 + x*gap, y*10+ y*gap, 0)
        rg.Plane
        
        r = Rectangle(point_bottom_left, point_top_right)
        
        degree = random.randint(-r.centre_pt.Y,r.centre_pt.Y) * 0.3 
        distance = random.randint(0,r.centre_pt.Y) * 0.05
        
        r.rotate(m.radians(0.75+degree))
        r.move(rg.Point3d(distance, -distance, 0))
        
        rectangles.append(r.draw())
        

#a = gh.treehelpers.list_to_tree(debug_vecs)
# ---------- end translate_rectangles ----------
geo = Geometry(move_and_rotate_rectangles.rectangles)
geo_2 = Geometry(move_and_rotate_rectangles.debug_pts)
vdis = VectorDisplay(Anchor=graft(move_and_rotate_rectangles.debug_pts), Vector=move_and_rotate_rectangles.a)
