# Grasshopper definition random_walker.ghx (Grasshopper 1.0.7)
# plug-ins: Bifocals

# Exercises
# 
# 
# . Create multiples walkers
# 
# . Generate boundaries to contain the walkers
# 
# . Base the pixels color on their spacial locations
number_slider = Slider(6, range=0..10)
size = Slider(2.8, range=0..10)
python = GhPythonScript(seed=number_slider, steps=Slider(3000, range=1..3000), size=size)  # -> out, a; inputs seed: Int32, steps: Int32
# ---------- python: Python ----------
import Rhino.Geometry as rg
import random as r
r.seed(seed)

class Walker():
    
    """Random Walk Python Class
    https://en.wikipedia.org/wiki/Random_walk
    """
    
    def __init__(self):
        self.x = 0
        self.y = 0
        self.z = 0
    
    def pixel(self):
        pt = rg.Point3d(self.x, self.y, self.z)
        dom = rg.Interval(-size/2, size/2)
        rct = rg.Box(rg.Plane(pt, rg.Vector3d(0,0,1)), dom, dom, dom)
        msh = rg.Mesh.CreateFromBox(rct, 1, 1, 1)
        return pt, msh
    
    def move(self):
        choice = r.randint(0,5)
        if choice == 0:
            self.x += size
        elif choice == 1:
            self.x -= size
        elif choice == 2:
            self.y += size
        elif choice == 3:
            self.y -= size
        elif choice == 4:
            self.z += size
        else:
            self.z -= size

w = Walker()
pts = []
rects = []

for s in range(steps):
    w.move()
    pt, rct = w.pixel()
    if pt not in pts:
        pts.append(pt)
        rects.append(rct)

a = rects
# ---------- end python ----------
lng = ListLength(List=python.a)
series = Series(Start=0, Step=1, Count=lng)
gradient = Gradient(
    LowerLimit="0",
    UpperLimit=lng,
    Parameter=series,
    stops=[0: RGB(0, 98, 0), 0.25: RGB(81, 175, 17), 0.5: RGB(159, 198, 146), 0.75: RGB(170, 235, 41), 1: RGB(221, 255, 53)])
mcol = MeshColours(Mesh=graft(python.a), Colours=graft(gradient))
