# Grasshopper definition random_walker.ghx (Grasshopper 1.0.7)
# plug-ins: Bifocals

# Ideas for additional practice
# 
# 
# . Generate boundaries to contain the walkers
# 
# . Base the pixels color on their spatial locations
# 
# . Add a 'bias' in the random walking that steers the walker in a certain direction
# 
# . Add diagonal (or other creative) steps
number_slider = Slider(6, range=0..10)
# Show how to animate slider to create a short animation. Use ffmpeg to turn it into a video.
# 
# Hmm, why is it so slow?
# 
# If we have the time: let's do the extra optimization that is needed!
size = Slider(2.8, range=0..10)
python = GhPythonScript(seed=number_slider, time=Slider(802, range=1..2000), size=size)  # -> out, boxes, pts; inputs seed: Int32, time: Int32
# ---------- python: Python ----------
import Rhino.Geometry as rg
import random as r
r.seed(seed)
import rhinoscriptsyntax as rs
from System.Drawing import Color

from compas_ghpython.utilities import list_to_ghtree

class Walker():
    
    """Random Walk Python Class
    https://en.wikipedia.org/wiki/Random_walk
    """
    
    def __init__(self, x, y, z, c, s):
        self.x = x
        self.y = y
        self.z = z
        self.color = c
        self.size = s
        
        self.path_pts = []
        self.path_boxes = []
        
    
    def update_path(self):
        pt = rg.Point3d(self.x, self.y, self.z)
        dom = rg.Interval(-self.size/2, self.size/2)
        rct = rg.Box(rg.Plane(pt, rg.Vector3d(0,0,1)), dom, dom, dom)
        msh = rg.Mesh.CreateFromBox(rct, 1, 1, 1)
        msh.VertexColors.CreateMonotoneMesh(self.color)
        
        self.path_pts.append(pt)
        self.path_boxes.append(msh)
    
    def move_cartesian(self):
        choice = r.randint(0,5)
        if choice == 0:
            self.x += self.size
        elif choice == 1:
            self.x -= self.size
        elif choice == 2:
            self.y += self.size
        elif choice == 3:
            self.y -= self.size
        elif choice == 4:
            self.z += self.size
        else:
            self.z -= self.size
            
    def move_messy(self):
        stepX = r.uniform(-1,1)
        self.x += stepX
        stepY = r.uniform(-1,1)
        self.y += stepY
        stepZ = r.uniform(-1,1)
        self.z += stepZ
        

""" --- main ---"""

# create 5 walkers
walkers = []
for _ in range(10):
    color = Color.FromArgb( r.randint(0,250), 0 , r.randint(0,250))
    w = Walker(x=0 , y=0 , z=0, c = color, s = r.uniform(0.6, 5.0))
    walkers.append(w)
    
# use a nested loop to update each walker at each time step
for t in range(time):
    for w in walkers:
        w.move_cartesian()
        #w.move_messy()
        w.update_path()
        

# get the path points and boxes of each walker
# for a single walker:
#pts, boxes = w.path_pts, w.path_boxes
# for many wakers:
pts = [w.path_pts for w in walkers]
boxes = [w.path_boxes for w in walkers]
# convert nested list into a grasshopper tree
pts = list_to_ghtree(pts)
boxes = list_to_ghtree(boxes)
# ---------- end python ----------
lng = ListLength(List=python.boxes)
series = Series(Start=0, Step=1, Count=lng)
pt = Point(python.pts)
gradient = Gradient(
    LowerLimit="0",
    UpperLimit=lng,
    Parameter=series,
    stops=[0: RGB(0, 98, 0), 0.25: RGB(81, 175, 17), 0.5: RGB(159, 198, 146), 0.75: RGB(170, 235, 41), 1: RGB(221, 255, 53)])
intcrv = Interpolate(Vertices=pt, Degree=3, Periodic=False, KnotStyle=1)  # -> Curve, Length, Domain
mesh = Mesh(python.boxes)
mcol = MeshColours(Mesh=graft(python.boxes), Colours=graft(gradient))
cloud = CloudDisplay(Points=python.pts, Colours=gradient, Size=1, SpriteType=0)
medges = MeshEdges(Mesh=mcol)  # -> NakedEdges, InteriorEdges, NonManifoldEdges
