# Grasshopper definition simulation_walkers.ghx (Grasshopper 1.0.7)
# plug-ins: Bifocals

# ---- group: Bouncy spheres with forces
dom = ConstructDomain(DomainStart="0", DomainEnd="100")
# --- Ideas for simpler tasks ---
# .Experiment with different forces. Ex: implement gravity force (i.e. a force that points downwards; in the negative z direction)
# .Constrain the bouncies in a sphere instead of a rectangle
# 
# 
# --- A bit more advanced tasks ---
# .Give to the bouncies a cooler body shape that is oriented in the direction of the motion (i.e. the velocity vector).
# .Find a creative way to display the trajectories of the bouncies. With colors maybe?
# 
# 
# --- Very advanced task ---
# .Implement collisions between spheres
# Hints: This requires a nested for-loop.
# The task can be split in two steps: 1) detect collisions
# 2) change velocities of colliding spheres
panel = Panel("1")
box = DomainBox(Base=PlaneXY(0, 0, 0), X=dom, Y=dom, Z=dom)
vec = VectorXYZ(XComponent=0, YComponent=panel, ZComponent=0)  # -> Vector, Length
pt = Point(Point(50.9247808, 28.71731104, 82.45756986))
python = GhPythonScript(
    bounds="100",
    time=Slider(190, range=0..1000),
    step_size=Slider(3.59, range=0..10),
    force_mult=Slider(0.007, range=0..0.04),
    wind=vec.Vector)  # -> out, bodies, trajectories; inputs time: Int32, wind: Vector3d, attractor: Point3d
# ---------- python: Python ----------
__author__ = "Ioanna"
__version__ = "2020.10.04"

import rhinoscriptsyntax as rs
import Rhino.Geometry as rg
import random as r

r.seed(2)

class Bouncy:
    def __init__(self, p0, v0, m):
        self.p = p0 # position
        self.v = v0 # velocity
        self.a = rg.Vector3d(0,0,0) # acceleration
        self.m = m # mass
        self.path = [] 
        
    def step(self):
        if self.p.X > bounds or self.p.X <0:
            self.v.X *= -1
            self.p.X = self.p.X - step_size if self.p.X > bounds else self.p.X + step_size 
        if self.p.Y > bounds or self.p.Y <0:
            self.v.Y *= -1
            self.p.Y = self.p.Y - step_size if self.p.Y > bounds else self.p.Y + step_size 
        if self.p.Z > bounds or self.p.Z <0:
            self.v.Z *= -1
            self.p.Z = self.p.Z - step_size if self.p.Z > bounds else self.p.Z + step_size 
        self.path.append(self.p)
        
        self.a = self.total_force() / self.m  # acceleration = force / mass
        self.v = self.v + self.a * step_size  # velocity = v_prev + acceleration * time
        self.p = self.p + self.v * step_size  # position = p_prev + velocity * time
        
    def body(self):
        return rg.Sphere(self.p, 5 * self.m)

    def get_path(self):
        return rg.Polyline(self.path) 
        
    def total_force(self): 
        f = rg.Vector3d(0,0,0)
        
        # wind force
        f += wind* force_mult
        
        ## attractor force
        if (attractor):
            a = attractor - self.p
            a = rg.Vector3d(a.X, a.Y, a.Z)
            a/= rs.VectorLength(a)
            f += a * force_mult
        
        return f;
    
    
    
""" main """
bouncies = []
for i in range(5):
    b = Bouncy(p0=rg.Point3d(50,50,50), v0=rg.Vector3d(r.uniform(-1,1), r.uniform(-1,1), r.uniform(-1,1)), m=r.uniform(0,2))
    bouncies.append(b)

trajectories = []
bodies = []

for i in range(time):
    for bouncy in bouncies:
        bouncy.step()
    
    
bodies = [bouncy.body() for bouncy in bouncies]
trajectories = [bouncy.get_path() for bouncy in bouncies]
# ---------- end python ----------
edges = BrepEdges(Brep=box)  # -> Naked, Interior, NonManifold
geo = Geometry(python.bodies)
crv = Curve(python.trajectories)
