# Grasshopper definition 211004_roboticDrawing_PA.ghx (Grasshopper 1.0.7)

robotic_drawing = GhPythonScript(send=Button())  # -> out, Points
# ---------- robotic_drawing: Python ----------
# Uncomment the following 2 lines to reload the code in example.py
from compas_rhino import unload_modules
unload_modules('simple_comm')
unload_modules('simple_ur_script')


import simple_ur_script as ur
import simple_comm as c

import Rhino.Geometry as rg

import math as m
import random as r

ROBOT_IP = "192.168.10.10"

#Values to set the robot origin
ORIGIN = rg.Point3d(527, -92, 0)
X_AXIS = rg.Point3d(527, 400, 0)
Y_POSITIVE_PLANE = rg.Point3d(250, -92, 0)

way_pts = []
Points =[]
Lines=[]
Polyline = []
pen_height = 165
#Sets the robot origin
def set_robot_base():
    robot_base = rg.Plane(ORIGIN,X_AXIS-ORIGIN,Y_POSITIVE_PLANE-ORIGIN)
    print (robot_base)
    return (robot_base)


#how to transform rhino to robot base coordinates
def rhino_to_robot_space(_plane,robot_base):
    _r_matrix = rg.Transform.PlaneToPlane(rg.Plane.WorldXY,robot_base)
    _plane.Transform(_r_matrix)
    return _plane

#how to randomly draw
def random_walk_draw(robot_base,pen_height,_no_pts,vel,accel):
    way_pts = []
    for i in range(_no_pts):
        y_r = r.randint(50,247)
        x_r = r.randint(50,370)
        r_pt = rg.Point3d(50+5*i,y_r,pen_height)
        way_pts.append(r_pt)
        Points.append(r_pt)

    for i,pt in enumerate(way_pts):
        if i>0:
            rg.Line(way_pts[i-1],pt)
    way_planes = [rg.Plane(pt,rg.Vector3d.ZAxis) for pt in way_pts]
    way_planes = [rhino_to_robot_space(plane,robot_base) for plane in way_planes]

    velocity = vel
    acceleration = accel
    robot_ip = ROBOT_IP

    script = ""
    script += ur.set_tcp_by_angles(0.0,0.0,pen_height,m.radians(-90.0),m.radians(180.0),m.radians(0))
    
    print pen_height
    
    for plane in way_planes:
        script += ur.move_l(plane,acceleration,velocity)

    script = c.concatenate_script(script)
    c.send_script(script,robot_ip)
    print script

send = True
if send:
    robot_base =  set_robot_base()
    random_walk_draw(robot_base,pen_height,50,0.3,0.3)
# ---------- end robotic_drawing ----------
