# Grasshopper definition 211004_roboticDrawing_PA_002.gh (Grasshopper 1.0.7)

robotic_drawing = GhPythonScript(send=Button())  # -> out, points, way_planes
# ---------- robotic_drawing: Python ----------
# Uncomment the following 2 lines to reload the code in example.py
from compas_rhino import unload_modules
unload_modules('simple_comm')
unload_modules('simple_ur_script')


import simple_ur_script as ur
import simple_comm as c

import Rhino.Geometry as rg

import math as m
import random as r

ROBOT_IP = "192.168.10.10"

#Values to set the robot origin
ORIGIN = rg.Point3d(527, -92, 0)
X_AXIS = rg.Point3d(527, 400, 0)
Y_POSITIVE_PLANE = rg.Point3d(250, -92, 0)

way_pts = []
Points =[]
Polyline = []


def set_robot_base():
    robot_base = rg.Plane(ORIGIN,X_AXIS-ORIGIN,Y_POSITIVE_PLANE-ORIGIN)
    print (robot_base)
    return (robot_base)


#how to transform rhino to robot base coordinates
def rhino_to_robot_space(_plane,robot_base):
    _r_matrix = rg.Transform.PlaneToPlane(rg.Plane.WorldXY,robot_base)
    _plane.Transform(_r_matrix)
    return _plane

#how to randomly draw
def random_walk_draw(_no_pts):
    way_pts = []
    for i in range(_no_pts):
        y_r = r.randint(50,247)
        x_r = r.randint(50,370)
        r_pt = rg.Point3d(50+5*i,y_r,0)
        way_pts.append(r_pt)
        Points.append(r_pt)
           
    way_planes = []
    for pt in way_pts:
        way_planes.append(rg.Plane(pt,rg.Vector3d.ZAxis))
    
    return way_planes

def send_to_robot(robot_base, way_planes, accel, vel):

    robot_ip = ROBOT_IP
    
    robot_planes = []
    for plane in way_planes: 
        robot_planes.append(rhino_to_robot_space(plane, robot_base))

    script = ""
    script += ur.set_tcp_by_angles(0.0,95.0,35.0,m.radians(-90.0),m.radians(180.0),m.radians(0))
    
    for plane in way_planes:
        script += ur.move_l(plane,accel,vel)

    script = c.concatenate_script(script)
    c.send_script(script,ROBOT_IP)
    return way_planes

send = True
if send:
    robot_base =  set_robot_base()
    way_planes = random_walk_draw(50)
    
    send_to_robot(robot_base, way_planes, 0.1, 0.1)
# ---------- end robotic_drawing ----------
geo = Geometry(robotic_drawing.points)
geo_2 = Geometry(robotic_drawing.way_planes)
pline = PolyLine(Vertices=geo, Closed=False)
