# Grasshopper definition 211005_PlanesFromRailMorning_PA.ghx (Grasshopper 1.0.7)

geo = Geometry(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)
divide_curve_to_make_planes = GhPythonScript(curve=geo, count=Slider(50, range=0..100))  # -> out, pts, X_axis, Y_axis, planes; inputs curve: Curve, count: Int32
# ---------- divide_curve_to_make_planes: Python ----------
import Rhino.Geometry as rg


# ==============================================================================
# 0. Divide curve into a set of points 
# ==============================================================================

params = curve.DivideByCount(count, True)

pts = []

for p in params:
    pt = curve.PointAt(p)
    pts.append(pt)

# ==============================================================================
# 1. Create a list of tangents (x-axis) at each pt location 
# ==============================================================================
    
tangents = []

for p in params:
    t = curve.TangentAt(p)
    t = t * 25
    tangents.append(t)

# ==============================================================================
# 2. Create y-axis vector (normal) from world Zaxis and the xaxis 
# rg.Vector3d.CrossProduct cross products are crucial when working with vectors https://en.wikipedia.org/wiki/Cross_product
# ==============================================================================


X_axis = []
Y_axis = []

for t in tangents:
    X_axis.append(t)
    Yvec = rg.Vector3d.CrossProduct(rg.Vector3d(0,0,1), t)
    Y_axis.append(Yvec)
    


# ==============================================================================
# 3. Create planes from the pt, x-axis and y-axis
# ==============================================================================

planes = []

for pt, x_vec, y_vec in zip(pts, X_axis, Y_axis):
    plane = rg.Plane(pt, x_vec, y_vec)
    planes.append(plane)
# ---------- end divide_curve_to_make_planes ----------
geo_2 = Geometry(divide_curve_to_make_planes.planes)
geo_3 = Geometry(divide_curve_to_make_planes.pts)
vdis = VectorDisplay(Anchor=divide_curve_to_make_planes.pts, Vector=divide_curve_to_make_planes.Y_axis)
vdis_2 = VectorDisplay(Anchor=divide_curve_to_make_planes.pts, Vector=divide_curve_to_make_planes.X_axis)
robotic_fabrication = GhPythonScript(way_planes=divide_curve_to_make_planes.planes, send=Toggle(False))  # -> out, base, robot_planes, robot_path, a; inputs way_planes: list of Plane, send: Boolean
# ---------- robotic_fabrication: Python ----------
import Rhino.Geometry as rg
import simple_comm as c
import simple_ur_script as ur

import math as m


def set_robot_base_plane_from_pts():
    """ Sets the robot base. 
    1.  Move the robot arm first to the origin in your workspace and copy the cordinates into pt_o (the UR panel (ase cordinate system))
    2.  Move the robot arm to a point on the base planes positive x axis and copy the cordinates into pt_1
    3.  Move the robot arm to a point on the base planes positive xy plane and copy the cordinates into pt_2
    
    ---------
    Returns:
    robot_base: Rhino.Geometry.Plane
    
    """
    pt_0 = rg.Point3d(496.17,118.56,-9.94)
    pt_1 = rg.Point3d(496.16,213.59,-9.96)
    pt_2 = rg.Point3d(333.27,118.6,-9.56)
    
    robot_base = rg.Plane(pt_0, pt_1-pt_0, pt_2-pt_0)
    return robot_base
    
def rhino_to_robot_space(rhino_plane, base):
    """ Translates plane from rhino cordinate system (rhino_plane) to robot cordinate system (robot_plane)
    
    ---------
    Paramteres:
    rhino_plane: Rhino.Geometry.Plane 
    
    ---------
    Returns :
    robot_plane: Rhino.Geometry.Plane
    
    """
    
    robot_plane = rhino_plane.Clone()
    robot_matrix = rg.Transform.PlaneToPlane(rg.Plane.WorldXY, base)
    
    robot_plane.Transform(robot_matrix)
    return robot_plane
    
# ==============================================================================
# 0. Translates the print_way_planes into the robot_base 
# ==============================================================================

base = set_robot_base_plane_from_pts()

robot_planes = []
for i in range(len(way_planes)):
    robot_plane = rhino_to_robot_space(way_planes[i], base)
    robot_planes.append(robot_plane)

# ==============================================================================
# 1. create empty script and assigne roboti valuse
# ==============================================================================

script = ""

safe_vel = 0.1 #m/s
safe_accel = 0.1 #m/s2
safe_distance = 50 #50m


robot_path = [] #list for viualising robot planes

# ==============================================================================
# 2. offsets the first way_plane of the robot fabrication to create a safety plane
# ==============================================================================

script += ur.set_tcp_by_angles(float(0.0), float(0.0), 
float(0.0), m.radians(0.0), m.radians(180.0), m.radians(0.0)) # Update with your values!!!!

# ==============================================================================
# 3. offsets the first way_plane of the robot fabrication to create a safety plane
# ==============================================================================


safe_plane = robot_planes[0].Clone()
safe_plane.Translate(rg.Vector3d(0,0,safe_distance))

script += ur.move_l(safe_plane, safe_accel, safe_vel)

robot_path.append(safe_plane)

# ==============================================================================
# 4. Moves to the first plane of drawing
# ==============================================================================


entry_plane = robot_planes.pop(0)   # entry plane is the first plane of the fabrication plane. after moving here we remove it.
script += ur.move_l(entry_plane, safe_accel, safe_vel)
robot_path.append(entry_plane)

# ==============================================================================
# 5. Moves along the trans plane to draw the whole line
# ==============================================================================


drawing_speed = 0.025
drawing_accel = 0.1 
blend_radius = (rg.Point3d.DistanceTo(robot_planes[0].Origin, robot_planes[1].Origin))/2.5

for plane in robot_planes:
    script += ur.move_l_blend(plane, drawing_accel, drawing_speed, blend_radius)
    robot_path.append(plane)

# ==============================================================================
# 6. Moves away from the drawing safe_exit_plane
# ==============================================================================

safe_exit_plane = robot_planes[-1].Clone()
safe_exit_plane.Translate(rg.Vector3d(0,0,safe_distance))

script += ur.move_l(safe_exit_plane, safe_accel, safe_vel)
robot_path.append(safe_exit_plane)
# ---------- end robotic_fabrication ----------
geo_4 = Geometry(robotic_fabrication.base)
geo_5 = Geometry(robotic_fabrication.robot_path)
pline = PolyLine(Vertices=geo_5, Closed=False)
