# Grasshopper definition 211005_PlanesFromRail_PA.ghx (Grasshopper 1.0.7)

number_slider = Slider(56, range=0..100)
crv = Curve(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)
crv_2 = Curve(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)
divide_curve_to_create_planes = GhPythonScript(curve=crv, count=number_slider)  # -> pts, raw_tangents, X_axis, Y_axis, planes; inputs curve: Curve
# ---------- divide_curve_to_create_planes: Python ----------
import Rhino.Geometry as rg


"""divide curve to creat pts for plane oprigins. 
"""
params = curve.DivideByCount(count, True)


pts = []
for p in params:
    pt = curve.PointAt(p)
    pts.append(pt)
    


""" Normal vectors
"""
raw_tangents = []
for p in params:
    t = curve.TangentAt(p)
    raw_tangents.append(t)
    

""" From Plane Zaxis (raw_tangents) create Plane Xaxis Plane Yaxis by using rg.Vector3d.CrossProduct 
cross products are crucial when working with vectors
https://en.wikipedia.org/wiki/Cross_product
"""
X_axis = []
Y_axis = []
Z_axis = []



for t in raw_tangents:
    Z_axis.append(t)                                         # plane Z is the same as the normal of the curve
    
    Xvec = rg.Vector3d.CrossProduct(rg.Vector3d(0,0,1), t)
    X_axis.append(Xvec)
    Yvec = rg.Vector3d.CrossProduct(t, Xvec)
    Y_axis.append(Yvec)




""" Creat planes from pts (origins), X_axis and Y_axis
"""


planes = []

for pt, x_vec, y_vec in zip (pts, X_axis, Y_axis):
    plane = rg.Plane(pt, x_vec, y_vec)
    planes.append(plane)
# ---------- end divide_curve_to_create_planes ----------
divide_curve_to_create_planes_2 = GhPythonScript(curve=crv_2, count=number_slider)  # -> pts, raw_tangents, X_axis, Y_axis, planes; inputs curve: Curve
# ---------- divide_curve_to_create_planes_2: Python ----------
import Rhino.Geometry as rg


# ==============================================================================
# 0. Divide curve into a set of points 
# ==============================================================================
params = curve.DivideByCount(count, True)   #generates a lists of parameters (location of the point on the curve)


pts = []                                    #creates empty list for adding pt
for p in params:                            # iterates trough the list of params and ads a point at each location
    pt = curve.PointAt(p)
    pts.append(pt)
    


# ==============================================================================
# 1. Create a list of tangents (x-axis) at each pt location 
# ==============================================================================

tangents = []                           #creates empty list for adding pt
for p in params:                            #iterates trough the list of params and get the tangent at each location
    t = curve.TangentAt(p)
    tangents.append(t)
    


# ==============================================================================
# 2. Create y-axis vector (normal) from world Zaxis and the xaxis 
# rg.Vector3d.CrossProduct cross products are crucial when working with vectors https://en.wikipedia.org/wiki/Cross_product
# ==============================================================================


X_axis = []
Y_axis = []


for t in tangents:
    X_axis.append(t)                                         
    Yvec = rg.Vector3d.CrossProduct(rg.Vector3d(0,0,1), t)
    Y_axis.append(Yvec)




# ==============================================================================
# 3. Create planes from the pt, x-axis and y-axis
# ==============================================================================

planes = []

for pt, x_vec, y_vec in zip (pts, X_axis, Y_axis):
    plane = rg.Plane(pt, x_vec, y_vec)
    planes.append(plane)
# ---------- end divide_curve_to_create_planes_2 ----------
vdis = VectorDisplay(Anchor=divide_curve_to_create_planes.pts, Vector=divide_curve_to_create_planes.Y_axis)
vdis_2 = VectorDisplay(Anchor=divide_curve_to_create_planes.pts, Vector=divide_curve_to_create_planes.X_axis)
vdis_3 = VectorDisplay(Anchor=divide_curve_to_create_planes.pts, Vector=divide_curve_to_create_planes.raw_tangents)
geo = Geometry(divide_curve_to_create_planes.planes)
geo_2 = Geometry(divide_curve_to_create_planes_2.planes)
vdis_4 = VectorDisplay(Anchor=divide_curve_to_create_planes_2.pts, Vector=divide_curve_to_create_planes_2.raw_tangents)
vdis_5 = VectorDisplay(Anchor=divide_curve_to_create_planes_2.pts, Vector=divide_curve_to_create_planes_2.X_axis)
vdis_6 = VectorDisplay(Anchor=divide_curve_to_create_planes_2.pts, Vector=divide_curve_to_create_planes_2.Y_axis)
fabrication = GhPythonScript(print_way_planes=divide_curve_to_create_planes_2.planes)  # -> out, rhino_base_way_planes, robot_way_planes; inputs print_way_planes: list
# ---------- fabrication: Python ----------
import Rhino.Geometry as rg
import simple_comm as c
import simple_ur_script as ur

import math as m


def tcp(script):
    """ Sets tcp
    Returns:
    script : "set_tcp(p[0.xxxx,0.xxxx,0.xxx,0.xxxx,x.xxxx,x.xxxx])" 
    """
    script += ur.set_tcp_by_angles(
        float(0.0), float(0.0), float(0.0), m.radians(0.0), m.radians(180.0), m.radians(0))
    return script

def set_robot_base_plane_from_pts():
    """ Sets the robot base. 
    1.  Move the robot arm first to the origin in your workspace and copy the cordinates into pt_o (the UR panel (ase cordinate system)
    2.  Move the robot arm to a point on the base planes positive x axis and copy the cordinates into pt_1
    3.  Move the robot arm to a point on the base planes positive xy plane and copy the cordinates into pt_2
    
    ---------
    Returns:
    robot_base: Rhino.Geometry.Plane
    
    """
    
    pt_0 = rg.Point3d(299, 63, 0)   # base plane origin
    pt_1 = rg.Point3d(499, 63, 0)   # point on base plane positive x direction
    pt_2 = rg.Point3d(499, 299, 0)  # point on base plane positive xy

    robot_base = rg.Plane(pt_0, pt_1-pt_0, pt_2-pt_0)
    return robot_base

def rhino_to_robot_space(rhino_plane):
    """ Translates plane from rhino cordinate system (rhino_plane) to robot cordinate system (robot_plane)
    
    ---------
    Paramteres:
    rhino_plane: Rhino.Geometry.Plane 
    
    ---------
    Returns :
    robot_plane: Rhino.Geometry.Plane
    
    """
    robot_plane = rhino_plane.Clone()
    _r_matrix = rg.Transform.PlaneToPlane(
        rg.Plane.WorldXY, set_robot_base_plane_from_pts())
    
    robot_plane.Transform(_r_matrix)
    return robot_plane
    
    
    
# ==============================================================================
# 0. Translates the print_way_planes into the robot_base 
# ==============================================================================

trans_planes = []
for plane in print_way_planes:
    trans_planes.append(rhino_to_robot_space(plane))

# ==============================================================================
# 1. create empty script and a list for visualizing the robot_way_planes
# ==============================================================================

script = ""
robot_way_planes = []

# ==============================================================================
# 2. set tcp (please add the values in the funktion based on the rhino model
# ==============================================================================
script = tcp(script)

# ==============================================================================
# 3. offsets the first way_plane of the robot fabrication to create a safety plane
# ==============================================================================

safe_vel = 0.1     # m/s
safe_accel = 0.1   # m/s2
safe_distance = 50 # mm


safe_plane = trans_planes[0].Clone()
safe_plane.Translate(rg.Vector3d(0, 0, safe_distance))


script += ur.move_l(safe_plane, safe_accel, safe_vel)
robot_way_planes.append(safe_plane)

# ==============================================================================
# 4. Moves to the first plane
# ==============================================================================
entry_plane = trans_planes.pop(0)       # entry plane is the first plane of the fabrication plane. after moving here we remove it.

script += ur.move_l(trans_planes[0], safe_accel, safe_vel)
robot_way_planes.append(trans_planes[0])




# ==============================================================================
# 5. Moves along the trans plane to print the structure.
# ==============================================================================

drawing_speed = 0.025                 # m/s here we set the speed for the robot during extrusion
drawing_accel = 0.1                   # m/s2 i do not think we need this value - we are using a blend radius wich overwrites the acceleration
blend_radius    = 0.01                  # blend radius must be less than half the distance between the way_planes



for plane in trans_planes:
    script += ur.move_l_blend(plane, drawing_accel, blend_radius)
    robot_way_planes.append(plane)
    

# ==============================================================================
# 6. Moves away from the drawing safe_exit_plane
# ==============================================================================
safe_extit_distance = 50


safe_exit_plane = trans_planes[-1].Clone()
safe_exit_plane.Translate(rg.Vector3d(0, 0, safe_extit_distance))


script += ur.move_l(safe_exit_plane, safe_accel, safe_vel)
robot_way_planes.append(safe_exit_plane)


# ==============================================================================
# 7. Formats the script "" into UR script 
# ==============================================================================

script = c.concatenate_script(script)

# ==============================================================================
# 8. Change send=True if you want to send to the computer
# ==============================================================================

send = False
if send:
    c.send_script(script, "192.168.10.10")
# ---------- end fabrication ----------
geo_3 = Geometry(fabrication.robot_way_planes)
