# Grasshopper definition 211006_RobotControlMoveJ_PA.ghx (Grasshopper 1.0.7)

layer_height = Slider(1.2, range=0..10)
layer_height_2 = Slider(56, range=0..100)
pt = Point(<point referenced from the Rhino model>)
series = Series(Start=0, Step=layer_height, Count=layer_height_2)
circle = CircleCNR(Center=pt, Normal=Vector(0, 0, 1), Radius=Slider(75, range=0..100))
Z = UnitZ(Factor=series)
resolution = Slider(20, range=0..100)
move = Move(Geometry=circle, Motion=Z)  # -> Geometry, Transform
divide = DivideCurve(Curve=move.Geometry, Count=resolution, Kinks=False)  # -> Points, Tangents, Parameters
xy = XYPlane(Origin=divide.Points)  # -> flatten(Plane)
pline = PolyLine(Vertices=flatten(xy), Closed=False)
fabrication = GhPythonScript(print_way_planes=xy)  # -> out, rhino_base_way_planes, robot_way_planes; inputs print_way_planes: list
# ---------- fabrication: Python ----------
import Rhino.Geometry as rg
import simple_comm as c
import simple_ur_script as ur

import math as m


def tcp(script):
    """ Sets tcp
    Returns:
    script : "set_tcp(p[0.xxxx,0.xxxx,0.xxx,0.xxxx,x.xxxx,x.xxxx])" 
    """
    script += ur.set_tcp_by_angles(
        float(0.0), float(0.0), float(200.0), m.radians(0.0), m.radians(180.0), m.radians(0))
    return script

def set_robot_base_plane_from_pts():
    """ Sets the robot base. 
    1.  Move the robot arm first to the origin in your workspace and copy the cordinates into pt_o (the UR panel (ase cordinate system)
    2.  Move the robot arm to a point on the base planes positive x axis and copy the cordinates into pt_1
    3.  Move the robot arm to a point on the base planes positive xy plane and copy the cordinates into pt_2
    
    ---------
    Returns:
    robot_base: Rhino.Geometry.Plane
    
    """
    
    pt_0 = rg.Point3d(299, 63, 0)   # base plane origin
    pt_1 = rg.Point3d(499, 63, 0)   # point on base plane positive x direction
    pt_2 = rg.Point3d(499, 299, 0)  # point on base plane positive xy

    robot_base = rg.Plane(pt_0, pt_1-pt_0, pt_2-pt_0)
    return robot_base

def rhino_to_robot_space(rhino_plane):
    """ Translates plane from rhino cordinate system (rhino_plane) to robot cordinate system (robot_plane)
    
    ---------
    Paramteres:
    rhino_plane: Rhino.Geometry.Plane 
    
    ---------
    Returns :
    robot_plane: Rhino.Geometry.Plane
    
    """
    robot_plane = rhino_plane.Clone()
    _r_matrix = rg.Transform.PlaneToPlane(
        rg.Plane.WorldXY, set_robot_base_plane_from_pts())
    
    robot_plane.Transform(_r_matrix)
    return robot_plane
    
    
    
# ==============================================================================
# 0. Translates the print_way_planes into the robot_base 
# ==============================================================================

trans_planes = []
for plane in print_way_planes:
    trans_planes.append(rhino_to_robot_space(plane))

# ==============================================================================
# 1. create empty script and a list for visualizing the robot_way_planes
# ==============================================================================

script = ""
robot_way_planes = []

# ==============================================================================
# 2. set tcp (please add the values in the funktion based on the rhino model
# ==============================================================================
script = tcp(script)

# ==============================================================================
# 3. offsets the first way_plane of the robot fabrication to create a safety pt 
# ==============================================================================

safe_vel = 0.1     # m/s
safe_accel = 0.1   # m/s2
safe_distance = 50 # mm


safe_plane = trans_planes[0].Clone()
safe_plane.Translate(rg.Vector3d(0, 0, safe_distance))


script += ur.move_l(safe_plane, safe_accel, safe_vel)
robot_way_planes.append(safe_plane)

# ==============================================================================
# 4. Moves to the first plane and turns on io
# ==============================================================================
entry_plane = trans_planes.pop(0)       # entry plane is the first plane of the fabrication plane. after moving here we remove it.


script += ur.move_l(trans_planes[0], safe_accel, safe_vel)
robot_way_planes.append(trans_planes[0])

script += ur.set_digital_out(5, True)   # i am not sure which Io we are using 
script += ur.sleep(1)                   # Do we need to wait a litle bit when we start the extruder?


# ==============================================================================
# 5. Moves along the trans plane to print the structure.
# ==============================================================================

extrusion_speed = 0.025                 # m/s here we set the speed for the robot during extrusion
extrusion_accel = 0.1                   # m/s2 i do not think we need this value - we are using a blend radius wich overwrites the acceleration
blend_radius    = 0.01                  # blend radius must be less than half the distance between the way_planes



for plane in trans_planes:
    script += ur.move_l_blend(plane, extrusion_accel, blend_radius)
    robot_way_planes.append(plane)
    

# ==============================================================================
# 6. Turns of io and moves away from the strutcure safe_exit_plane
# ==============================================================================
safe_extit_distance = 50

script += ur.set_digital_out(5, False)  # i am not sure which Io we are using 
script += ur.sleep(1)                   # Do we need to wait a litle bit when we turn of the extruder?


safe_exit_plane = trans_planes[-1].Clone()
safe_exit_plane.Translate(rg.Vector3d(0, 0, safe_extit_distance))


script += ur.move_l(safe_exit_plane, safe_accel, safe_vel)
robot_way_planes.append(safe_exit_plane)


# ==============================================================================
# 7. Formats the script "" into UR script 
# ==============================================================================

script = c.concatenate_script(script)

# ==============================================================================
# 8. Change send=True if you want to send to the computer
# ==============================================================================

send = False
if send:
    c.send_script(script, "192.168.10.10")
# ---------- end fabrication ----------
geo = Geometry(fabrication.robot_way_planes)
