# Grasshopper definition 211007_ExtraExcerciseAnswere_PA.ghx (Grasshopper 1.0.7)

geo = Geometry(<curve referenced from the Rhino model>)
python = GhPythonScript(input_curve=geo)  # -> out, planes, path_curve; inputs input_curve: Curve
# ---------- python: Python ----------
import Rhino.Geometry as rg
# ==============================================================================
""" Create a list of points along a curve, offset every second poind accoridng to 
the normal of the cure.
Use the Rhino Common API for help.
https://developer.rhino3d.com/api/RhinoCommon/html/N_Rhino_Geometry.htm
"""
# ==============================================================================



# ==============================================================================
# 0. Divide input_curve and create a list of points
# ==============================================================================
params = input_curve.DivideByCount(50, True)

pts = []

for p in params:
    pt = input_curve.PointAt(p)
    pts.append(pt)


# ==============================================================================
# 1. Create a list of tangents (x-axis) at each pt location 
# ==============================================================================
    
x_axis = []

for p in params:
    x_vec = input_curve.TangentAt(p)
    x_axis.append(x_vec)

# ==============================================================================
# 2. Create y-axis vector (normal) from world Zaxis and the xaxis 
# rg.Vector3d.CrossProduct cross products are crucial when working with vectors https://en.wikipedia.org/wiki/Cross_product
# ==============================================================================


y_axis = []

for x_vec in x_axis:

    yvec = rg.Vector3d.CrossProduct(rg.Vector3d(0,0,1), x_vec)
    y_axis.append(yvec)
    

# ==============================================================================
# 3. offset everey second point in +y direction and every second -y (normal)
# ==============================================================================

new_pts = []
offset_distance = 50

for i in range(len(pts)):
    if i%2==0:
        vector = y_axis[i]*offset_distance
        new_pts.append(pts[i]+vector)
    else:
        vector = y_axis[i]*offset_distance*-1
        new_pts.append(pts[i]+vector)


# ==============================================================================
# 4. Create a polyline trough the origins of the planes to create a ZIG-ZAG curve
# ==============================================================================

path_curve = rg.NurbsCurve.Create(False, 1, new_pts)

# ==============================================================================
# 5. Create planes from the pt, x-axis and y-axis
# ==============================================================================

planes = []

for pt, x_vec, y_vec in zip(new_pts, x_axis, y_axis):
    plane = rg.Plane(pt, x_vec, y_vec)
    planes.append(plane)
# ---------- end python ----------
geo_2 = Geometry(python.planes)
geo_3 = Geometry(python.path_curve)
