# Grasshopper definition 211007_ExtraExcercise_PA.ghx (Grasshopper 1.0.7)

geo = Geometry(<curve referenced from the Rhino model>)
python = GhPythonScript(input_curve=geo)  # -> out, planes, path_curve; inputs input_curve: Curve
# ---------- python: Python ----------
import Rhino.Geometry as rg
# ==============================================================================
""" Create a list of points along a curve, offset every second poind accoridng to 
the normal of the cure.
Use the Rhino Common API for help.
https://developer.rhino3d.com/api/RhinoCommon/html/N_Rhino_Geometry.htm
"""
# ==============================================================================



# ==============================================================================
# 0. Divide input_curve and create a list of points
# ==============================================================================



# ==============================================================================
# 1. Create a list of tangents (x-axis) at each pt location 
# ==============================================================================
    

# ==============================================================================
# 2. Create y-axis vector (normal) from world Zaxis and the xaxis 
# rg.Vector3d.CrossProduct cross products are crucial when working with vectors https://en.wikipedia.org/wiki/Cross_product
# ==============================================================================



    

# ==============================================================================
# 3. offset everey second point in +y direction and every second -y (normal)
# ==============================================================================



# ==============================================================================
# 4. Create a polyline trough the origins of the planes to create a ZIG-ZAG curve
# ==============================================================================



# ==============================================================================
# 5. Create planes from the pt, x-axis and y-axis
# ==============================================================================
# ---------- end python ----------
geo_2 = Geometry(python.planes)
geo_3 = Geometry(python.path_curve)
