# Grasshopper definition 211013_RobotMove1mTcp_PA.gh (Grasshopper 1.0.7)

pt = Point(<point referenced from the Rhino model>)
fabrication = GhPythonScript(rotation_pt=pt, rotation_u=Slider(15, range=-45..45), rotation_v=Slider(5, range=-45..45))  # -> out, plane; inputs rotation_pt: Point3d
# ---------- fabrication: Python ----------
import Rhino.Geometry as rg
import simple_comm as c
import simple_ur_script as ur

import math as m
import random as r

###### plane ######

z_vec = rg.Point3d(0,0,0) - rotation_pt

y_vec = rg.Vector3d(0,0,1)

x_vec = rg.Vector3d.CrossProduct(y_vec, z_vec)

plane = rg.Plane(rotation_pt, x_vec, y_vec)

planes = []
for i in range (50):
    if i %2==0:
        rot_u = -40#r.randint(-30,30)
        rot_v = 0 #r.randint(-15,15)
    else:
        rot_u = 30
        rot_v = 0
        
    copy_plane = rg.Plane.Clone(plane)
    copy_plane.Rotate(m.radians(rot_u), plane.XAxis, plane.Origin)
    copy_plane.Rotate(m.radians(rot_v), plane.YAxis, plane.Origin)
    planes.append(copy_plane)
        


script = ""

script += ur.set_tcp_by_angles(
    float(0.0), float(0.0), float(1040.0), m.radians(0.0), m.radians(180.0), m.radians(0))


robot_way_planes = []




safe_vel = 0.02     # m/s
safe_accel = 0.01   # m/s2



for plane in planes:
    script += ur.move_l(plane, safe_accel, safe_vel)

script = c.concatenate_script(script)
print script 

send = True

if send:
    c.send_script(script, "192.168.10.10")
# ---------- end fabrication ----------
geo = Geometry(fabrication.plane)
deplane = DeconstructPlane(Plane=geo)  # -> Origin, XAxis, YAxis, ZAxis
vdis = VectorDisplay(Anchor=deplane.Origin, Vector=deplane.ZAxis)
