# Grasshopper definition 211215_Catenary_PA.ghx (Grasshopper 1.0.7)

python = GhPythonScript(target_deflection=Slider(42, range=0..100))  # -> out, catenaries, path_length, robot_planes; inputs target_deflection: Int32
# ---------- python: Python ----------
import Rhino.Geometry as rg
import ghpythonlib as gh



def generateCatenary(plane_1, plane_2, target_deflection):
    
    pt_0 = plane_1.Origin
    pt_1 = plane_2.Origin
    
    #target_deflection = 60
    
    
    
    distance = pt_0.DistanceTo(pt_1)
    catenary_geuss = distance * 1.2
    
    catenary = gh.components.Catenary(pt_0, pt_1, catenary_geuss, rg.Vector3d(0,0,-1))
    mid_pt = catenary.PointAtNormalizedLength(0.5)
    deflection = pt_0.Z - mid_pt.Z
    
    for i in range (250):
        
        if deflection < target_deflection:
            catenary_geuss += 0.25
        else:
            catenary_geuss -= 0.25
        
        
        catenary = gh.components.Catenary(pt_0, pt_1, catenary_geuss, rg.Vector3d(0,0,-1))
        mid_pt = catenary.PointAtNormalizedLength(0.5)
        deflection = pt_0.Z - mid_pt.Z
    
    return catenary

plane_1 = rg.Plane(rg.Point3d(0,0,0), rg.Vector3d.XAxis, rg.Vector3d.YAxis)
plane_2 = rg.Plane(rg.Point3d(100,0,0), rg.Vector3d.XAxis, rg.Vector3d.YAxis)



### test for 10 layers ####

layer_thickness  = 1.8
deflection_layer_thickness = 3

catenaries = []

path_length = []

robot_planes = []

for i in range (10):
    temp_plane_1 = plane_1.Clone()
    temp_plane_1.Translate(rg.Vector3d(0,0,layer_thickness*i))
    
    
    temp_plane_1_1 = plane_1.Clone()
    temp_plane_1_1.Translate(rg.Vector3d(layer_thickness*i,0,layer_thickness*i))
    
    temp_line_1 = rg.NurbsCurve.Create(False, 1, [temp_plane_1.Origin, temp_plane_1_1.Origin])
    
    
    temp_plane_2 = plane_2.Clone()
    temp_plane_2.Translate(rg.Vector3d(0,0,layer_thickness*i))
    
    temp_plane_2_1 = plane_2.Clone()
    temp_plane_2_1.Translate(rg.Vector3d(-layer_thickness*i,0,layer_thickness*i))
    
    
    temp_line_2 = rg.NurbsCurve.Create(False, 1, [temp_plane_2.Origin, temp_plane_2_1.Origin])
    
    catenary = generateCatenary(temp_plane_1_1, temp_plane_2_1, target_deflection- (i*deflection_layer_thickness))
    
    test = rg.Curve.JoinCurves([temp_line_1, catenary, temp_line_2])
    
    crv = test[0]
    
    catenaries.append(crv) 
    path_length.append(crv.GetLength())
    
    robot_planes.append([temp_plane_1, temp_plane_2])
# ---------- end python ----------
panel = Panel(python.path_length)
geo = Geometry(python.catenaries)
python_2 = GhPythonScript(catenary=python.catenaries, path_lengths=python.path_length, robot_planes=python.robot_planes)  # -> out, robot_velocities; inputs catenary: list of Curve, path_lengths: list, robot_planes: list
# ---------- python_2: Python ----------
import Rhino.Geometry as rg

extursion_vel = 9 # mm/s

robot_velocities = []
for length, plane_pair in zip(path_lengths, robot_planes):
    
    pt_0 = plane_pair[0].Origin
    pt_1 = plane_pair[1].Origin
    
    
    robot_distance = pt_0.DistanceTo(pt_1)
    
    robot_vel = robot_distance/ length* extursion_vel
    robot_velocities.append(robot_vel)
# ---------- end python_2 ----------
robotic_fabrication = GhPythonScript(robot_velocities=python_2.robot_velocities)  # -> out, a; unedited script template
