# Grasshopper definition 01_primitives + subdivision.ghx (Grasshopper 1.0.7)

# ---- group: a triangle fan using polar coordinates
ghpython_script = GhPythonScript()  # -> out, a
# ---------- ghpython_script: Python ----------
import sys

#change this path to point to where your local mola folder is saved
#for windows users switch "\" to "/"
path = "C:/Users/pj_30/OneDrive/Desktop/Github"
if path not in sys.path:
    sys.path.append(path)

import mola
from mola import module_rhino

import math

# create a new empty mesh
m3 = mola.Mesh()
num_corners = 5
radius = 10

# add a ring of vertices using polar coordinates
step = math.pi * 2 / num_corners
for i in range(num_corners):
    angle = i * step
    x = radius * math.cos(angle)
    y = radius * math.sin(angle)
    #v = mola.Vertex(x, y, 0)
    #m3.vertices.append(v)
    m3.add_vertex(x, y)

# create a center vertex at the origin
cen = mola.Vertex(0,0,7)
m3.vertices.append(cen)

# add triangular faces
for i in range(num_corners):
    # walk along the ring
    # v1 is the current vertex, v2 the next
    # if v1 is the last, v2 is the first again
    # this is done with modulo
    # i goes from 0 to num_corners-1, if i+1 == num_corners -> 0
    v0 = m3.vertices[i]
    vnext = m3.vertices[(i+1)%num_corners]
    f = mola.Face([v0, vnext, cen])
    m3.faces.append(f)

a = module_rhino.display_mesh(m3)
# ---------- end ghpython_script ----------

# ---- group: simple mesh quad
# mesh from scratch
ghpython_script_2 = GhPythonScript()  # -> out, a
# ---------- ghpython_script_2: Python ----------
import sys

#change this path to point to where your local mola folder is saved
#for windows users switch "\" to "/"
path = "C:/Users/pj_30/OneDrive/Desktop/Github"
if path not in sys.path:
    sys.path.append(path)

import mola
from mola import module_rhino

# create an empty mesh
m = mola.Mesh()

# define a series of vertices
a = mola.Vertex(0, 0, 0)
b = mola.Vertex(15, 0, 0)
c = mola.Vertex(15, 10, 0)
d = mola.Vertex(0, 10, 0)

# add the vertices to the mesh
m.vertices.append(a)
m.vertices.append(b)
m.vertices.append(c)
m.vertices.append(d)
# m.vertices.extend([a,b,c,d])

# define a face from these vertices and add it to the mesh
f = mola.Face([a,b,c,d])
m.faces.append(f)
f.color = (0.6,0.67,0.73,1)

a = module_rhino.display_mesh(m)

help(mola.Mesh)
# ---------- end ghpython_script_2 ----------

# ---- group: a triangle fan using polar coordinates
ghpython_script_3 = GhPythonScript()  # -> out, a
# ---------- ghpython_script_3: Python ----------
import sys

#change this path to point to where your local mola folder is saved
#for windows users switch "\" to "/"
path = "C:/Users/pj_30/OneDrive/Desktop/Github"
if path not in sys.path:
    sys.path.append(path)

import mola
from mola import module_rhino

import random

m2 = mola.Mesh()
nx = 16
ny = 9

for y in range(ny):
    for x in range(nx):
        z = random.random() * 0.8
        m2.vertices.append(mola.Vertex(x, y, z))

for y in range(ny-1):
    for x in range(nx-1):
        v1 = m2.vertices[y * nx + x]
        v2 = m2.vertices[y * nx + (x + 1)]
        v3 = m2.vertices[(y + 1) * nx + (x + 1)]
        v4 = m2.vertices[(y + 1) * nx + x]
        f = mola.Face([v1, v2, v3, v4])
        m2.faces.append(f)

a = module_rhino.display_mesh(m2)
# ---------- end ghpython_script_3 ----------

# ----
mesh = Mesh(ghpython_script.a)
mesh_2 = Mesh(ghpython_script_2.a)
mesh_3 = Mesh(ghpython_script_3.a)

ghpython_script_4 = GhPythonScript()  # -> out, a
# ---------- ghpython_script_4: Python ----------
import sys

#change this path to point to where your local mola folder is saved
#for windows users switch "\" to "/"
path = "C:/Users/pj_30/OneDrive/Desktop/Github"
if path not in sys.path:
    sys.path.append(path)

import mola
from mola import module_rhino

# construct an icosahedron and subdivide iteratively, using the rule 'extrudeToPointCenter'
# mesh=mola.construct_box(-4,-3,-3,4,3,3)
mesh = mola.construct_icosahedron(5)
numberOfIterations = 1

for i in range(numberOfIterations):
    newMesh=mola.Mesh()
    for face in mesh.faces:
        # the extrusion height is dependent on the current iteration index
        resultingfaces=mola.subdivide_face_extrude_to_point_center(face,1/(i+1))
        newMesh.faces.extend(resultingfaces)
    mesh=newMesh

for i in range(numberOfIterations):
    newMesh=mola.Mesh()
    for face in mesh.faces:
        # the extrusion height is dependent on the current iteration index
        resultingfaces=mola.subdivide_face_extrude_tapered(face,1/(i+1),0.2, doCap=False)
        newMesh.faces.extend(resultingfaces)
    mesh=newMesh 

for i,f in enumerate(mesh.faces):
    fa = mola.face_area(f)
    fp = mola.face_perimeter(f)
    f.color = (1,0,0,1)
    if i%2==0:
        f.color = (0,1,0,1)

a = module_rhino.display_mesh(mesh)
# ---------- end ghpython_script_4 ----------
mesh_4 = Mesh(ghpython_script_4.a)

value_list = ValueList({"Overhang": 0, "Curvature": 1, "Area": 2, "Perimeter": 3, "Compactness": 4, "Horizontal_Angle": 5}, selected="Horizontal_Angle")
# primitives
number_slider = Slider(-5, range=-5..5)

# ---- group: cone
ghpython_script_5 = GhPythonScript(
    z1=Slider(-5, range=-10..10),
    z2=Slider(10, range=-10..10),
    r1=Slider(10, range=-10..10),
    r2=Slider(6, range=0..10),
    nSegments=Slider(9, range=0..10))  # -> out, a, my_cone; inputs nSegments: Int32
# ---------- ghpython_script_5: Python ----------
import sys

#change this path to point to where your local mola folder is saved
#for windows users switch "\" to "/"
path = "C:/Users/pj_30/OneDrive/Desktop/Github"
if path not in sys.path:
    sys.path.append(path)

import mola
from mola import module_rhino

# construct a truncated cone using the z-heights and radii of the bottom and top.

my_cone = mola.construct_cone(z1,z2,r1,r2,nSegments)
# color mesh faces by their area
mola.color_faces_by_area(my_cone.faces)


a = module_rhino.display_mesh(my_cone)
# ---------- end ghpython_script_5 ----------

# ---- group: icosahedron
ghpython_script_6 = GhPythonScript(radius=Slider(16, range=0..100))  # -> out, my_icosahedron, a
# ---------- ghpython_script_6: Python ----------
import sys

#change this path to point to where your local mola folder is saved
#for windows users switch "\" to "/"
path = "C:/Users/pj_30/OneDrive/Desktop/Github"
if path not in sys.path:
    sys.path.append(path)

import mola
from mola import module_rhino

# construct a dodecahedron
my_icosahedron = mola.construct_icosahedron(radius)

a = module_rhino.display_mesh(my_icosahedron)
# ---------- end ghpython_script_6 ----------

# ---- group: tetrahedron
ghpython_script_7 = GhPythonScript(radius=Slider(16, range=0..100))  # -> out, a
# ---------- ghpython_script_7: Python ----------
import sys

#change this path to point to where your local mola folder is saved
#for windows users switch "\" to "/"
path = "C:/Users/pj_30/OneDrive/Desktop/Github"
if path not in sys.path:
    sys.path.append(path)

import mola
from mola import module_rhino

# construct and render a tetrahedron
my_tetrahedron = mola.construct_tetrahedron(20)

a = module_rhino.display_mesh(my_tetrahedron)
# ---------- end ghpython_script_7 ----------

# ---- group: dodecahedron
ghpython_script_8 = GhPythonScript(radius=Slider(5, range=0..5))  # -> out, a
# ---------- ghpython_script_8: Python ----------
import sys

#change this path to point to where your local mola folder is saved
#for windows users switch "\" to "/"
path = "C:/Users/pj_30/OneDrive/Desktop/Github"
if path not in sys.path:
    sys.path.append(path)

import mola
from mola import module_rhino

# construct a dodecahedron
my_dodecahedron = mola.construct_dodecahedron(radius)

print(len(my_dodecahedron.faces))
print(len(my_dodecahedron.faces[0].vertices))

a = module_rhino.display_mesh(my_dodecahedron)

help(mola.Mesh)
# ---------- end ghpython_script_8 ----------

# ---- group: torus +
ghpython_script_9 = GhPythonScript(
    ringRadius=Slider(12, range=0..100),
    tubeRadius=Slider(8, range=0..100),
    ringN=Slider(13, range=0..100),
    tubeN=Slider(6, range=0..100),
    criteria=value_list)  # -> out, a, spheres; inputs ringN: Int32, tubeN: Int32
# ---------- ghpython_script_9: Python ----------
import sys

#change this path to point to where your local mola folder is saved
#for windows users switch "\" to "/"
path = "C:/Users/pj_30/OneDrive/Desktop/Github"
if path not in sys.path:
    sys.path.append(path)

import mola
from mola import module_rhino

my_torus = mola.construct_torus(ringRadius, tubeRadius, ringN, tubeN)
# color mesh faces by their angle to the z-axis

if criteria == 0:
    mola.color_faces_by_vertical_angle(my_torus.faces)
elif criteria ==1:
    mola.color_faces_by_curvature(my_torus.faces)
elif criteria ==2:
    mola.color_faces_by_area(my_torus.faces)
elif criteria ==3:
    mola.color_faces_by_perimeter(my_torus.faces)
elif criteria ==4:
    mola.color_faces_by_compactness(my_torus.faces)
elif criteria ==5:
    mola.color_faces_by_horizontal_angle(my_torus.faces)

a = module_rhino.display_mesh(my_torus)

#make a sphere for every vertex
spheres = []
for v in my_torus.vertices:
    radius = mola.math_map(v.z,-4,4,0.5,1)
    s = mola.construct_sphere(radius, v.x, v.y, v.z, 9, 9)
    temp = module_rhino.display_mesh(s)
    spheres.append(temp)
# ---------- end ghpython_script_9 ----------

# ---- group: box
ghpython_script_10 = GhPythonScript(
    x1=number_slider,
    y1=Slider(-4, range=-5..5),
    z1=Slider(-3, range=-5..5),
    x2=Slider(5, range=-5..5),
    y2=Slider(4, range=-5..5),
    z2=Slider(3, range=-5..5))  # -> out, a, my_box
# ---------- ghpython_script_10: Python ----------
import sys

#change this path to point to where your local mola folder is saved
#for windows users switch "\" to "/"
path = "C:/Users/pj_30/OneDrive/Desktop/Github"
if path not in sys.path:
    sys.path.append(path)

import mola
from mola import module_rhino

#construct a Box Mesh using the mola library's factory.
my_box = mola.construct_box(x1, y1, z1, x2, y2, z2)

a = module_rhino.display_mesh(my_box)

# print the number of faces of the mesh
print(len(my_box.faces))
print(len(my_box.vertices))

# print the number of vertices on a face of the mesh
print(len(my_box.faces[0].vertices))

# print the vertex positions
for v in my_box.vertices:
    print(repr(v))
# ---------- end ghpython_script_10 ----------

# ----
rhino_mesh = Mesh(ghpython_script_5.a)
mesh_5 = Mesh(ghpython_script_10.a)
mesh_6 = Mesh(ghpython_script_8.a)
mesh_7 = Mesh(ghpython_script_7.a)
mesh_8 = Mesh(ghpython_script_6.a)
mesh_9 = Mesh(ghpython_script_9.a)
mesh_10 = Mesh(ghpython_script_9.spheres)

# ---- group: split roof
ghpython_script_11 = GhPythonScript(mesh=ghpython_script_6.my_icosahedron, numberOfIterations=Slider(3, range=0..10))  # -> out, a; inputs numberOfIterations: Int32
# ---------- ghpython_script_11: Python ----------
import sys

#change this path to point to where your local mola folder is saved
#for windows users switch "\" to "/"
path = "C:/Users/pj_30/OneDrive/Desktop/Github"
if path not in sys.path:
    sys.path.append(path)

import mola
from mola import module_rhino

for i in range(numberOfIterations):
    newMesh = mola.Mesh()
    for face in mesh.faces:
    # the height of the roof is dependent on the current iteration index
        roofHeight = 3 / (i * 2 + 1)
        resultingfaces = mola.subdivide_face_split_roof(face,roofHeight)
        newMesh.faces.extend(resultingfaces)
    mesh = newMesh

mola.color_faces_by_area(mesh.faces)

a = module_rhino.display_mesh(mesh)
# ---------- end ghpython_script_11 ----------

# ---- group: split tapered
ghpython_script_12 = GhPythonScript(mesh=ghpython_script_10.my_box, numberOfIterations=Slider(1, range=0..10))  # -> out, a; inputs numberOfIterations: Int32
# ---------- ghpython_script_12: Python ----------
import sys

#change this path to point to where your local mola folder is saved
#for windows users switch "\" to "/"
path = "C:/Users/pj_30/OneDrive/Desktop/Github"
if path not in sys.path:
    sys.path.append(path)

import mola
from mola import module_rhino

for i in range(numberOfIterations):
    
    newMesh = mola.Mesh()
    for face in mesh.faces:
        resultingfaces = mola.subdivide_face_extrude_tapered(face,3,0.5,doCap=False)
        newMesh.faces.extend(resultingfaces)
    mesh = newMesh

mola.color_faces_by_area(mesh.faces)

a = module_rhino.display_mesh(mesh)
# ---------- end ghpython_script_12 ----------

# ---- group: extrude to center
ghpython_script_13 = GhPythonScript(mesh=ghpython_script_10.my_box, numberOfIterations=Slider(5, range=0..10))  # -> out, a; inputs numberOfIterations: Int32
# ---------- ghpython_script_13: Python ----------
import sys

#change this path to point to where your local mola folder is saved
#for windows users switch "\" to "/"
path = "C:/Users/pj_30/OneDrive/Desktop/Github"
if path not in sys.path:
    sys.path.append(path)

import mola
from mola import module_rhino

for i in range(numberOfIterations):
    newMesh=mola.Mesh()
    for face in mesh.faces:
    # the extrusion height is dependent on the current iteration index
        resultingfaces=mola.subdivide_face_extrude_to_point_center(face,1/(i+1))
        newMesh.faces.extend(resultingfaces)
    mesh=newMesh

mola.color_faces_by_vertical_angle(mesh.faces)

a = module_rhino.display_mesh(mesh)
# ---------- end ghpython_script_13 ----------

# ---- group: face extrude
# subdivision
ghpython_script_14 = GhPythonScript(mesh=ghpython_script_5.my_cone)  # -> out, a
# ---------- ghpython_script_14: Python ----------
import sys

#change this path to point to where your local mola folder is saved
#for windows users switch "\" to "/"
path = "C:/Users/pj_30/OneDrive/Desktop/Github"
if path not in sys.path:
    sys.path.append(path)

import mola
from mola import module_rhino

extrusion = 4

newMesh = mola.Mesh()
for face in mesh.faces:
  resultingFaces = mola.subdivide_face_extrude(face,extrusion)
  newMesh.faces.extend(resultingFaces)

mesh = newMesh
mola.color_faces_by_area(mesh.faces)

a = module_rhino.display_mesh(mesh)
# ---------- end ghpython_script_14 ----------
