# Grasshopper definition 02_gradation.ghx (Grasshopper 1.0.7)

# ---- group: windows and offset
ghpython_script = GhPythonScript()  # -> out, a
# ---------- ghpython_script: Python ----------
import sys

#change this path to point to where your local mola folder is saved
#for windows users switch "\" to "/"
path = "C:/Users/pj_30/OneDrive/Desktop/Github"
if path not in sys.path:
    sys.path.append(path)

import mola
from mola import module_rhino

mesh = mola.construct_cone(0,10,10,5,6)

for i in range(2):
  mesh = mola.subdivide_mesh_catmull(mesh)

new_mesh = mola.Mesh()
for face in mesh.faces:
    new_mesh.faces.extend(mola.subdivide_face_extrude_tapered(face,0,0.3,False))

new_mesh.update_topology()
new_mesh = mola.mesh_offset(new_mesh, 0.8)

for i in range(2):
  new_mesh = mola.subdivide_mesh_catmull(new_mesh)

mola.color_faces_by_curvature(new_mesh.faces)

a = module_rhino.display_mesh(new_mesh)
# ---------- end ghpython_script ----------

# ---- group: Functionally graded mesh structure
ghpython_script_2 = GhPythonScript()  # -> out, a
# ---------- ghpython_script_2: Python ----------
import sys

#change this path to point to where your local mola folder is saved
#for windows users switch "\" to "/"
path = "C:/Users/pj_30/OneDrive/Desktop/Github"
if path not in sys.path:
    sys.path.append(path)

import mola
import math
from mola import module_rhino

my_sphere = mola.construct_sphere(radius=5,u_res=8,v_res=8)
# turn sphere into egg
for v in my_sphere.vertices:
    if (v.z>0):
        # v.z*=1.8
        v.z = v.z * 1.8

my_sphere = mola.subdivide_mesh_catmull(my_sphere)

face_angles = my_sphere.face_properties(mola.face_angle_vertical)

for i in range(len(face_angles)):
    face_angles[i] = abs(math.pi - abs(face_angles[i]))
face_angles = mola.math_map_list(face_angles, 0.1, 1)

z_positions = my_sphere.face_properties(mola.face_center_z)
fractions = mola.math_map_list(z_positions, 1, 0.1)

heights = [0.3] * len(my_sphere.faces)
fractions = [0.5] * len(my_sphere.faces)
doCaps = [True] * len(my_sphere.faces)
#
import random
#
for i in range(len(face_angles)):
    face_angles[i] *= random.random()

for i in range(len(doCaps)):
    if z_positions[i] > 0.2:
        doCaps[i] = False
#
mola.color_faces_by_values(my_sphere.faces, z_positions)
my_sphere = mola.subdivide_mesh_extrude_tapered(my_sphere, face_angles, fractions, doCaps)
#
my_sphere = mola.subdivide_mesh_catmull(my_sphere)
my_sphere = mola.mesh_offset(my_sphere, 0.2)
#
colors = my_sphere.face_properties(mola.face_center_z)
mola.color_faces_by_values(my_sphere.faces, colors)

a = module_rhino.display_mesh(my_sphere)
# ---------- end ghpython_script_2 ----------
