# Grasshopper definition 04_city.ghx (Grasshopper 1.0.7)

point = Point(Point(-0.6892432225, 0, 0))
point_2 = Point(Point(1.600812064, 2.496045628, 0))

# ---- group: city generator
ghpython_script = GhPythonScript(pointA=point, pointB=point_2, iterations=Slider(0, range=0..5))  # -> out, a; inputs pointA: Point3d, pointB: Point3d, iterations: Int32
# ---------- ghpython_script: Python ----------
import sys
#change this path to point to where your local mola folder is saved
#for windows users switch "\" to "/"
path = "C:/Users/pj_30/OneDrive/Desktop/Github"
if path not in sys.path:
    sys.path.append(path)

import mola
from mola import module_rhino
import random
random.seed = 1

def subdivide_by_ftype(mesh):
    
    newMesh = mola.Mesh()
    
    for face in mesh.faces:
        
        if face.group == "plot":
            
            new_faces = mola.subdivide_face_extrude_tapered(face, 0.0, 0.45, True)
            for f in new_faces[:-1]:
                f.group = "circulation"
                f.color = (1,0,0)
            new_faces[-1].group = "construction"
            newMesh.faces.extend(new_faces)
                
        elif face.group == "construction":
            print random.random()
            if random.random() < 0.2:
                # make a park
                new_faces = mola.subdivide_face_extrude_to_point_center(face, 0.1)
                for f in new_faces:
                    f.group = "park"
                    f.color = (1,1,0)
                newMesh.faces.extend(new_faces)
            else:
                #make a building
                num = random.randint(5,10)
                for i in range(num):

                    r = random.random() * 0.6 - 0.3
                    new_faces = mola.subdivide_face_extrude_tapered(face, 0.1, r, True)
                    for f in new_faces[:-1]:
                        f.group = "facade"
                        f.color = (0,0,1)
                    new_faces[-1].color = (0,1,1)
                    new_faces[-1].group = "roof"
                    newMesh.faces.extend(new_faces)
        else:
            
            newMesh.faces.append(face)
#            else:
#                # make a building
#                num = random.randint(5,10)
#                temp_fk = fk
#                for i in range(num):
#
#                    r = random.random() * 0.6 - 0.3
#                    new_keys = msd.taper_face(mesh, temp_fk, height=0.1, ratio=r, doCap = True, keep_original=True)
#
#                    for key in new_keys[:-1]:
#                        mesh.face_attribute(key, 'ftype', 'facade')
#                    mesh.face_attribute(temp_fk, 'ftype', 'floor')
#                    temp_fk = new_keys[-1]
#                mesh.face_attribute(temp_fk, 'ftype', 'roof')

#        elif ftype=='facade':
#            # make a facade
#            fvs = mesh.face_vertices(fk)
#            facade_length = mesh.edge_length(fvs[0],fvs[1])
#            num_subdivisions = int(facade_length/0.05)
#            if num_subdivisions>1:
#                new_keys = msd.segment_face(mesh, fk, num=num_subdivisions)
#                for key in new_keys:
#                    mesh.face_attribute(key, 'ftype', 'panel')
#            else:
#                mesh.face_attribute(fk, 'ftype', 'panel')

    return newMesh


mesh = mola.Mesh()
#a = mesh.add_vertex(pointA.X, pointA.Y, z=0)
#b = mesh.add_vertex(pointA.X, pointB.Y, z=0)
#c = mesh.add_vertex(pointB.X, pointB.Y, z=0)
#d = mesh.add_vertex(pointB.X, pointA.Y, z=0)

a = mesh.add_vertex(x=0, y=0, z=0)
b = mesh.add_vertex(x=1, y=0, z=0)
c = mesh.add_vertex(x=1, y=1, z=0)
d = mesh.add_vertex(x=0, y=1, z=0)


f = mesh.add_face([a, b, c, d])

newMesh = mola.Mesh()
for face in mesh.faces:
    new_faces = mola.subdivide_face_extrude_to_point_center(face)
    newMesh.faces.extend(new_faces)
mesh = newMesh

newMesh = mola.Mesh()
for face in mesh.faces:
    new_faces = mola.subdivide_face_extrude_to_point_center(face)
    newMesh.faces.extend(new_faces)
mesh = newMesh

newMesh = mola.Mesh()
for face in mesh.faces:
    print len(face.vertices)
    new_faces = mola.subdivide_face_split_grid(face,2,1)
    for f in new_faces:
        f.group = "plot"
    newMesh.faces.extend(new_faces)
mesh = newMesh

for i in range(iterations):
    
    temp = subdivide_by_ftype(mesh)
    print len(temp.faces)
    mesh = temp
    
a = module_rhino.display_mesh(mesh)
# ---------- end ghpython_script ----------

# ----
mesh = Mesh(ghpython_script.a)
face_normals = FaceNormals(Mesh=mesh)  # -> Centers, Normals
amplitude = Amplitude(Vector=face_normals.Normals, Amplitude=Slider(1, range=0..100))
vector_display = VectorDisplay(Anchor=face_normals.Centers, Vector=amplitude)
