# Grasshopper definition 05_SubDiv Components.ghx (Grasshopper 1.0.7)
# plug-ins: MeshEdit Components, Bifocals, Subdivision Info

mesh_sphere = MeshSphere(Base=PlaneXY(0, 0, 0), Radius=Slider(10, range=0..10), UCount=Slider(10, range=0..10), VCount=Slider(10, range=0..10))
mesh_explode = MeshExplode(Mesh=mesh_sphere, Interpolate=False)
deconstruct_mesh = DeconstructMesh(Mesh=mesh_explode)  # -> Vertices, Faces, Colours, Normals
list_length = ListLength(List=deconstruct_mesh.Vertices)  # -> flatten(Length)
smaller_than = SmallerThan(FirstNumber=list_length, SecondNumber="4")  # -> SmallerThan, OrEqualTo
cull_pattern = CullPattern(List=mesh_explode, CullPattern=invert(smaller_than.SmallerThan))
number_slider = Slider(1, range=0..1)
mesh_join = MeshJoin(Meshes=cull_pattern)
panel = Panel("""0
1
2
3
4
5""")
mesh_box = MeshBox(
    Base={Plane=PlaneXY(0, 0, 0), X=Domain(-10, 10), Y=Domain(-10, 10), Z=Domain(-10, 10)},
    XCount=number_slider,
    YCount=number_slider,
    ZCount=number_slider)
list_length_2 = ListLength(List=cull_pattern)
panel_2 = Panel("""0
1""")
subdivision_catmull = SubdivisionCatmull(Mesh=mesh_box, FacesExtrusion=Slider(0, range=0..10), FacesGroup=panel)  # -> Mesh, FacesGroup, VerticesLocked, VerticesGeneration
repeat_data = RepeatData(Data=panel_2, Length=list_length_2)

# ---- group: split faces to their centers
subdivision = Subdivision(
    Mesh=subdivision_catmull.Mesh,
    FacesGroup=subdivision_catmull.FacesGroup,
    VerticesLocked=False,
    VerticesGeneration=subdivision_catmull.VerticesGeneration)  # -> Mesh, FacesGroup, VerticesLocked, VerticesGeneration

# ----
subdivision_taper = SubdivisionTaper(
    Mesh=mesh_join,
    FacesExtrusion=Slider(10, range=0..10),
    FacesInset=0.25,
    FacesClose=True,
    FacesGroup=repeat_data,
    VerticesLocked=False,
    VerticesGeneration=1)  # -> Mesh, FacesGroup, VerticesLocked, VerticesGeneration
panel_3 = Panel("""0
0
0
0
1""")
list_length_3 = ListLength(List=subdivision_taper.FacesGroup)
repeat_data_2 = RepeatData(Data=panel_3, Length=list_length_3)
face_analyse = FaceAnalyse(Mesh=subdivision.Mesh)  # -> Mesh, Values
smaller_than_2 = SmallerThan(FirstNumber=repeat_data_2, SecondNumber=expr("1", 0))  # -> SmallerThan, OrEqualTo
mesh_explode_2 = MeshExplode(Mesh=subdivision_taper.Mesh, Interpolate=False)
bounds = Bounds(Numbers=face_analyse.Values)
cull_pattern_2 = CullPattern(List=mesh_explode_2, CullPattern=invert(smaller_than_2.SmallerThan))
cull_pattern_3 = CullPattern(List=mesh_explode_2, CullPattern=smaller_than_2.SmallerThan)
remap_numbers = RemapNumbers(Value=face_analyse.Values, Source=bounds, Target="0 To 20")  # -> Mapped, Clipped
cull_pattern_4 = CullPattern(List=cull_pattern_2, CullPattern=[False, True])
mesh_join_2 = MeshJoin(Meshes=cull_pattern_4)
subdivision_taper_2 = SubdivisionTaper(
    Mesh=face_analyse.Mesh,
    FacesExtrusion=remap_numbers.Mapped,
    FacesInset=0.25,
    FacesClose=Toggle(False),
    FacesGroup=subdivision.FacesGroup,
    VerticesLocked=False,
    VerticesGeneration=subdivision.VerticesGeneration)  # -> Mesh, FacesGroup, VerticesLocked, VerticesGeneration
subdivision_taper_3 = SubdivisionTaper(
    Mesh=mesh_join_2,
    FacesExtrusion=Slider(15, range=0..100),
    FacesInset=0.25,
    FacesClose=True,
    FacesGroup=1,
    VerticesLocked=False,
    VerticesGeneration=1)  # -> Mesh, FacesGroup, VerticesLocked, VerticesGeneration
subdivision_catmull_2 = SubdivisionCatmull(Mesh=subdivision_taper_3.Mesh)  # -> Mesh, FacesGroup, VerticesLocked, VerticesGeneration
mesh_colorise = MeshColorise(Mesh=subdivision_taper_2.Mesh, Values=subdivision_taper_2.FacesGroup)
offset = Offset(Mesh=mesh_colorise, Offset=Slider(2, range=0..10))
subdivision_catmull_3 = SubdivisionCatmull(Mesh=offset)  # -> Mesh, FacesGroup, VerticesLocked, VerticesGeneration
subdivision_catmull_4 = SubdivisionCatmull(Mesh=subdivision_catmull_3.Mesh)  # -> Mesh, FacesGroup, VerticesLocked, VerticesGeneration
face_analyse_2 = FaceAnalyse(Mesh=subdivision_catmull_4.Mesh)  # -> Mesh, Values
subdivision_pyramide = SubdivisionPyramide(
    Mesh=subdivision_catmull_4.Mesh,
    FacesExtrusion=face_analyse_2.Values,
    FacesGroup=1,
    VerticesLocked=False,
    VerticesGeneration=1)  # -> Mesh, FacesGroup, VerticesLocked, VerticesGeneration
