# Grasshopper definition 05_column with subdi.ghx (Grasshopper 1.0.7)

# ---- group: double click to open
ghpython_script = GhPythonScript(radius=Slider(5, range=0..10), extrusion=Slider(15, range=0..100))  # -> out, a
# ---------- ghpython_script: Python ----------
import sys

#change this path to point to where your local mola folder is saved
#for windows users switch "\" to "/"
path = "C:/Users/pj_30/OneDrive/Desktop/Github"
if path not in sys.path:
    sys.path.append(path)

import mola
from mola import module_rhino

mesh = mola.construct_sphere(radius)
new_mesh = mola.Mesh()

for f in mesh.faces:
    new_faces = mola.subdivide_face_extrude_to_point_center(f,extrusion)
    new_mesh.faces.extend(new_faces)
new_mesh.update_topology()

for i in range(3):
    new_mesh = mola.subdivide_mesh_catmull(new_mesh)
mola.color_faces_by_curvature(new_mesh.faces)



a = module_rhino.display_mesh(new_mesh)
# ---------- end ghpython_script ----------
