# Grasshopper definition example_1.gh (Grasshopper 1.0.7)
# plug-ins: Axolotl Info

# ---- group: CSG
# Primitives
X = UnitX(Factor=1)
Y = UnitY(Factor=1)
Z = UnitZ(Factor=1)
number_slider = Slider(9, range=0..10)
pl = PlaneNormal(Origin=Point(0, 0, 0), ZAxis=[X, Y, Z])
box = Box(DimensionX=number_slider, DimensionY=number_slider, DimensionZ=number_slider, Radius=0, Plane=PlaneXY(0, 0, 0))
sphere = Sphere(Radius=Slider(6, range=0..10), Center=Point(0, 0, 0))
cylinder = Cylinder(Radius=Slider(3, range=0..10), Height=Slider(12, range=0..20), Plane=pl, Fillet=0)

# ----
# Random Planes for Edges
number_slider_2 = Slider(3.4, range=0..10)
sph = Sphere(Base=PlaneXY(0, 0, 0), Radius=number_slider_2)
popgeo = PopulateGeometry(Geometry=sph, Count=Slider(9, range=0..10), Seed=1)
pl_2 = PlaneNormal(Origin=popgeo, ZAxis=popgeo)

# ----
# Bounding Box
number_slider_3 = Slider(5, range=0..10)
neg = Negative(Value=number_slider_3)
dom = ConstructDomain(DomainStart=neg, DomainEnd=number_slider_3)
box_2 = DomainBox(Base=PlaneXY(0, 0, 0), X=dom, Y=dom, Z=dom)
edges = BrepEdges(Brep=box_2)  # -> Naked, Interior, NonManifold

# ---- group: CSG
# Boolean Operators
boolean_intersect = BooleanIntersect(DistanceObjectS=sphere, DistanceObject=box)
boolean_union = BooleanUnion(DistanceObjectS=cylinder)
boolean_subtract = BooleanSubtract(DistanceObject=boolean_intersect, DistanceObject_2=boolean_union)

# ----
# Square edge profiles
# Blended smoothly with a central sphere
dimension_x_y = Slider(1.5, range=0..10)
box_3 = Box(
    DimensionX=dimension_x_y,
    DimensionY=dimension_x_y,
    DimensionZ=Slider(3.5, range=0..10),
    Radius=Slider(0.3, range=0..1),
    Plane=pl_2)
boolean_union_2 = BooleanUnion(DistanceObjectS=box_3)
sphere_2 = Sphere(Radius=Slider(2, range=0..10), Center=Point(0, 0, 0))
smoothunionlist = SmoothUnionList(DistanceObjects=flatten([boolean_union_2, sphere_2]), SmoothingFactor=Slider(10, range=0..10))

number_slider_4 = Slider(150, range=0..1000)
# Octree Meshing
isosurface_distancefunction = IsosurfaceDistancefunction(
    NumberX=number_slider_4,
    NumberY=number_slider_4,
    NumberZ=number_slider_4,
    Isovalue=0,
    Capped=False,
    DistanceObject=boolean_subtract,
    Refine=True)
preview = CustomPreview(Geometry=isosurface_distancefunction, Material=ColourSwatch(SwatchColor=RGB(238, 102, 121)))

# ----
# Slice 2D
number_slider_5 = Slider(1, range=-5..5)
pt = ConstructPoint(XCoordinate=0, YCoordinate=0, ZCoordinate=number_slider_5)
xy = XYPlane(Origin=pt)
slice2d = Slice2D(DistanceObject=boolean_subtract, NumberU=50, NumberV=50, DimensionX=10, DimensionY=10, Plane=xy)  # -> Values, Mesh, Contours

# ----
# Create shell and cut off tips
number_slider_6 = Slider(0.2, range=0..1)
shell = Shell(DistanceObject=smoothunionlist, Thickness=number_slider_6, Factor=Slider(1, range=0..2))
sphere_3 = Sphere(Radius=Slider(4.8, range=0..10), Center=Point(0, 0, 0))
boolean_intersect_2 = BooleanIntersect(DistanceObjectS=sphere_3, DistanceObject=shell)

# ----
# Isosurface Meshing
number_slider_7 = Slider(150, range=0..200)
isosurface_distancefunction_2 = IsosurfaceDistancefunction(
    NumberX=number_slider_7,
    NumberY=number_slider_7,
    NumberZ=number_slider_7,
    Isovalue=0,
    Capped=False,
    DistanceObject=boolean_intersect_2,
    Refine=True)
preview_2 = CustomPreview(Geometry=isosurface_distancefunction_2, Material=ColourSwatch(SwatchColor=RGB(238, 102, 121)))

# ----
# Outer Shape
number_slider_8 = Slider(25, range=0..100)
sph_2 = Sphere(Base=PlaneXY(0, 0, 0), Radius=Slider(3, range=0..10))
popgeo_2 = PopulateGeometry(Geometry=sph_2, Count=number_slider_8, Seed=1)
number_slider_9 = Slider(200, range=0..300)

plane = Plane(Origin=popgeo_2, Normal=popgeo_2)

boolean_intersect_3 = BooleanIntersect(DistanceObjectS=plane)
shell_2 = Shell(DistanceObject=boolean_intersect_3, Thickness=Slider(0.2, range=0..1), Factor=0)
isosurface_distancefunction_3 = IsosurfaceDistancefunction(
    BoundingBox=box_2,
    NumberX=number_slider_9,
    NumberY=number_slider_9,
    NumberZ=number_slider_9,
    Isovalue=0,
    Capped=False,
    DistanceObject=shell_2,
    Refine=True)
preview_3 = CustomPreview(Geometry=isosurface_distancefunction_3, Material=ColourSwatch(SwatchColor=RGBA(237, 102, 120, 128)))

# ----
# Inner Lattices
number_slider_10 = Slider(0.2, range=0..1)
number_slider_11 = Slider(200, range=0..300)
lattice = Lattice(Cellsize=Slider(1, range=0..10), Thickness=number_slider_10)
boolean_intersect_4 = BooleanIntersect(DistanceObjectS=boolean_intersect_3, DistanceObject=lattice)
isosurface_distancefunction_4 = IsosurfaceDistancefunction(
    BoundingBox=box_2,
    NumberX=number_slider_11,
    NumberY=number_slider_11,
    NumberZ=number_slider_11,
    Isovalue=0,
    Capped=False,
    DistanceObject=boolean_intersect_4,
    Refine=True)
preview_4 = CustomPreview(Geometry=isosurface_distancefunction_4, Material=ColourSwatch(SwatchColor=RGB(238, 102, 121)))
