# Grasshopper definition trick_or_treat.gh (Grasshopper 1.0.7)
# plug-ins: Axolotl Info

# ---- group: MOUTH
pt = ConstructPoint(XCoordinate=Slider(1, range=0..10), YCoordinate=Slider(1, range=0..10), ZCoordinate=0)
pt_2 = ConstructPoint(XCoordinate=Slider(1, range=0..10), YCoordinate=Slider(3, range=0..10), ZCoordinate=0)
pt_3 = ConstructPoint(XCoordinate=Slider(5, range=0..10), YCoordinate=Slider(3, range=0..10), ZCoordinate=0)
pt_4 = ConstructPoint(XCoordinate=Slider(5, range=0..10), YCoordinate=0, ZCoordinate=0)
pl = ConstructPlane(Origin=pt, XAxis="{-1,1,0}", YAxis=Vector(0, 1, 0))
pl_2 = ConstructPlane(Origin=pt_2, XAxis="{-1,1,0}", YAxis=Vector(0, 1, 0))
pl_3 = ConstructPlane(Origin=pt_3, XAxis="{1,-1,0}", YAxis=Vector(0, 1, 0))
pl_4 = ConstructPlane(Origin=pt_4, XAxis="{-1,0,0}", YAxis=Vector(0, 1, 0))
polygonextrusion = PolygonExtrusion(Radius=Slider(2, range=0..10), SecondRadius=-1, Height=8, Number="3", Plane=pl)
polygonextrusion_2 = PolygonExtrusion(Radius=Slider(1.6, range=0..10), SecondRadius=-1, Height=8, Number="3", Plane=pl_2)
polygonextrusion_3 = PolygonExtrusion(Radius=Slider(2, range=0..10), SecondRadius=-1, Height=8, Number="3", Plane=pl_3)
polygonextrusion_4 = PolygonExtrusion(Radius=Slider(2.4, range=0..10), SecondRadius=-1, Height=8, Number="3", Plane=pl_4)
boolean_union = BooleanUnion(DistanceObjectS=[polygonextrusion, polygonextrusion_2, polygonextrusion_3, polygonextrusion_4])
pl_5 = ConstructPlane(Origin=Point(0, 0, 0), XAxis=Vector(1, 0, 0), YAxis="{0,-1,0}")
neg = Negative(Value=Slider(7, range=0..10))
transform = Transform(DistanceObject=boolean_union, Plane=pl_5)
pt_5 = ConstructPoint(XCoordinate=neg, YCoordinate=0, ZCoordinate=0)
boolean_union_2 = BooleanUnion(DistanceObjectS=boolean_union, DistanceObject=transform)
cylinder = Cylinder(Radius=Slider(8.4, range=0..10), Height=8, Plane=pt_5, Fillet=0)
cylinder_2 = Cylinder(Radius=Slider(5, range=0..10), Height=Slider(6, range=0..10), Plane=PlaneXY(0, 0, 0), Fillet=0)
boolean_subtract = BooleanSubtract(DistanceObject=cylinder_2, DistanceObject_2=cylinder)
pt_6 = ConstructPoint(XCoordinate=Slider(5, range=0..10), YCoordinate=0, ZCoordinate=Slider(1.2, range=0..2))
boolean_subtract_2 = BooleanSubtract(DistanceObject=boolean_subtract, DistanceObject_2=boolean_union_2)
pl_6 = ConstructPlane(Origin=pt_6, XAxis="{0,0,-1}", YAxis=Vector(0, 1, 0))
transform_2 = Transform(DistanceObject=boolean_subtract_2, Plane=pl_6)

# ----
panel = Panel("TRICK OR TREAT")

# ---- group: EYES
xy = XYPlane(Origin=Point(0, 0, 0))
deplane = DeconstructPlane(Plane=xy)  # -> Origin, XAxis, YAxis, ZAxis
number_slider = Slider(6, range=0..10)
number_slider_2 = Slider(2.5, range=0..10)
number_slider_3 = Slider(2.4, range=0..5)
addition = Addition(A=deplane.XAxis, B=deplane.YAxis)
multiplication = Multiplication(A=addition, B=Slider(1, range=0..1))
neg_2 = Negative(Value=number_slider_3)
move = Move(Geometry=deplane.Origin, Motion=multiplication)  # -> Geometry, Transform
pt_7 = ConstructPoint(XCoordinate=number_slider, YCoordinate=number_slider_3, ZCoordinate=number_slider_2)
pt_8 = ConstructPoint(XCoordinate=number_slider, YCoordinate=neg_2, ZCoordinate=number_slider_2)
pl_7 = ConstructPlane(Origin=move.Geometry, XAxis=Vector(1, 0, 0), YAxis=Vector(0, 1, 0))
yz = YZPlane(Origin=pt_7)
yz_2 = YZPlane(Origin=pt_8)
cylinder_3 = Cylinder(Radius=Slider(1.2, range=0..2), Height=8, Plane=pl_7, Fillet=0)
polygonextrusion_5 = PolygonExtrusion(Radius=Slider(1.7, range=0..3), SecondRadius=-1, Height=Slider(5, range=0..10), Number=Slider(3, range=0..10), Plane=xy)
deplane_2 = DeconstructPlane(Plane=yz)  # -> Origin, XAxis, YAxis, ZAxis
deplane_3 = DeconstructPlane(Plane=yz_2)  # -> Origin, XAxis, YAxis, ZAxis
boolean_union_3 = BooleanUnion(DistanceObjectS=polygonextrusion_5)
neg_3 = Negative(Value=deplane_2.XAxis)
pl_8 = ConstructPlane(Origin=deplane_2.Origin, XAxis=deplane_2.YAxis, YAxis=neg_3)
pl_9 = ConstructPlane(Origin=deplane_3.Origin, XAxis=deplane_3.YAxis, YAxis=deplane_3.XAxis)
smoothsubtraction = SmoothSubtraction(DistanceObject=boolean_union_3, DistanceObject_2=cylinder_3, Radius=Slider(0.9, range=0..1))

# ---- group: PUMPKIN_BODY
neg_4 = Negative(Value=Slider(1, range=0..10))
cir = Circle(Plane=PlaneXY(0, 0, 0), Radius=Slider(4, range=0..10))
pt_9 = ConstructPoint(XCoordinate=0, YCoordinate=0, ZCoordinate=neg_4)
pframes = PerpFrames(Curve=cir, Count=Slider(12, range=0..20), Align=True)  # -> Frames, Parameters
ellipsoid = Ellipsoid(RadiusX=Slider(4, range=0..10), RadiusY=Slider(5, range=0..10), RadiusZ=Slider(3, range=0..10), Plane=pframes.Frames)
xy_2 = XYPlane(Origin=pt_9)
egg = Egg(RadiusA=Slider(2, range=0..10), RadiusB=Slider(4, range=0..10), Coefficient=0.1, Plane=xy_2)
boolean_union_4 = BooleanUnion(DistanceObjectS=ellipsoid)

# ---- group: STEM
pt_10 = ConstructPoint(XCoordinate=0, YCoordinate=0, ZCoordinate=Slider(4, range=0..10))
xy_3 = XYPlane(Origin=pt_10)
polygonextrusion_6 = PolygonExtrusion(
    Radius=Slider(0.6, range=0..1),
    SecondRadius=Slider(1.2, range=0..2),
    Height=Slider(3, range=0..10),
    Number=6,
    Plane=xy_3)

# ----
smoothunion = SmoothUnion(DistanceObject=boolean_union_4, DistanceObject_2=egg, Radius=Slider(0.6, range=0..1))
shell = Shell(DistanceObject=smoothunion, Thickness=Slider(0.8, range=0..1), Factor="1")
transform_3 = Transform(DistanceObject=smoothsubtraction, Plane=[pl_9, pl_8])
smoothunion_2 = SmoothUnion(DistanceObject=shell, DistanceObject_2=polygonextrusion_6, Radius=Slider(0.6, range=0..1))
boolean_union_5 = BooleanUnion(DistanceObjectS=transform_3)
boolean_subtract_3 = BooleanSubtract(DistanceObject=smoothunion_2, DistanceObject_2=boolean_union_5)

# ---- group: BOUNDING_BOX
number_slider_4 = Slider(10, range=0..100)
neg_5 = Negative(Value=number_slider_4)
dom = ConstructDomain(DomainStart=neg_5, DomainEnd=number_slider_4)
box = DomainBox(Base=PlaneXY(0, 0, 0), X=dom, Y=dom, Z=dom)

# ----
boolean_subtract_4 = BooleanSubtract(DistanceObject=boolean_subtract_3, DistanceObject_2=transform_2)

# ---- group: ISOSURFACE_MESHING
number_slider_5 = Slider(150, range=0..1000)
isosurface_distancefunction = IsosurfaceDistancefunction(
    BoundingBox=box,
    NumberX=number_slider_5,
    NumberY=number_slider_5,
    NumberZ=number_slider_5,
    Isovalue=0,
    Capped=False,
    DistanceObject=boolean_subtract_4,
    Refine=True)
preview = CustomPreview(Geometry=isosurface_distancefunction, Material=ColourSwatch(SwatchColor=RGB(217, 122, 0)))
