# Grasshopper definition tutorial_1_distance_functions_from_scratch.gh (Grasshopper 1.0.7)
# plug-ins: Bifocals

number_slider = Slider(300, range=0..1000)

# ---- group: Samples
# Sample points creation
number_slider_2 = Slider(100, range=0..100)
rectangle = Rectangle(Plane=PlaneXY(0, 0, 0), XSize=number_slider_2, YSize=number_slider_2, Radius=0)  # -> Rectangle, Length
populate_2d = Populate2D(Region=rectangle.Rectangle, Count=Slider(1000, range=0..1000), Seed=1)

# ---- group: Samples in regular grid
number_slider_3 = Slider(100, range=0..100)
sqgrid = Square(Plane=PlaneXY(0, 0, 0), Size=1, ExtentX=number_slider_3, ExtentY=number_slider_3)  # -> Cells, Points

# ----
sample_points = Point(flatten(sqgrid.Points))

# ---- group: Sphere
query_points = Point(sample_points)
radius = Slider(30.71, range=0..50)
center = Point(Point(49.98106731, 66.42271834, 0))
dist = Distance(PointA=center, PointB=query_points)
subtraction = Subtraction(A=dist, B=radius)

query_points_2 = Point(sample_points)
radius_2 = Slider(15.54, range=0..50)
center_2 = Point(Point(60.18577462, 43.3625775, 0))
dist_2 = Distance(PointA=center_2, PointB=query_points_2)
subtraction_2 = Subtraction(A=dist_2, B=radius_2)

# ---- group: Subtraction
neg = Negative(Value=subtraction_2)
max = Maximum(A=neg, B=subtraction)

# ---- group: Union
# Distance functions
min = Minimum(A=subtraction_2, B=subtraction)

# ---- group: Intersection
max_2 = Maximum(A=subtraction_2, B=subtraction)

# ----
distances = Data(max_2)

# ---- group: Many offsets
mod = Modulus(A=distances, B=Slider(7.14, range=0..10))

# ---- group: Shell creation
thickness = Slider(1.31, range=0..10)
abs = Absolute(Value=mod)
subtraction_3 = Subtraction(A=abs, B=thickness)

# ---- group: One offset
subtraction_4 = Subtraction(A=mod, B=Slider(1.1, range=0..10))

# ----
distances_2 = Data(subtraction_4)
# Visualization
number_slider_4 = Slider(0, range=0..100)

# ---- group: Visualization
bnd = Bounds(Numbers=distances_2)
dedomain = DeconstructDomain(Domain=bnd)  # -> Start, End
gradient = Gradient(
    LowerLimit=number_slider_4,
    UpperLimit=dedomain.End,
    Parameter=distances_2,
    stops=[0: RGB(0, 128, 0), 0.0384: RGB(255, 255, 0), 1: RGB(255, 0, 0)])
cloud = CloudDisplay(Points=sample_points, Colours=gradient, Size=Slider(0.59, range=0..10), SpriteType=1)

# ----
panel = Panel(bnd)
