# Grasshopper definition tutorial_141021_morning.gh (Grasshopper 1.0.7)
# plug-ins: Bifocals

number_slider = Slider(100, range=0..100)
pt = Point(<point referenced from the Rhino model>)
# Generate sample points
rectangle = Rectangle(Plane=PlaneXY(0, 0, 0), XSize=number_slider, YSize=number_slider, Radius=0)  # -> Rectangle, Length
sqgrid = Square(Plane=pt, Size=1, ExtentX=Slider(200, range=0..1000), ExtentY=number_slider)  # -> Cells, flatten(Points)
pop2d = Populate2D(Region=rectangle.Rectangle, Count=Slider(4000, range=0..10000), Seed=1)

# ---- group: Mirror
sample_points = Point(sqgrid.Points)
pdecon = Deconstruct(Point=sample_points)  # -> XComponent, YComponent, ZComponent
abs = Absolute(Value=pdecon.XComponent)
pt_2 = ConstructPoint(XCoordinate=abs, YCoordinate=pdecon.YComponent, ZCoordinate=pdecon.ZComponent)
pt_3 = Point(pt_2)

# ----
sample_points_2 = Point(sqgrid.Points)

# ---- group: Sphere distance function
# Distance function
cen = Point(<point referenced from the Rhino model>)
radius = Slider(34, range=0..100)
dist = Distance(PointA=cen, PointB=pt_3)
subtraction = Subtraction(A=dist, B=radius)

cen_2 = Point(<point referenced from the Rhino model>)
radius_2 = Slider(27, range=0..100)
dist_2 = Distance(PointA=cen_2, PointB=pt_3)
subtraction_2 = Subtraction(A=dist_2, B=radius_2)

# ---- group: Union
min = Minimum(A=subtraction, B=subtraction_2)

# ---- group: Intersection
max = Maximum(A=subtraction, B=subtraction_2)

# ----
neg = Negative(Value=subtraction)
min_2 = Minimum(A=neg, B=subtraction_2)

distances = Data(min_2)

# ----
# Display poionts
abs_2 = Absolute(Value=distances)
bnd = Bounds(Numbers=abs_2)
dedomain = DeconstructDomain(Domain=bnd)  # -> Start, End
sample_points_3 = Point(sample_points_2)
gradient = Gradient(
    LowerLimit=dedomain.Start,
    UpperLimit=dedomain.End,
    Parameter=abs_2,
    stops=[0: RGB(0, 128, 0), 0.0373: RGB(255, 255, 0), 0.474: RGB(255, 0, 0)])
cloud = CloudDisplay(Points=sample_points_3, Colours=gradient, Size=Slider(0.573, range=0..1), SpriteType=1)
