# Grasshopper definition 211026_BrickFabricationExample_PA.ghx (Grasshopper 1.0.7)

pt = Point(<point referenced from the Rhino model>)
xy = XYPlane(Origin=pt)
brick = GhPythonScript(position=xy)  # -> out, brick_pts, brick_surfaces, brick_mesh, brick_plane; inputs position: Plane
# ---------- brick: Python ----------
import Rhino.Geometry as rg
import copy

LENGTH = 12.5 
WIDTH = 6
HEIGHT = 4

global LENGTH
global WIDTH
global HEIGHT

def brick(plane):
    """ List of rg.Points definding the corners of the brick 
    
    Returns
    ----------
    [pt0 : bottom point at negative x and negative y,
    pt1 : bottom point at negative x and possitive y,
    pt2 : bottom point at possitive x and possitve y,
    pt3 : bottom point at possitive x and negative y,
    pt4 : pt0 + Thickness,
    pt5 : pt1 + Thickness,
    pt6 : pt2 + Thickness,
    pt7 : pt3 + Thickness]
    """
    

    
    origin = plane.Origin
    
    x_vec = plane.XAxis #rg.Plane.XAxis
    y_vec = plane.YAxis 
    z_vec = plane.ZAxis
    
    pt_0 = origin - (x_vec *LENGTH/2) - (y_vec*WIDTH/2)
    pt_1 = origin + (x_vec *LENGTH/2) - (y_vec*WIDTH/2)
    pt_2 = origin + (x_vec *LENGTH/2) + (y_vec*WIDTH/2)
    pt_3 = origin - (x_vec *LENGTH/2) + (y_vec*WIDTH/2)
    
    pt_4 = pt_0 + (z_vec*HEIGHT)
    pt_5 = pt_1 + (z_vec*HEIGHT)
    pt_6 = pt_2 + (z_vec*HEIGHT)
    pt_7 = pt_3 + (z_vec*HEIGHT)
    
    pts = [pt_0, pt_1, pt_2, pt_3, pt_4, pt_5, pt_6, pt_7]
    
    
    
    return pts


def surface(s_pts):
    """NURB surfaces depicting the brick:

    Returns
    ----------
    [srf0 : base surface,
    srf1 : long edge,
    srf2 : top surface
    srf3 : long edge,
    srf4 : short edge
    srf5 : short edge]
    """
    
    pt_0, pt_1, pt_2, pt_3, pt_4, pt_5, pt_6, pt_7 = s_pts 
    
    srf_0 = rg.NurbsSurface.CreateFromPoints([pt_0, pt_1, pt_3, pt_2], 2, 2, 1, 1)
    srf_1 = rg.NurbsSurface.CreateFromPoints([pt_0, pt_1, pt_4, pt_5], 2, 2, 1, 1)
    srf_2 = rg.NurbsSurface.CreateFromPoints([pt_4, pt_5, pt_7, pt_6], 2, 2, 1, 1)
    srf_3 = rg.NurbsSurface.CreateFromPoints([pt_2, pt_3, pt_6, pt_7], 2, 2, 1, 1)
    srf_4 = rg.NurbsSurface.CreateFromPoints([pt_0, pt_3, pt_4, pt_7], 2, 2, 1, 1)
    srf_5 = rg.NurbsSurface.CreateFromPoints([pt_1, pt_2, pt_5, pt_6], 2, 2, 1, 1)
    
    return srf_0, srf_1, srf_2, srf_3, srf_4, srf_5
    
    
def mesh(m_pts):
    """Mesh  depicting the brick:

    Returns
    ----------
    mesh_brick : Mesh
    """
    mesh_brick = rg.Mesh.CreateFromBox(m_pts, 1,1,1)
    return mesh_brick
    
    
def plane(bottom_plane):
    """offsets the plane fo the brick with the thickness of the brick. 
    Returns
    ----------
    p_plane : rg.Plane
    """
    
    offset_vec = bottom_plane.ZAxis * HEIGHT
    p_plane = copy.copy(bottom_plane)
    p_plane.Translate(offset_vec) #rg.Plane.Translate (plane, offset_vector)
    
    return p_plane 
    
    
    

brick_pts = brick(position)
brick_surfaces = surface(brick_pts) 
brick_mesh = mesh(brick_pts)
brick_plane = plane(position)
# ---------- end brick ----------
geo = Geometry(brick.brick_surfaces)
geo_2 = Geometry(brick.brick_plane)
geo_3 = Geometry(brick.brick_pts)
fabrication = GhPythonScript(brick_planes=geo_2, fabricate=Button())  # -> vis_planes, script; inputs brick_planes: list of Plane, fabricate: Boolean
# ---------- fabrication: Python ----------
import Rhino.Geometry as rg
import simple_ur_script as ur
import simple_comm as c
import math as m 

ROBOT_IP = "192.168.10.10"
global ROBOT_IP

SAFE_ROBOT_ACC = 0.05
global SAFE_ROBOT_ACC

SAFE_ROBOT_VEL = 0.1 
global SAFE_ROBOT_VEL 

IO = 0
global IO


#############################################################

#############################################################

def tcp(script):
    script += ur.set_tcp_by_angles(0.0, 0.0, 74.0, m.radians(0.0),
    m.radians(180.0), m.radians(0.0))
    
    return script


def set_robot_base_from_pts():
    pt_0 = rg.Point3d(327,230,0) # base plane origin 
    pt_1 = rg.Point3d(499,230,0) # point on possitive x axis
    pt_2 = rg.Point3d(499,499,0)# point on possitive xy plane
    robot_base = rg.Plane(pt_0, pt_1-pt_0, pt_2-pt_0)
    return robot_base
    
def rhino_to_robot_space(rhino_plane):
    plane = rhino_plane.Clone()
    robot_base_plane = set_robot_base_from_pts()
    rhino_matrix = rg.Transform.PlaneToPlane(rg.Plane.WorldXY, robot_base_plane)
    plane.Transform(rhino_matrix)   #rg.Plane.Transform()
    return plane
    
def pickup_brick(script, pick_up_plane):
    planes = []
    SAFE_DIST = 50 
    
    safe_plane = pick_up_plane.Clone()
    safe_plane.Translate(rg.Vector3d.ZAxis*SAFE_DIST)           # rg.Plane.Translate()
    
    script += ur.move_l(safe_plane, SAFE_ROBOT_ACC, SAFE_ROBOT_VEL)
    planes.append(safe_plane)
    
    script += ur.move_l(pick_up_plane, SAFE_ROBOT_ACC, SAFE_ROBOT_VEL)
    planes.append(pick_up_plane)
    
    script += ur.set_digital_out(IO, True)
    script += ur.sleep(1)
    
    script += ur.move_l(safe_plane, SAFE_ROBOT_ACC, SAFE_ROBOT_VEL)
    planes.append(safe_plane)
    
    return script, planes
    
def place_brick(script, air_plane):
    planes = []
    
    SAFE_DIST = 100
    
    safe_plane = air_plane.Clone()
    safe_plane.Translate(rg.Vector3d(0,0,SAFE_DIST)) # rg.Plane.Translate()
    
    script += ur.move_l(safe_plane, SAFE_ROBOT_ACC, SAFE_ROBOT_VEL)
    planes.append(safe_plane)
    
    script += ur.move_l(air_plane, SAFE_ROBOT_ACC, SAFE_ROBOT_VEL)
    planes.append(air_plane)
    
    script += ur.set_digital_out(IO, False)
    script += ur.sleep(1)
    
    script += ur.move_l(safe_plane, SAFE_ROBOT_ACC, SAFE_ROBOT_VEL)
    planes.append(safe_plane)
    
    return script, planes
    
    
    
def send(script):
    c.concatenate_script(script)
    c.send_script(script, ROBOT_IP)
    

#############################################################

#############################################################
pick_up_plane = rg.Plane(rg.Point3d(0, 450, 7), rg.Vector3d.XAxis, rg.Vector3d.YAxis) # location of pickup station

script = ""
vis_planes = []



script = tcp(script)
#### translate from rhino to robot space 
robot_planes = []

for p in brick_planes:
    r_plane = rhino_to_robot_space(p)
    robot_planes.append(r_plane)



for b_plane in robot_planes:
    script, p = pickup_brick(script, pick_up_plane)
    vis_planes.extend(p)
    
    script, p = place_brick(script, b_plane)
    vis_planes.extend(p)
    
    
fabricate = True
if fabricate:
    send(script)
    print script
# ---------- end fabrication ----------
panel = Panel(fabrication.script)
geo_4 = Geometry(fabrication.vis_planes)
