# Grasshopper definition 211026_BrickFabrication_PA.ghx (Grasshopper 1.0.7)

pt = Point(<point referenced from the Rhino model>)
pt_2 = Point(<point referenced from the Rhino model>)  # disabled
pt_3 = Point(<point referenced from the Rhino model>)  # disabled
brick_positions = GhPythonScript()  # -> out, brick_planes; disabled
# ---------- brick_positions: Python ----------
import Rhino.Geometry as rg
import math as m



"""Genrates a Rhino Geometry plane for each brick

This is where the design of the wall is created.

Returns
----------
brick_planes : [Rhino Geometry Plane, Rhino Geometry Plane, ...]

"""


VERTICAL_COUNT = 100
HORIZONTAL_COUNT = 50


BRICK_LENGTH = 12.5
BRICK_HEIGHT = 4

brick_planes = []

for i in range (VERTICAL_COUNT):
    for j in range (HORIZONTAL_COUNT):
        if i%2 ==0:
            x_pos = j * (BRICK_LENGTH + 1)
            rot = m.radians(10)
            
        else:
            x_pos = j * (BRICK_LENGTH + 1) + BRICK_LENGTH/2
            rot = m.radians(-10)
            
        z_pos = i * BRICK_HEIGHT
        
        origin = rg.Point3d(x_pos, 0, z_pos)
        
        plane = rg.Plane(origin, rg.Vector3d.XAxis, rg.Vector3d.YAxis)
        rg.Plane.Rotate(plane,rot, plane.ZAxis, plane.Origin)  #plane.Rotate(rot, plane.ZAxis, plane.Origin)
        brick_planes.append(plane)
# ---------- end brick_positions ----------
xy = XYPlane(Origin=pt)
xy_2 = XYPlane(Origin=pt_3)  # disabled
xy_3 = XYPlane(Origin=pt_2)  # disabled
brick = GhPythonScript(position=xy)  # -> out, brick_pts, brick_surfaces, brick_mesh, brick_plane; inputs position: Plane
# ---------- brick: Python ----------
import Rhino.Geometry as rg
import copy

LENGTH = 12.5 
WIDTH = 6
HEIGHT = 4

global LENGTH
global WIDTH
global HEIGHT

def brick(plane):
    """ List of rg.Points definding the corners of the brick 
    
    Returns
    ----------
    [pt0 : bottom point at negative x and negative y,
    pt1 : bottom point at negative x and possitive y,
    pt2 : bottom point at possitive x and possitve y,
    pt3 : bottom point at possitive x and negative y,
    pt4 : pt0 + Thickness,
    pt5 : pt1 + Thickness,
    pt6 : pt2 + Thickness,
    pt7 : pt3 + Thickness]
    """
    

    
    origin = plane.Origin
    
    x_vec = plane.XAxis #rg.Plane.XAxis
    y_vec = plane.YAxis 
    z_vec = plane.ZAxis
    
    pt_0 = origin - (x_vec *LENGTH/2) - (y_vec*WIDTH/2)
    pt_1 = origin + (x_vec *LENGTH/2) - (y_vec*WIDTH/2)
    pt_2 = origin + (x_vec *LENGTH/2) + (y_vec*WIDTH/2)
    pt_3 = origin - (x_vec *LENGTH/2) + (y_vec*WIDTH/2)
    
    pt_4 = pt_0 + (z_vec*HEIGHT)
    pt_5 = pt_1 + (z_vec*HEIGHT)
    pt_6 = pt_2 + (z_vec*HEIGHT)
    pt_7 = pt_3 + (z_vec*HEIGHT)
    
    pts = [pt_0, pt_1, pt_2, pt_3, pt_4, pt_5, pt_6, pt_7]
    
    
    
    return pts


def surface(s_pts):
    """NURB surfaces depicting the brick:

    Returns
    ----------
    [srf0 : base surface,
    srf1 : long edge,
    srf2 : top surface
    srf3 : long edge,
    srf4 : short edge
    srf5 : short edge]
    """
    
    pt_0, pt_1, pt_2, pt_3, pt_4, pt_5, pt_6, pt_7 = s_pts 
    
    srf_0 = rg.NurbsSurface.CreateFromPoints([pt_0, pt_1, pt_3, pt_2], 2, 2, 1, 1)
    srf_1 = rg.NurbsSurface.CreateFromPoints([pt_0, pt_1, pt_4, pt_5], 2, 2, 1, 1)
    srf_2 = rg.NurbsSurface.CreateFromPoints([pt_4, pt_5, pt_7, pt_6], 2, 2, 1, 1)
    srf_3 = rg.NurbsSurface.CreateFromPoints([pt_2, pt_3, pt_6, pt_7], 2, 2, 1, 1)
    srf_4 = rg.NurbsSurface.CreateFromPoints([pt_0, pt_3, pt_4, pt_7], 2, 2, 1, 1)
    srf_5 = rg.NurbsSurface.CreateFromPoints([pt_1, pt_2, pt_5, pt_6], 2, 2, 1, 1)
    
    return srf_0, srf_1, srf_2, srf_3, srf_4, srf_5
    
    
def mesh(m_pts):
    """Mesh  depicting the brick:

    Returns
    ----------
    mesh_brick : Mesh
    """
    mesh_brick = rg.Mesh.CreateFromBox(m_pts, 1,1,1)
    return mesh_brick
    
    
def plane(plane):
    """offsets the plane fo the brick with the thickness of the brick. 
    Returns
    ----------
    p_plane : rg.Plane
    """
    
    offset_vec = plane.ZAxis * HEIGHT
    p_plane = copy.copy(plane)
    p_plane.Translate(offset_vec) #rg.Plane.Translate (plane, offset_vector)
    
    return p_plane 
    
    
    

brick_pts = brick(position)
brick_surfaces = surface(brick_pts) 
brick_mesh = mesh(brick_pts)
brick_plane = plane(position)
# ---------- end brick ----------
bricks = GhPythonScript(positions=brick_positions.brick_planes)  # -> out, brick_pts, brick_surfaces, brick_meshes; inputs positions: list of Plane; disabled
# ---------- bricks: Python ----------
import Rhino.Geometry as rg


def brick(plane):
    """ List of rg.Points definding the corners of the brick 
    
    Returns
    ----------
    [pt0 : bottom point at negative x and negative y,
    pt1 : bottom point at negative x and possitive y,
    pt2 : bottom point at possitive x and possitve y,
    pt3 : bottom point at possitive x and negative y,
    pt4 : pt0 + Thickness,
    pt5 : pt1 + Thickness,
    pt6 : pt2 + Thickness,
    pt7 : pt3 + Thickness]
    """
    
    LENGTH = 12.5 
    WIDTH = 6
    HEIGHT = 4
    
    origin = plane.Origin
    
    x_vec = plane.XAxis #rg.Plane.XAxis
    y_vec = plane.YAxis 
    z_vec = plane.ZAxis
    
    pt_0 = origin - (x_vec *LENGTH/2) - (y_vec*WIDTH/2)
    pt_1 = origin + (x_vec *LENGTH/2) - (y_vec*WIDTH/2)
    pt_2 = origin + (x_vec *LENGTH/2) + (y_vec*WIDTH/2)
    pt_3 = origin - (x_vec *LENGTH/2) + (y_vec*WIDTH/2)
    
    pt_4 = pt_0 + (z_vec*HEIGHT)
    pt_5 = pt_1 + (z_vec*HEIGHT)
    pt_6 = pt_2 + (z_vec*HEIGHT)
    pt_7 = pt_3 + (z_vec*HEIGHT)
    
    pts = [pt_0, pt_1, pt_2, pt_3, pt_4, pt_5, pt_6, pt_7]
    
    
    
    return pts


def surface(s_pts):
    """NURB surfaces depicting the brick:

    Returns
    ----------
    [srf0 : base surface,
    srf1 : long edge,
    srf2 : top surface
    srf3 : long edge,
    srf4 : short edge
    srf5 : short edge]
    """
    
    pt_0, pt_1, pt_2, pt_3, pt_4, pt_5, pt_6, pt_7 = s_pts 
    
    srf_0 = rg.NurbsSurface.CreateFromPoints([pt_0, pt_1, pt_3, pt_2], 2, 2, 1, 1)
    srf_1 = rg.NurbsSurface.CreateFromPoints([pt_0, pt_1, pt_4, pt_5], 2, 2, 1, 1)
    srf_2 = rg.NurbsSurface.CreateFromPoints([pt_4, pt_5, pt_7, pt_6], 2, 2, 1, 1)
    srf_3 = rg.NurbsSurface.CreateFromPoints([pt_2, pt_3, pt_6, pt_7], 2, 2, 1, 1)
    srf_4 = rg.NurbsSurface.CreateFromPoints([pt_0, pt_3, pt_4, pt_7], 2, 2, 1, 1)
    srf_5 = rg.NurbsSurface.CreateFromPoints([pt_1, pt_2, pt_5, pt_6], 2, 2, 1, 1)
    
    return srf_0, srf_1, srf_2, srf_3, srf_4, srf_5
    
    
def mesh(m_pts):
    """Mesh  depicting the brick:

    Returns
    ----------
    mesh_brick : Mesh
    """
    mesh_brick = rg.Mesh.CreateFromBox(m_pts, 1,1,1)
    return mesh_brick


brick_surfaces = []
brick_meshes = []

for pos in positions:

    brick_pts = brick(pos)
    #brick_surfaces.extend(surface(brick_pts))
    brick_meshes.append(mesh(brick_pts))
# ---------- end bricks ----------
geo = Geometry(brick.brick_surfaces)
geo_2 = Geometry(brick.brick_plane)
geo_3 = Geometry(brick.brick_pts)
geo_4 = Geometry(bricks.brick_meshes)  # disabled
geo_5 = Geometry(bricks.brick_surfaces)  # disabled
geo_6 = Geometry(bricks.brick_pts)  # disabled
fabricate = GhPythonScript(brick_planes=geo_2, fabricate=Button())  # -> script, vis_curve, vis_planes; inputs brick_planes: list of Plane, fabricate: Boolean
# ---------- fabricate: Python ----------
import Rhino.Geometry as rg
import simple_ur_script as ur
import simple_comm as c

import math as m


ROBOT_IP = "192.168.10.10"
global ROBOT_IP

SAFE_ROBOT_VEL= 0.1
global SAFE_ROBOT_SPEED

SAFE_ROBOT_ACC = 0.05
global SAFE_ROBOT_ACCEL

IO = 0
global IO


def tcp(script):
    script += ur.set_tcp_by_angles(
        0.0, 0.0, 74.0, m.radians(0.0), m.radians(180.0), m.radians(0))
    return script


def set_robot_base_plane_from_pts():

    pt_0 = rg.Point3d(327, 230, 0)  # base plane origin
    # point on base plane positive x direction
    pt_1 = rg.Point3d(499, 230, 0)
    pt_2 = rg.Point3d(499, 499, 0)  # point on base plane positive xy

    robot_base = rg.Plane(pt_0, pt_1-pt_0, pt_2-pt_0)
    return robot_base

def rhino_to_robot_space(in_plane):
    plane = in_plane.Clone()
    _r_matrix = rg.Transform.PlaneToPlane(
        rg.Plane.WorldXY, set_robot_base_plane_from_pts())
    plane.Transform(_r_matrix)
    return plane


def pickup_brick(script, pick_up_plane):
    """Example of a method's documentation.

    Parameters
    ----------
    point_x : float
    Description of the first param
    point_y : float
    Description of the second param
    """
    planes = []
    
    safe_distance = 50

    safe_plane = pick_up_plane.Clone()
    safe_plane.Translate(rg.Vector3d(0, 0, safe_distance))

    script += ur.move_l(safe_plane, SAFE_ROBOT_ACC, SAFE_ROBOT_VEL)
    planes.append(safe_plane)

    script += ur.move_l(pick_up_plane, SAFE_ROBOT_ACC, SAFE_ROBOT_VEL)
    planes.append(pick_up_plane)

    script += ur.set_digital_out(IO, True)
    script += ur.sleep(1)

    script += ur.move_l(safe_plane, SAFE_ROBOT_ACC, SAFE_ROBOT_VEL)
    planes.append(safe_plane)

    return script, planes

def place_brick(script, plane):
    """
    this function gereates the robotic sequience for placing a brick
    Requires a plane wich describes the possition of the brick"""
    planes = []
    
    safe_distance = 50

    safe_plane = plane.Clone()
    safe_plane.Translate(rg.Vector3d(0, 0, safe_distance))

    script += ur.move_l(safe_plane, SAFE_ROBOT_ACC, SAFE_ROBOT_VEL)
    planes.append(safe_plane)

    script += ur.move_l(plane, SAFE_ROBOT_ACC, SAFE_ROBOT_VEL)
    planes.append(plane)

    script += ur.set_digital_out(IO, False)
    script += ur.sleep(1)

    script += ur.move_l(safe_plane, SAFE_ROBOT_ACC, SAFE_ROBOT_VEL)
    planes.append(safe_plane)

    return script, planes

def send(script):
    """
    this funktion sends the script to the robot."""

    script = c.concatenate_script(script)
    c.send_script(script, ROBOT_IP)
    return script


################################################################################
#Procedure 
################################################################################
script = ""

script = tcp(script)
robot_planes = []

vis_planes = []


pick_up_plane = rg.Plane(rg.Point3d(0, 450, 7), rg.Vector3d.XAxis, rg.Vector3d.YAxis) # location of pickup station


for plane in (brick_planes):
    robot_planes.append(rhino_to_robot_space(plane))
    
    
    
for plane in (robot_planes):
    script, planes  = pickup_brick(script, pick_up_plane)
    vis_planes.extend(planes)
    script, planes = place_brick(script, plane)
    vis_planes.extend(planes)

if fabricate:
    send(script)


crv = []
for plane in vis_planes:
    pt = plane.Origin
    crv.append(pt)

vis_curve = rg.NurbsCurve.Create(False, 1, crv)
# ---------- end fabricate ----------
panel = Panel(fabricate.script)
