# Grasshopper definition 211028_BrickExternalModel_PA.ghx (Grasshopper 1.0.7)

pt = Point(<point referenced from the Rhino model>)
xy = XYPlane(Origin=pt)
python = GhPythonScript(position=xy)  # -> out, brick_mesh; inputs position: Plane
# ---------- python: Python ----------
#from compas_rhino import unload_modules
#unload_modules('brickFunktions')

import imp


import Rhino.Geometry as rg
import math as m
import brickFunktions as b

imp.reload(b)

brick_pts = b.brick(position)
brick_surfaces = b.surface(brick_pts) 
brick_mesh = b.mesh(brick_pts)
brick_plane = b.plane(position)
# ---------- end python ----------
geo = Geometry(python.brick_mesh)
