# Grasshopper definition 211101_FabricationClassTutorial_PA.ghx (Grasshopper 1.0.7)

pt = Point(Point(6.129917356, 44.71980093, 0))
pt_2 = Point(Point(9.201915809, 5.177754377, 0))
xy = XYPlane(Origin=pt)
xy_2 = XYPlane(Origin=pt_2)
python = GhPythonScript(position=[xy_2, xy])  # -> out, brick_mesh, brick_plane
# ---------- python: Python ----------
import imp
import Rhino.Geometry as rg
import math as m

import brickFunktions as b


imp.reload(b)

brick_pts = b.brick(position)
brick_surfaces = b.surface(brick_pts) 
brick_mesh = b.mesh(brick_pts)
print brick_mesh
brick_plane = b.plane(position)
# ---------- end python ----------
geo = Geometry(python.brick_plane)
geo_2 = Geometry(python.brick_mesh)
python_2 = GhPythonScript(planes=geo)  # -> out, ur_script, vis_planes; inputs planes: list of Plane
# ---------- python_2: Python ----------
import Rhino.Geometry as rg
import simple_ur_script as ur
import simple_comm as c
import math as m



class Fabrication():
    ROBOT_IP = "192.168.10.10"
    ROBOT_ACC = 0.05
    ROBOT_VEL = 0.1
    ROBOT_IO = 0
    
    def __init__(self, fabrication_bool = False, brick_planes = None):
        self.fabrication_bool = fabrication_bool
        self.brick_planes = brick_planes
        
        #################################
        ###################################
        origin = rg.Point3d(0,450,7)
        self.pickup_plane = rg.Plane(origin, rg.Vector3d.XAxis, rg.Vector3d.YAxis)
        
        #####################################
        ###################################
        
        self.script = ""
        
        self.robot_planes = []       # robot planes for visualisation
        
    def tcp(self):
        self.script += ur.set_tcp_by_angles(0.0,0.0, 77.0, m.radians(0.0), m.radians(180.0), m.radians(0.0))
    
    def pick_up_brick(self):    # robotic procedure for picking up a brick 
        SAFETY_DISTANCE = 50
        
        safety_plane = self.pickup_plane.Clone()
        safety_plane.Translate(rg.Vector3d.ZAxis * SAFETY_DISTANCE)
        
        self.script  += ur.move_l(safety_plane, self.ROBOT_ACC, self.ROBOT_VEL)
        self.robot_planes.append(safety_plane)
        
        self.script  += ur.move_l(self.pickup_plane, self.ROBOT_ACC, self.ROBOT_VEL)
        self.robot_planes.append(self.pickup_plane)
        
        self.script += ur.set_digital_out(self.ROBOT_IO, True)
        self.script += ur.sleep(1)
        
        
        self.script  += ur.move_l(safety_plane, self.ROBOT_ACC, self.ROBOT_VEL)
        self.robot_planes.append(safety_plane)
        
    
    def place_brick(self, brick_plane):
        SAFETY_DISTANCE = 50
        
        safety_plane = brick_plane.Clone()
        safety_plane.Translate(rg.Vector3d.ZAxis * SAFETY_DISTANCE)
        
        self.script  += ur.move_l(safety_plane, self.ROBOT_ACC, self.ROBOT_VEL)
        self.robot_planes.append(safety_plane)
        
        self.script  += ur.move_l(brick_plane, self.ROBOT_ACC, self.ROBOT_VEL)
        self.robot_planes.append(safety_plane)
    
        self.script += ur.set_digital_out(self.ROBOT_IO, False)
        self.script += ur.sleep(1)
        
        self.script  += ur.move_l(safety_plane, self.ROBOT_ACC, self.ROBOT_VEL)
        self.robot_planes.append(safety_plane)
        
    def procedure(self, msg):
        self.tcp()
        for b_plane in self.brick_planes:
            self.pick_up_brick()
            self.place_brick(b_plane)            
        
        return self.script, self.robot_planes

myFabrication = Fabrication(brick_planes = planes, fabrication_bool =True)
ur_script, vis_planes = myFabrication.procedure(["everything is ok", "great scripting", "fantastic code"])
# ---------- end python_2 ----------
geo_3 = Geometry(python_2.vis_planes)
panel = Panel(python_2.ur_script)
