# Grasshopper definition 211101_FabricationClass_PA.ghx (Grasshopper 1.0.7)

pt = Point(<point referenced from the Rhino model>)
xy = XYPlane(Origin=pt)
python = GhPythonScript(position=xy)  # -> out, brick_mesh, brick_plane
# ---------- python: Python ----------
import imp
import Rhino.Geometry as rg
import math as m

import brickFunktions as b


imp.reload(b)

brick_pts = b.brick(position)
brick_surfaces = b.surface(brick_pts) 
brick_mesh = b.mesh(brick_pts)
print brick_mesh
brick_plane = b.plane(position)
# ---------- end python ----------
geo = Geometry(python.brick_plane)
geo_2 = Geometry(python.brick_mesh)
fabrication = GhPythonScript(planes=python.brick_plane, fabricate=Button())  # -> vis_planes, script; inputs planes: list of Plane, fabricate: Boolean
# ---------- fabrication: Python ----------
import Rhino.Geometry as rg
import simple_ur_script as ur
import simple_comm as c
import math as m 

class Fabrication(object):
    ROBOT_IP = "192.168.10.10"
    ROBOT_ACC = 0.05
    ROBOT_VEL = 0.1 
    ROBOT_IO = 0
    
    def __init__(self, fabricate = False, brick_planes = None):
        self.fabricate = fabricate
        self.brick_planes  = brick_planes 
        
        
        
        self.script = ""
        self.way_planes = []
        self.p_plane = []
        
        self.robot_planes = []
        
        
    def tcp(self, script):
        script += ur.set_tcp_by_angles(0.0, 0.0, 74.0, m.radians(0.0),
        m.radians(180.0), m.radians(0.0))
        
    def set_robot_base_from_pts(self):
        pt_0 = rg.Point3d(327,230,0) # base plane origin 
        pt_1 = rg.Point3d(499,230,0) # point on possitive x axis
        pt_2 = rg.Point3d(499,499,0)# point on possitive xy plane
        robot_base = rg.Plane(pt_0, pt_1-pt_0, pt_2-pt_0)
        return robot_base
    
    def rhino_to_robot_space(self, rhino_plane):
        plane = rhino_plane.Clone()
        robot_base_plane = self.set_robot_base_from_pts()
        rhino_matrix = rg.Transform.PlaneToPlane(rg.Plane.WorldXY, robot_base_plane)
        plane.Transform(rhino_matrix)   #rg.Plane.Transform()
        return plane
        
    def pickup_plane(self):
        self.p_plane = rg.Plane(rg.Point3d(0, 450, 7), rg.Vector3d.XAxis, rg.Vector3d.YAxis)
        return self.p_plane
        
    def pickup_brick(self, pick_up_plane):
        SAFE_DIST = 50 
        
        safe_plane = pick_up_plane.Clone()
        safe_plane.Translate(rg.Vector3d.ZAxis*SAFE_DIST)           # rg.Plane.Translate()
        
        self.script += ur.move_l(safe_plane, self.ROBOT_ACC, self.ROBOT_VEL)
        self.way_planes.append(safe_plane)
        
        self.script += ur.move_l(pick_up_plane, self.ROBOT_ACC, self.ROBOT_VEL)
        self.way_planes.append(pick_up_plane)
        
        self.script += ur.set_digital_out(self.ROBOT_IO, True)
        self.script += ur.sleep(1)
        
        self.script += ur.move_l(safe_plane, self.ROBOT_ACC, self.ROBOT_VEL)
        self.way_planes.append(safe_plane)
    
    
    def place_brick(self, air_plane):
        
        SAFE_DIST = 100
        
        safe_plane = air_plane.Clone()
        safe_plane.Translate(rg.Vector3d(0,0,SAFE_DIST)) # rg.Plane.Translate()
        
        self.script += ur.move_l(safe_plane, self.ROBOT_ACC, self.ROBOT_VEL)
        self.way_planes.append(safe_plane)
        
        self.script += ur.move_l(air_plane, self.ROBOT_ACC, self.ROBOT_VEL)
        self.way_planes.append(air_plane)
        
        self.script += ur.set_digital_out(self.ROBOT_IO, False)
        self.script += ur.sleep(1)
        
        self.script += ur.move_l(safe_plane, self.ROBOT_ACC, self.ROBOT_VEL)
        self.way_planes.append(safe_plane)
    
    def send(self):
        c.concatenate_script(self.script)
        c.send_script(self.script, self.robot_ip)


    def procedure(self):
        print self.brick_planes
        for plane in self.brick_planes:
            r_plane = self.rhino_to_robot_space(plane)
            self.robot_planes.append(r_plane)
        
        for plane in self.robot_planes:
            self.pickup_brick(self.pickup_plane())
            self.place_brick(plane)

        return self.way_planes, self.script
        

myFabrication = Fabrication(brick_planes = planes)
vis_planes, script = myFabrication.procedure()
# ---------- end fabrication ----------
panel = Panel(fabrication.script)
geo_3 = Geometry(fabrication.vis_planes)
