# Grasshopper definition 211104_PlaneRotationTranslationTransformation_PA.ghx (Grasshopper 1.0.7)

originpt = Point(Point(23.19625928, 23.09907393, 0))
ypt = Point(Point(23.19625928, 33.09907393, 0))
xpt = Point(Point(33.19625928, 23.09907393, 0))
plane_from_3_points = GhPythonScript(origin_pt=originpt, x_point=xpt, y_point=ypt)  # -> out, plane, plane_for_transformation; inputs origin_pt: Point3d, x_point: Point3d, y_point: Point3d
# ---------- plane_from_3_points: Python ----------
import Rhino.Geometry as rg
import math as m

x_axis = x_point - origin_pt
y_axis = y_point - origin_pt


plane = rg.Plane(origin_pt, x_axis, y_axis)


#########################################
# plane rotation 
#########################################

rg.Plane.Rotate(plane,              # plane is the plane that you want to rotate
                m.radians(45),      # this is the angle you want to rotate the plane 
                x_axis,             # this is the axis you want to rotate around
                origin_pt)          # and this is the point you want to be the centre of rotation
                
#plane.Rotate(m.radians(45), x_axis, origin_pt)     # this is another way to write the same code. Rotate is a method belonging to the class rg.Plane
                
                

#########################################
# plane translation - move a plane along a vector (the vector defines the distance and the direction)
#########################################

translation_vector = x_axis * 5

rg.Plane.Translate(plane,                   # this is the plane you want to translate 
                    translation_vector)     # this is the vector you want to move it along
                    
#plane.Translate(transvector)               # this is another way to write the same code. Translate is a method belonging to the class rg.Plane



#########################################
# plane transform - move a plane from one location (cordinate system) to another. We will transform the plane to the origin of the cordinate system 
#########################################

# reate a transformation matrix See https://en.wikipedia.org/wiki/Transformation_matrix
# this is the information used to tranform the plane from one location to another 
plane_for_transformation = plane.Clone()

target_plane= rg.Plane(rg.Point3d(0,0,0),   # Orgin point of our codinate system 
                        plane_for_transformation.XAxis,  # world XAxis if you want to maintain original orientation of the plane 
                        plane_for_transformation.YAxis)  # world YAxis if you want to maintain original orientation of the plane 


matrix = rg.Transform.PlaneToPlane(plane_for_transformation,    # this is the plane we want to tranform
                                    target_plane )              # this is the plane we want to transform to
                            
#matrix = plane.PlaneToPlane(target_plane)           # this is another way to write the same code. Translate is a method belonging to the class rg.Plane


rg.Plane.Transform(plane_for_transformation,                            # this is the plane we want to translate
                    matrix)
# ---------- end plane_from_3_points ----------
