# Grasshopper definition main.ghx (Grasshopper 1.0.7)

# ----
# examples
number_slider = Slider(5, range=1..10)
design_class = GhPythonScript(layer_cnt=number_slider)  # -> out, bricks_tree; inputs layer_cnt: Int32
# ---------- design_class: Python ----------
import ghpythonlib.treehelpers as th
import design as design
import imp
imp.reload(design)

d = design.Design(layer_cnt)

bricks_tree = []
for i in range(layer_cnt):
    bricks_list = []
    for j in range(len(d.base_crvs[i].bricks)):
        brick = d.base_crvs[i].bricks[j]
        print(brick.layer_cnt, brick.brick_cnt)
        bricks_list.append(brick.surface)
    bricks_tree.append(bricks_list)

bricks_tree = th.list_to_tree(bricks_tree)
# ---------- end design_class ----------
design_class_2 = GhPythonScript(layer_cnt=Slider(5, range=1..10))  # -> out, top_srf, bottom_srf; inputs layer_cnt: Int32
# ---------- design_class_2: Python ----------
import ghpythonlib.treehelpers as th
import design as design
import imp
imp.reload(design)

d = design.Design(layer_cnt)

top_srf = d.base_crvs[0].bricks[0].surface[2]
bottom_srf = d.base_crvs[1].bricks[0].surface[0]
# ---------- end design_class_2 ----------
design_class_3 = GhPythonScript(layer_cnt=Slider(1, range=1..10))  # -> out, top_srf_tree, bot_srf_tree; inputs layer_cnt: Int32
# ---------- design_class_3: Python ----------
import ghpythonlib.treehelpers as th
import design as design
import imp
imp.reload(design)

d = design.Design(layer_cnt)

top_srf_tree = []
bot_srf_tree = []
for i in range(layer_cnt):
    top_srf_list = []
    bot_srf_list = []
    for j in range(len(d.base_crvs[i].bricks)):
        top_srf = d.base_crvs[i].bricks[j].surface[2]
        top_srf_list.append(top_srf)
        bot_srf = d.base_crvs[i].bricks[j].surface[0]
        bot_srf_list.append(bot_srf)
    top_srf_tree.append(top_srf_list)
    bot_srf_tree.append(bot_srf_list)

top_srf_tree = th.list_to_tree(top_srf_tree)
bot_srf_tree = th.list_to_tree(bot_srf_tree)
# ---------- end design_class_3 ----------
srf = Surface(design_class_2.bottom_srf)
srf_2 = Surface(design_class_2.top_srf)
srf_3 = Surface(design_class_3.bot_srf_tree)
srf_4 = Surface(design_class_3.top_srf_tree)
preview = CustomPreview(Geometry=design_class.bricks_tree, Material=ColourSwatch(SwatchColor=RGB(150, 150, 150)))
preview_2 = CustomPreview(Geometry=srf_2, Material=ColourSwatch(SwatchColor=RGB(255, 0, 0)))
preview_3 = CustomPreview(Geometry=srf, Material=ColourSwatch(SwatchColor=RGB(0, 170, 255)))
preview_4 = CustomPreview(Geometry=srf_4, Material=ColourSwatch(SwatchColor=RGB(255, 0, 0)))
preview_5 = CustomPreview(Geometry=srf_3, Material=ColourSwatch(SwatchColor=RGB(0, 170, 255)))
