# Grasshopper definition 211024_Bricks_PA.ghx (Grasshopper 1.0.7)

geo = Geometry(<point referenced from the Rhino model>)
geo_2 = Geometry(<point referenced from the Rhino model>)
geo_3 = Geometry(<point referenced from the Rhino model>)
python = GhPythonScript()  # -> out, brick_planes
# ---------- python: Python ----------
import Rhino.Geometry as rg
import math as m


"""Genrates a Rhino Geometry plane for each brick

This is where the design of the wall is created.

Returns
----------
brick_planes : [Rhino Geometry Plane, Rhino Geometry Plane, ...]

"""
Z_COUNT = 10
X_COUNT = 20

BRICK_LENGTH = 16
BRICK_HEIGHT = 4


brick_planes = []
for i in range(Z_COUNT):  # layer count
    for j in range(X_COUNT):  # layer length

        if i % 2 == 0:
            x_pos = j * (BRICK_LENGTH+1)
            rotation = m.radians(10)
        else:
            x_pos = j * (BRICK_LENGTH+1) + (BRICK_LENGTH/2)-1
            rotation = m.radians(-10)

        z_pos = i * (BRICK_HEIGHT)

        origin = rg.Point3d(x_pos, 0, z_pos)
        plane = rg.Plane(origin, rg.Vector3d.XAxis, rg.Vector3d.YAxis)
        plane.Rotate(rotation, rg.Vector3d.ZAxis)
        brick_planes.append(plane)
# ---------- end python ----------
xy = XYPlane(Origin=geo_3)
xy_2 = XYPlane(Origin=geo)
xy_3 = XYPlane(Origin=geo_2)
brick_01 = GhPythonScript(possition=xy)  # -> out, pts, srf, msh; inputs possition: Plane
# ---------- brick_01: Python ----------
import Rhino.Geometry as rg


def brick_01(plane):
    """ List of rg.Points definding the corners of the brick 
    
    Returns
    ----------
    [pt0 : bottom point at negative x and negative y,
    pt1 : bottom point at negative x and possitive y,
    pt2 : bottom point at possitive x and possitve y,
    pt3 : bottom point at possitive x and negative y,
    pt4 : pt0 + Thickness,
    pt5 : pt1 + Thickness,
    pt6 : pt2 + Thickness,
    pt7 : pt3 + Thickness]
    """
    LENGTH = 12.5
    WIDTH = 6
    HEIGHT = 4
    
    origin = plane.Origin # rg.Plane.Origin
    
    x_vec = plane.XAxis   # rg.Plane.XAxis
    y_vec = plane.YAxis   # rg.Plane.YAxis
    z_vec = plane.ZAxis   # rg.Plane.ZAxis
    
    # 1 create list of points defining the corner of the bricks 
    
    # 1.1 bottom points 
    
    pt_0 = origin - (x_vec*LENGTH/2) - (y_vec*WIDTH/2)
    pt_1 = origin + (x_vec*LENGTH/2) - (y_vec*WIDTH/2)
    pt_2 = origin + (x_vec*LENGTH/2) + (y_vec*WIDTH/2)
    pt_3 = origin - (x_vec*LENGTH/2) + (y_vec*WIDTH/2)
    
    bottom_pts = [pt_0, pt_1, pt_2, pt_3]
    
    # 1.2 top points 
    
    top_pts = []
    
    for pt in bottom_pts:
        t_pt = pt + z_vec*HEIGHT
        top_pts.append(t_pt)
    
    pts = []
    pts.extend(bottom_pts)
    pts.extend(top_pts)
    
    
    return pts
    
def surface(pts):
    """NURB surfaces depicting the brick:

    Returns
    ----------
    [srf0 : base surface,
    srf1 : long edge,
    srf2 : top surface
    srf3 : long edge,
    srf4 : short edge
    srf5 : short edge]

    """
    pt_0, pt_1, pt_2, pt_3, pt_4, pt_5, pt_6, pt_7 = pts

    srf_0 = rg.NurbsSurface.CreateFromPoints(
        [pt_0, pt_1, pt_3, pt_2], 2, 2, 1, 1)
    srf_1 = rg.NurbsSurface.CreateFromPoints(
        [pt_0, pt_1, pt_4, pt_5], 2, 2, 1, 1)
    srf_2 = rg.NurbsSurface.CreateFromPoints(
        [pt_4, pt_5, pt_7, pt_6], 2, 2, 1, 1)
    srf_3 = rg.NurbsSurface.CreateFromPoints(
        [pt_6, pt_7, pt_2, pt_3], 2, 2, 1, 1)
    srf_4 = rg.NurbsSurface.CreateFromPoints(
        [pt_0, pt_3, pt_4, pt_7], 2, 2, 1, 1)
    srf_5 = rg.NurbsSurface.CreateFromPoints(
        [pt_1, pt_2, pt_5, pt_6], 2, 2, 1, 1)

    return (srf_0, srf_1, srf_2, srf_3, srf_4, srf_5)
    
def mesh(pts):
    """Mesh  depicting the brick:

    Returns
    ----------
    mesh_brick : Mesh
    """

    mesh_brick = rg.Mesh.CreateFromBox(pts, 1, 1, 1)

    return mesh_brick
    

    
    
pts = brick_01(possition)

srf = surface(pts)

msh = mesh(pts)
# ---------- end brick_01 ----------
brick_01_2 = GhPythonScript(possitions=python.brick_planes)  # -> out, pts, srf, msh; inputs possitions: list of Plane
# ---------- brick_01_2: Python ----------
import Rhino.Geometry as rg


def brick_01(plane):
    """ List of rg.Points definding the corners of the brick 
    
    Returns
    ----------
    List of rg.Points definding the corners of the brick 
    
    Returns
    ----------
    [pt0 : bottom point at negative x and negative y,
    pt1 : bottom point at negative x and possitive y,
    pt2 : bottom point at possitive x and possitve y,
    pt3 : bottom point at possitive x and negative y,
    pt4 : pt0 + Thickness,
    pt5 : pt1 + Thickness,
    pt6 : pt2 + Thickness,
    pt7 : pt3 + Thickness]
    """
    
    LENGTH = 12.5
    WIDTH = 6
    HEIGHT = 4
    
    origin = plane.Origin # rg.Plane.Origin
    
    x_vec = plane.XAxis   # rg.Plane.XAxis
    y_vec = plane.YAxis   # rg.Plane.YAxis
    z_vec = plane.ZAxis   # rg.Plane.ZAxis
    
    # 1 create list of points defining the corner of the bricks 
    
    # 1.1 bottom points 
    
    pt_0 = origin - (x_vec*LENGTH/2) - (y_vec*WIDTH/2)
    pt_1 = origin + (x_vec*LENGTH/2) - (y_vec*WIDTH/2)
    pt_2 = origin + (x_vec*LENGTH/2) + (y_vec*WIDTH/2)
    pt_3 = origin - (x_vec*LENGTH/2) + (y_vec*WIDTH/2)
    
    bottom_pts = [pt_0, pt_1, pt_2, pt_3]
    
    # 1.2 top points 
    
    top_pts = []
    
    for pt in bottom_pts:
        t_pt = pt + z_vec*HEIGHT
        top_pts.append(t_pt)
    
    pts = []
    pts.extend(bottom_pts)
    pts.extend(top_pts)
    
    
    return pts
    
def surface(pts):
    """NURB surfaces depicting the brick:

    Returns
    ----------
    [srf0 : base surface,
    srf1 : long edge,
    srf2 : top surface
    srf3 : long edge,
    srf4 : short edge
    srf5 : short edge]

    """
    pt_0, pt_1, pt_2, pt_3, pt_4, pt_5, pt_6, pt_7 = pts

    srf_0 = rg.NurbsSurface.CreateFromPoints(
        [pt_0, pt_1, pt_3, pt_2], 2, 2, 1, 1)
    srf_1 = rg.NurbsSurface.CreateFromPoints(
        [pt_0, pt_1, pt_4, pt_5], 2, 2, 1, 1)
    srf_2 = rg.NurbsSurface.CreateFromPoints(
        [pt_4, pt_5, pt_7, pt_6], 2, 2, 1, 1)
    srf_3 = rg.NurbsSurface.CreateFromPoints(
        [pt_6, pt_7, pt_2, pt_3], 2, 2, 1, 1)
    srf_4 = rg.NurbsSurface.CreateFromPoints(
        [pt_0, pt_3, pt_4, pt_7], 2, 2, 1, 1)
    srf_5 = rg.NurbsSurface.CreateFromPoints(
        [pt_1, pt_2, pt_5, pt_6], 2, 2, 1, 1)

    return (srf_0, srf_1, srf_2, srf_3, srf_4, srf_5)
    
def mesh(pts):
    """Mesh  depicting the brick:

    Returns
    ----------
    mesh_brick : Mesh
    """

    mesh_brick = rg.Mesh.CreateFromBox(pts, 1, 1, 1)

    return mesh_brick
    

    
    
pts = [] 
srf = [] 

msh = [] 

for pos in possitions:
    b_pts = brick_01(pos)
    pts.extend(b_pts)
    srf.extend(surface(b_pts))
    msh.append(mesh(b_pts))
# ---------- end brick_01_2 ----------
brick_02 = GhPythonScript(possition=[xy_2, xy_3])  # -> out, a, meshes; inputs possition: list of Plane
# ---------- brick_02: Python ----------
import Rhino.Geometry as rg
import copy

def brick_02():
    
    """returns 8 points describing the brick:

    Returns
    ----------
    [pt0 : bottom point at origin,
    pt1 : bottom point at possitive Y,
    pt2 : bottom point at possitive X,
    pt3 : bottom point at possitive X and poossitive Y,
    pt4 : top point at origin,
    pt1 : top point at possitive Y,
    pt2 : top point at possitive X,
    pt3 : top point at possitive X and poossitive Y]
    """
    LENGTH = 12.5
    WIDTH = 6
    HEIGHT = 4
    
    pt_0 = rg.Point3d(0, 0, 0)
    pt_1 = rg.Point3d(LENGTH, 0, 0)
    pt_2 = rg.Point3d(LENGTH, WIDTH, 0)
    pt_3 = rg.Point3d(0, WIDTH, 0)

    pt_4 = rg.Point3d(0, 0, HEIGHT)
    pt_5 = rg.Point3d(LENGTH, 0, HEIGHT)
    pt_6 = rg.Point3d(LENGTH, WIDTH, HEIGHT)
    pt_7 = rg.Point3d(0, WIDTH, HEIGHT)

    b_pts = [pt_0, pt_1, pt_2, pt_3, pt_4, pt_5, pt_6, pt_7]

    return b_pts

    
def surface(pts):
    """NURB surfaces depicting the brick:

    Returns
    ----------
    [srf0 : base surface,
    srf1 : long edge,
    srf2 : top surface
    srf3 : long edge,
    srf4 : short edge
    srf5 : short edge]

    """
    pt_0, pt_1, pt_2, pt_3, pt_4, pt_5, pt_6, pt_7 = pts

    srf_0 = rg.NurbsSurface.CreateFromPoints(
        [pt_0, pt_1, pt_3, pt_2], 2, 2, 1, 1)
    srf_1 = rg.NurbsSurface.CreateFromPoints(
        [pt_0, pt_1, pt_4, pt_5], 2, 2, 1, 1)
    srf_2 = rg.NurbsSurface.CreateFromPoints(
        [pt_4, pt_5, pt_7, pt_6], 2, 2, 1, 1)
    srf_3 = rg.NurbsSurface.CreateFromPoints(
        [pt_6, pt_7, pt_2, pt_3], 2, 2, 1, 1)
    srf_4 = rg.NurbsSurface.CreateFromPoints(
        [pt_0, pt_3, pt_4, pt_7], 2, 2, 1, 1)
    srf_5 = rg.NurbsSurface.CreateFromPoints(
        [pt_1, pt_2, pt_5, pt_6], 2, 2, 1, 1)

    return (srf_0, srf_1, srf_2, srf_3, srf_4, srf_5)
    
def b_plane(pts):
    """returns the origin plane in the centre of the base of the brick:

    Returns
    ----------
    [Rhino Geometry Plane]

    """
    vec = (pts[2]-pts[0])/2
    origin = pts[0] + vec
    plane = rg.Plane(origin, rg.Vector3d.XAxis, rg.Vector3d.YAxis)
    return plane
    
def transform(b_location, pts):
    """Transoformation matrix fot transformating the brick to the brick possiotn:

    Returns
    ----------
    [Rhino Geometry Transformation]
    """
    
    
    brick_plane = b_plane(pts)
    
    transformation = rg.Transform.PlaneToPlane(brick_plane, b_location)
    
    brick_plane.Transform(transformation)
    
    t_pts = []
    
    for pt in pts:
        t_pt = copy.copy(pt)
        t_pt.Transform(transformation)
        t_pts.append(t_pt)
    
    
    return t_pts
    
def mesh(pts):
    """Mesh  depicting the brick:

    Returns
    ----------
    mesh_brick : Mesh
    """

    mesh_brick = rg.Mesh.CreateFromBox(pts, 1, 1, 1)

    return mesh_brick



meshes = []
for pos in possition:
    
    
    pts = brick_02()
    
    pts = transform(pos, pts)
    print pts
    srf = surface(pts)
    
    msh = mesh(pts)
    meshes.append(msh)
# ---------- end brick_02 ----------
geo_4 = Geometry(brick_02.meshes)
brick_class = GhPythonScript()  # -> Out, A
