# Grasshopper definition Hello_MAS_3DP.ghx (Grasshopper 1.0.7)

# ---- group: yAxis_pt
pt = ConstructPoint(XCoordinate="245.20", YCoordinate="422.50", ZCoordinate="-20.2")

# ---- group: Safe_pt
pt_2 = ConstructPoint(XCoordinate="245.25", YCoordinate="422.50", ZCoordinate="150.00")

# ----
# Reference geometries
robot_base = Geometry([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])
boundary = Curve(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)
# 4 type of input curves
inputbase_pt = Point(Point(792.59, 125.4, -8.42))

# ---- group: Degree =1 , Closed
crv = Curve(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)

# ---- group: Degree =1 , Open
crv_2 = Curve(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)

# ---- group: Degree =3 , Closed
crv_3 = Curve(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)

# ---- group: Degree =3 , Open
crv_4 = Curve(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)

# ---- group: Ori Pt
# UR5/10 Calibration Points & Work Area
# 
# Tool tip should just touch the ruler!!!
# 
# You should feel it's hardly to move the ruler
panel = Panel("245.20")
pt_3 = ConstructPoint(XCoordinate=panel, YCoordinate="326.70", ZCoordinate="-19.32")

# ---- group: xAxis_pt
pt_4 = ConstructPoint(XCoordinate="412.85", YCoordinate="326.70", ZCoordinate="-19.8")

# ----
# Basic Parameters
divide_interval = Slider(20, range=0..50)
layers = Slider(40, range=0..50)
velocity = Slider(15, range=0..50)

# ----
# Printing parameters generator
rsd_slicer = GhPythonScript(curve=crv_2, divide_interval=divide_interval, layers=layers, layer_height=Slider(1.05, range=0..10), velocity=velocity)  # -> points, way_points, velocities, blend_radiuses, extruder_toggles; inputs curve: Curve, layers: Int32, velocity: Int32
# ---------- rsd_slicer: Python ----------
import Rhino.Geometry as rg
import math as m
import random as r

def divide_crv(crv, divide_interval, endInc):
    crv_length = crv.GetLength()
    count = int(crv_length/divide_interval)
    params = crv.DivideByCount(count, endInc)
    points = [crv.PointAt(p) for p in params]#add simple version
    tangents = [crv.TangentAt(p) for p in params]
    normals = [rg.Vector3d.CrossProduct(t, rg.Vector3d.ZAxis) for t in tangents]
    return points, normals

def calc_blend_radius(new_pts, buffer=0.1):
    blend_radiuses = []
    for i in range(len (new_pts)-1):
        pt = new_pts[i]
        pt_1 = new_pts[i+1]
        dist = pt.DistanceTo(pt_1)
        blend_radius = dist*buffer
        blend_radiuses.append(blend_radius)
    blend_radiuses.append(blend_radiuses[-1])
    return blend_radiuses


"""
if curve_degree == 1, it's a polyline
or
if curve_degree == 3, it's a curve
we use different logic to divide this curve to get the planes for printing
"""
curve_degree = curve.Degree

points = []
if curve_degree ==1:
    if not curve.IsClosed:
        crv_segs = curve.DuplicateSegments()
        for i,seg in enumerate(crv_segs):
            if i==0:
                points.append(seg.PointAtStart)
                points.append(seg.PointAtEnd)
            else:
                points.append(seg.PointAtEnd)
    elif curve.IsClosed:
        crv_segs = curve.DuplicateSegments()
        for seg in crv_segs:
            points.append(seg.PointAtEnd)

elif curve_degree !=1:
    endInc = True
    points,_ = divide_crv(curve, divide_interval, endInc)

"""Here we create robot way points"""
way_points = []
for i in range(layers):
    layer_points = []
    for pt in points:
        way_point = rg.Point3d(pt.X, pt.Y, pt.Z + i*layer_height)
        layer_points.append(way_point)
    if i%2==1 and not curve.IsClosed:
        layer_points.reverse()
    way_points.extend(layer_points)

"""Here we insert a safe point in the beginning"""
safe_dis = 10.0
Lift = rg.Transform.Translation(0, 0, safe_dis)
safe_pt = way_points[0].Clone()
safe_pt.Transform(Lift)
way_points.insert(0,safe_pt)

"""Here we create a list of velocity"""
velocities=[]
for pt in way_points:
    velocities.append(velocity)

"""Here we create a list of blend radius"""
blend_radiuses = calc_blend_radius(way_points, buffer=0.1)

"""Here we create a list of extruder toggle, True means the robot sends signal to the extruder mortor """
extruder_toggles=[]
for i,pt in enumerate(way_points):
    if i ==0 or i == len(way_points)-1:
        extruder_toggles.append(False)# if toggle is False, stop extruding       
    else:
        extruder_toggles.append(True)# if toggle is True, extruding
# ---------- end rsd_slicer ----------

# ---- group: Select Target Pt
# Here you can select which point sent to UR
list = ValueList({"Ori_Pt": 0, "xAxis_Pt": 1, "yAxis_Pt": 2, "Safe_Pt": 3}, selected="xAxis_Pt")
filter = StreamFilter(Gate=list, Stream0=pt_3, Stream1=pt_4, Stream2=pt, Stream3=pt_2)

# ---- group: Robot_Send
# Send to UR
z = Slider(0.5, range=0..1000)
fabrication = GhPythonScript(
    ori_pt=pt_3,
    xAxis_pt=pt_4,
    yAxis_pt=pt,
    safe_pt=pt_2,
    inputBase_pt=inputbase_pt,
    robot_pts=rsd_slicer.way_points,
    velosities=rsd_slicer.velocities,
    blend_radiuses=rsd_slicer.blend_radiuses,
    extruder_toggles=rsd_slicer.extruder_toggles,
    myTCP_z=z,
    send=Button())  # -> script, rhino_base_way_planes, robot_planes; inputs ori_pt: Point3d, xAxis_pt: Point3d, yAxis_pt: Point3d, safe_pt: Point3d, inputBase_pt: Point3d, robot_pts: list, velosities: list, blend_radiuses: list, extruder_toggles: list
# ---------- fabrication: Python ----------
from compas_rhino import unload_modules
unload_modules('simple_ur_script')
unload_modules('simple_comm')

import Rhino.Geometry as rg
import simple_comm as c
import simple_ur_script as ur
import math as m


def tcp(script):
    """ This funktion sets tcp 
    """
    script += ur.set_tcp_by_angles(float(-17.90), float(45.85), float(143.68 + myTCP_z), m.radians(0.0), m.radians(180.0), m.radians(90.0))
    return script

def set_robot_base_plane_from_pts(ori_pt, xAxis_pt, yAxis_pt):
    robot_base = rg.Plane(ori_pt, xAxis_pt - ori_pt, yAxis_pt - ori_pt)
    return robot_base

def rhino_to_robot_space(rhino_plane):
    """ this funktion translates planes from the rhino cordinate system to
    the robot cordinate system 
    """
    robot_plane = rhino_plane.Clone()
    robotBase_plane = set_robot_base_plane_from_pts(ori_pt, xAxis_pt, yAxis_pt)
    _r_matrix = rg.Transform.PlaneToPlane(rg.Plane(inputBase_pt, rg.Vector3d.XAxis, rg.Vector3d.YAxis), 
                                          robotBase_plane)
    robot_plane.Transform(_r_matrix)
    return robot_plane

def point_to_rhino_plane(point):
    rhino_plane = rg.Plane(point, rg.Vector3d.XAxis, rg.Vector3d.YAxis)
    return rhino_plane

def set_extruder_speed_1(script):
    script += ur.set_digital_out(5, False)
    script += ur.set_digital_out(6,True) 
    script += ur.set_digital_out(7,False)
    return script
    
def set_extruder_speed_2(script):
    script += ur.set_digital_out(5, False)
    script += ur.set_digital_out(6,False) 
    script += ur.set_digital_out(7,True)
    return script

def set_extruder_retraction(script):
    script += ur.set_digital_out(5, False)
    script += ur.set_digital_out(6, True) 
    script += ur.set_digital_out(7, True)
    return script
    
def extrude(plane, vel, blend_radi, extr, script, change_extruder_status):
    script += ur.move_l_blend(plane, vel/1000, blend_radi/1000)
    
    if change_extruder_status:
        if extr:
            #script = set_extruder_speed_1(script)
            script = set_extruder_speed_2(script)
        else:
            script += ur.set_digital_out(5, True) 
    return script 


""" Robotic fabrication procedure
"""
script = ""

script = tcp(script)


"""Create rhino planes
"""

rhino_base_way_planes = []
for point in robot_pts:
    rhino_base_way_planes.append(point_to_rhino_plane(point))


"""Translate rhino planes to robot_plabe 
"""

robot_planes = []
for rhino_plane in (rhino_base_way_planes):
    robot_planes.append(rhino_to_robot_space(rhino_plane))

    
"""Create comands
"""

change_extruder_status = True
for i, (plane, velocity, blend_radi, extruder_toggle) in enumerate(zip(robot_planes, velosities, blend_radiuses, extruder_toggles)):
    if i>0:
        if extruder_toggle != extruder_toggles[i-1]:
            change_extruder_status = True
        else: 
            change_extruder_status = False

    script = extrude(plane, velocity, blend_radi, extruder_toggle, script, change_extruder_status)

    if i%5 == 0:
        script += ur.textmsg("Pt: %d" % i)

    if i == len(robot_pts)-1: #For the last point, we turn off the extruder
        #change_extruder_status = True
        script = extrude(plane, velocity, blend_radi, 0, script, change_extruder_status)
        script += ur.move_l_blend(rg.Plane(safe_pt, rg.Vector3d.XAxis, rg.Vector3d.YAxis),
                                  velocity/1000, 
                                  blend_radi/1000)

if send:
    script = c.concatenate_script(script)
    c.send_script(script, "192.168.10.10")
# ---------- end fabrication ----------

# ---- group: Send to calibrate table
# Here we calibrate the printing table
# 1.
# "Click send_TCP"
# 2.
# Set "tcp_h" to "0" while calibrating
# Set "tcp_h" >20  after calibration for safety reason
# 3. Click "send"
tcp_h = Slider(0, range=0..300)
send = Button()
conplane = GhPythonScript(pt=filter)  # -> plane; inputs pt: Point3d
# ---------- conplane: Python ----------
import Rhino.Geometry as rg

plane = rg.Plane(pt, rg.Vector3d.XAxis, rg.Vector3d.YAxis)
# ---------- end conplane ----------
send_tcp = Button()
sendtopoint = GhPythonScript(target_plane=conplane, tcp_height=tcp_h, send_TCP=send_tcp, send=send)  # -> rhino_base_way_planes, robot_planes, target_plane, script; inputs target_plane: Plane, send_TCP: Boolean
# ---------- sendtopoint: Python ----------
from compas_rhino import unload_modules
unload_modules('simple_ur_script')
unload_modules('simple_comm')

import simple_comm as c
import simple_ur_script as ur
import Rhino.Geometry as rg
import math as m

if send_TCP:
    script = ""
    script += ur.set_tcp_by_angles(float(-17.90), float(45.85), float(143.68), m.radians(0.0), m.radians(180.0), m.radians(90.0))
    script = c.concatenate_script(script)
    c.send_script(script,"192.168.10.10")

T = rg.Transform.Translation(0,0,tcp_height)
target_plane.Transform(T)

if send:
    script = ""
    script += ur.set_tcp_by_angles(float(-17.90), float(45.85), float(143.68), m.radians(0.0), m.radians(180.0), m.radians(90.0))
    velocity = 0.05
    acceleration = 0.02
    
    script += ur.move_l(target_plane, acceleration, velocity)
    script = c.concatenate_script(script)
    c.send_script(script,"192.168.10.10")
# ---------- end sendtopoint ----------

# ----
panel_2 = Panel(fabrication.script)
panel_3 = Panel(sendtopoint.script)
