# Grasshopper definition Hello_MAS_3DP_Updated.ghx (Grasshopper 1.0.7)

# ---- group: Ori Pt
# UR5/10 Calibration Points & Work Area
# 
# Tool tip should just touch the ruler!!!
# 
# You should feel it's hardly to move the ruler
panel = Panel("245.20")
pt = ConstructPoint(XCoordinate=panel, YCoordinate="326.70", ZCoordinate="-19.32")

# ---- group: xAxis_pt
pt_2 = ConstructPoint(XCoordinate="412.85", YCoordinate="326.70", ZCoordinate="-19.8")

# ---- group: yAxis_pt
pt_3 = ConstructPoint(XCoordinate="245.20", YCoordinate="422.50", ZCoordinate="-20.2")

# ---- group: Safe_pt
pt_4 = ConstructPoint(XCoordinate="245.25", YCoordinate="422.50", ZCoordinate="150.00")

# ----
# Reference geometries
robot_base = Geometry([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])

# ----
# Should be a "Planar" rectangle boundry, drawn from the "OriPt" you measured.
# Can be moved anywhere you like
boundary = Curve(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)

# ----
# Should be replaced by the bottom left point(top view in Rhino)
# 4 types of input curves
inputbase_pt = Point(Point(792.59, 125.4, -8.42))

# ---- group: Degree =1 , Closed
# Should be inside the "Boundary", and aligned to it(side view in Rhino)
crv = Curve(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)

# ---- group: Degree =1 , Open
crv_2 = Curve(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)

# ---- group: Degree =3 , Closed
crv_3 = Curve(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)

# ---- group: Degree =3 , Open
crv_4 = Curve(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)

# ----
# Basic Parameters
divide_interval = Slider(15, range=0..50)
layers = Slider(30, range=0..50)
velocity = Slider(15, range=0..50)

# ---- group: Select Target Pt
# Here you can select which point sent to UR
list = ValueList({"Ori_Pt": 0, "xAxis_Pt": 1, "yAxis_Pt": 2, "Safe_Pt": 3}, selected="Ori_Pt")
filter = StreamFilter(Gate=list, Stream0=pt, Stream1=pt_2, Stream2=pt_3, Stream3=pt_4)

# ----
# Printing parameters generator
rsd_slicer = GhPythonScript(curve=crv_2, divide_interval=divide_interval, layers=layers, layer_height=Slider(1.05, range=0..10), velocity=velocity)  # -> points, way_points, velocities, blend_radiuses, extruder_toggles; inputs curve: Curve, layers: Int32, velocity: Int32
# ---------- rsd_slicer: Python ----------
import Rhino.Geometry as rg
import math as m
import random as r

def divide_crv(crv, divide_interval, endInc):
    crv_length = crv.GetLength()
    count = int(crv_length/divide_interval)
    params = crv.DivideByCount(count, endInc)
    points = [crv.PointAt(p) for p in params]#add simple version
    tangents = [crv.TangentAt(p) for p in params]
    normals = [rg.Vector3d.CrossProduct(t, rg.Vector3d.ZAxis) for t in tangents]
    return points, normals

def calc_blend_radius(new_pts, buffer=0.1):
    blend_radiuses = []
    for i in range(len (new_pts)-1):
        pt = new_pts[i]
        pt_1 = new_pts[i+1]
        dist = pt.DistanceTo(pt_1)
        blend_radius = dist*buffer
        blend_radiuses.append(blend_radius)
    blend_radiuses.append(blend_radiuses[-1])
    return blend_radiuses


"""
if curve_degree == 1, it's a polyline
or
if curve_degree == 3, it's a curve
we use different logic to divide this curve to get the planes for printing
"""
curve_degree = curve.Degree
print (curve.Degree)

points = []
if curve_degree ==1:
    if not curve.IsClosed:
        crv_segs = curve.DuplicateSegments()
        for i,seg in enumerate(crv_segs):
            if i==0:
                points.append(seg.PointAtStart)
                points.append(seg.PointAtEnd)
            else:
                points.append(seg.PointAtEnd)
    elif curve.IsClosed:
        crv_segs = curve.DuplicateSegments()
        for seg in crv_segs:
            points.append(seg.PointAtEnd)

elif curve_degree !=1:
    endInc = True
    points, _ = divide_crv(curve, divide_interval, endInc)

"""Here we create robot way points"""
way_points = []
for i in range(layers):
    layer_points = []
    for pt in points:
        way_point = rg.Point3d(pt.X, pt.Y, pt.Z + i*layer_height)
        layer_points.append(way_point)
    if i%2==1 and not curve.IsClosed:
        layer_points.reverse()
    way_points.extend(layer_points)

"""Here we insert a safe point in the beginning"""
safe_dis = 10.0
Lift = rg.Transform.Translation(0, 0, safe_dis)
safe_pt = way_points[0].Clone()
safe_pt.Transform(Lift)
way_points.insert(0,safe_pt)

"""Here we create a list of velocity"""
velocities=[]
for pt in way_points:
    velocities.append(velocity)

"""Here we create a list of blend radius"""
blend_radiuses = calc_blend_radius(way_points, buffer=0.1)

"""Here we create a list of extruder toggle, True means the robot sends signal to the extruder mortor """
extruder_toggles=[]
for i,pt in enumerate(way_points):
    if i ==0 or i == len(way_points)-1:
        extruder_toggles.append(False)# if toggle is False, stop extruding       
    else:
        extruder_toggles.append(True)# if toggle is True, extruding
# ---------- end rsd_slicer ----------

# ---- group: Send to calibrate table
# Here we calibrate the printing table
# 1.
# "Click send_TCP"
# 2.
# Set "tcp_h" to "0" while calibrating
# Set "tcp_h" >20  after calibration for safety reason
# 3. Click "send"
send_tcp = Button()
tcp_h = Slider(30.04, range=0..300)
send = Button()
conplane = GhPythonScript(pt=filter)  # -> plane; inputs pt: Point3d
# ---------- conplane: Python ----------
import Rhino.Geometry as rg

plane = rg.Plane(pt, rg.Vector3d.XAxis, rg.Vector3d.YAxis)
# ---------- end conplane ----------
sendtopoint = GhPythonScript(target_plane=conplane, tcp_height=tcp_h, send_TCP=send_tcp, send=send)  # -> rhino_base_way_planes, robot_planes, target_plane, script; inputs target_plane: Plane, send_TCP: Boolean
# ---------- sendtopoint: Python ----------
from compas_rhino import unload_modules
unload_modules('simple_ur_script')
unload_modules('simple_comm')

import simple_comm as c
import simple_ur_script as ur
import Rhino.Geometry as rg
import math as m

if send_TCP:
    script = ""
    script += ur.set_tcp_by_angles(float(-17.90), float(45.85), float(143.68), m.radians(0.0), m.radians(180.0), m.radians(90.0))
    script = c.concatenate_script(script)
    c.send_script(script,"192.168.10.10")

T = rg.Transform.Translation(0,0,tcp_height)
target_plane.Transform(T)

if send:
    script = ""
    script += ur.set_tcp_by_angles(float(-17.90), float(45.85), float(143.68), m.radians(0.0), m.radians(180.0), m.radians(90.0))
    velocity = 0.05
    acceleration = 0.02
    
    script += ur.move_l(target_plane, acceleration, velocity)
    script = c.concatenate_script(script)
    c.send_script(script,"192.168.10.10")
# ---------- end sendtopoint ----------

# ---- group: Robot_Send
# Send to UR
mytcp_z = Slider(0.5, range=-2..2)
send_2 = Button()
fabrication = GhPythonScript(
    ori_pt=pt,
    xAxis_pt=pt_2,
    yAxis_pt=pt_3,
    safe_pt=pt_4,
    inputBase_pt=inputbase_pt,
    robot_pts=rsd_slicer.way_points,
    velosities=rsd_slicer.velocities,
    blend_radiuses=rsd_slicer.blend_radiuses,
    extruder_toggles=rsd_slicer.extruder_toggles,
    myTCP_z=mytcp_z,
    send=send_2)  # -> script, rhino_base_way_planes, robot_planes; inputs ori_pt: Point3d, xAxis_pt: Point3d, yAxis_pt: Point3d, safe_pt: Point3d, inputBase_pt: Point3d, robot_pts: list, velosities: list, blend_radiuses: list, extruder_toggles: list
# ---------- fabrication: Python ----------
from compas_rhino import unload_modules
unload_modules('simple_ur_script')
unload_modules('simple_comm')

import Rhino.Geometry as rg
import simple_comm as c
import simple_ur_script as ur
import math as m

def tcp(script):
    """ This function sets tcp
        Change "myTCPz" to adjust the tcp for having a nice the first layer print, 
        the slider of it is set from -2.0 to +2.0, dont change it, 
        run the calibration again if this domain doesn't work for you
    """
    script += ur.set_tcp_by_angles(float(-17.90), float(45.85), float(143.68 + myTCP_z), m.radians(0.0), m.radians(180.0), m.radians(90.0))
    return script

def set_robot_base_plane_from_pts(ori_pt, xAxis_pt, yAxis_pt):
    """ This function constructs the robot base plane form 3 calibrated points.
    """
    robot_base = rg.Plane(ori_pt, xAxis_pt - ori_pt, yAxis_pt - ori_pt)
    return robot_base

def rhino_to_robot_space(rhino_plane):
    """ this function translates planes from the rhino cordinate system to
        the robot cordinate system.
        It uses "inputBase_pt", which should use the bottom left corner point(from top view in Rhino)
        to construct a "rhino plane",
        and get a transform matrix from it to the "robot base plane"
    """
    robot_plane = rhino_plane.Clone()
    robotBase_plane = set_robot_base_plane_from_pts(ori_pt, xAxis_pt, yAxis_pt)
    _r_matrix = rg.Transform.PlaneToPlane(rg.Plane(inputBase_pt, rg.Vector3d.XAxis, rg.Vector3d.YAxis), 
                                          robotBase_plane)
    robot_plane.Transform(_r_matrix)
    return robot_plane

def point_to_rhino_plane(point):
    """ this function makes planes form the input points
    """
    rhino_plane = rg.Plane(point, rg.Vector3d.XAxis, rg.Vector3d.YAxis)
    return rhino_plane

def set_extruder_speed_0(script):
    """ this function changes the IO 5-6 status to print
        by using "espeed 0" in Arduino, 2mm/sec as default
    """
    script += ur.set_digital_out(5, False)
    script += ur.set_digital_out(6,False) 
    script += ur.set_digital_out(7,True)
    return script
    
def set_extruder_speed_1(script):
    """ this function changes the IO 5-6 status to print
        by using "espeed 1" in Arduino, 7mm/sec as default
    """
    script += ur.set_digital_out(5, False)
    script += ur.set_digital_out(6,True) 
    script += ur.set_digital_out(7,False)
    return script

def set_extruder_retraction(script):
    """ this function changes the IO 5-6 status to retract
        by using "rspeed" in Arduino, 30mm/sec as default
        MAYBE IT'S TOO FAST, WILL BE TESTED AND IMPLEMENTED LATTER
    """
    script += ur.set_digital_out(5, False)
    script += ur.set_digital_out(6, True) 
    script += ur.set_digital_out(7, True)
    return script
    
def extrude(plane, vel, blend_radi, extruder_toggle, script, change_extruder_status):
    """ this function generates robot motion and sends IO signals
        use function "set_extruder_speed_0" for slower extrution speed.
        
        Note "change_extruder_status" is to check if the current "extruder_toggle" is different form the previous one
        if it's different and current "extruder_toggle" is "True", it prints;
        if it's different and current "extruder_toggle" is "False", it turns IO 5 so it stops printing.
        This is to shorten the fianl UR script, so you can send more points for printing
    """
    script += ur.move_l_blend(plane, vel/1000, blend_radi/1000)
    if change_extruder_status:
        if extruder_toggle:
            """
            Disable one line below to switch between "aspeed 0" and "aspeed 1"
            """
            #script = set_extruder_speed_0(script)
            script = set_extruder_speed_1(script)
        else:
            script += ur.set_digital_out(5, True) 
    return script 


""" Robotic fabrication procedure
"""
script = ""
script = tcp(script)


"""Create rhino planes
"""

rhino_base_way_planes = []
for point in robot_pts:
    rhino_base_way_planes.append(point_to_rhino_plane(point))


"""Translate rhino planes to robot_plabe 
"""

robot_planes = []
for rhino_plane in (rhino_base_way_planes):
    robot_planes.append(rhino_to_robot_space(rhino_plane))

    
"""Create commands
"""

change_extruder_status = True
for i, (plane, velocity, blend_radi, extruder_toggle) in enumerate(zip(robot_planes, velosities, blend_radiuses, extruder_toggles)):
    if i>0:
        if extruder_toggle != extruder_toggles[i-1]:
            change_extruder_status = True
        else:
            """ check explaination of "extrude", compared to the previous one,
                if the "extruder_toggle" is not changed, IO status doesn't need to change either.
                So "change_extruder_status" is set to "False" 
                and "extrude" function only generates script for robot motion
            """
            change_extruder_status = False

    script = extrude(plane, velocity, blend_radi, extruder_toggle, script, change_extruder_status)

    if i%5 == 0:
        """ Click "log" on the UR panel to read the index of the last point printed
            It only returns index every 5 points
        """
        script += ur.textmsg("Pt: %d" % i)

    if i == len(robot_pts)-1: 
        """ For the last point, it turns off the extruder
            Since the "extruder toggle" of the last point is "False"
            function "ectrude" turns on IO 5 to stop extruding 
        """
        change_extruder_status = True
        script = extrude(plane, velocity, blend_radi, 0, script, change_extruder_status)
        
        
        """ Move to the safe point, note the safe point is not included in the list of points sent to UR
        """
        script += ur.move_l_blend(rg.Plane(safe_pt, rg.Vector3d.XAxis, rg.Vector3d.YAxis),
                                  velocity/1000, 
                                  blend_radi/1000)

if send:
    script = c.concatenate_script(script)
    c.send_script(script, "192.168.10.10")
# ---------- end fabrication ----------

# ----
panel_2 = Panel(fabrication.script)
panel_3 = Panel(sendtopoint.script)
