# Grasshopper definition 211117_ContourPython_PA.gh (Grasshopper 1.0.7)

geo = Geometry(<brep referenced from the Rhino model>)
python = GhPythonScript(brep=geo)  # -> out, graft(intersection_curves); inputs brep: Brep
# ---------- python: Python ----------
import Rhino.Geometry as rg
import random as r
import ghpythonlib.treehelpers as ght

##First get the min_z, max_z and height

brep_bounding_box = brep.GetBoundingBox(rg.Plane.WorldXY)


max_x, max_y, max_z = brep_bounding_box.Max
min_x, min_y, min_z = brep_bounding_box.Min

brep_height = max_z - min_z

### Intersect brep with a series of planes 

intersection_curves = []

min_thickness = 1
max_thickness = 10
height = min_z

for i in range (1000):
    height += r.uniform(min_thickness, max_thickness)
    if height < max_z:
        intersection_plane = rg.Plane(rg.Point3d(0,0, height), rg.Vector3d.XAxis, rg.Vector3d.YAxis)
        
        intersection_events = rg.Intersect.Intersection.BrepPlane(brep, intersection_plane, 0.01)
        
        
        if intersection_events[0]:
            print "sucesfull intersection!"
            
            for crv in intersection_events[1]:
                intersection_curves.append(crv)
        else:
            print "brep and plane are not interecting! You are doing something wrong!"


intersection_curves = ght.list_to_tree(intersection_curves)
# ---------- end python ----------
geo_2 = Geometry(python.intersection_curves)
