# Grasshopper definition 211118_slicing with Petrus.gh (Grasshopper 1.0.7)

geo = Geometry(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)
python = GhPythonScript(brep=geo)  # -> out, a, brep_bounding_box, planes, int_crvs; inputs brep: Brep
# ---------- python: Python ----------
import math
import Rhino.Geometry as rg

print brep

brep_bounding_box = rg.Brep.GetBoundingBox(brep,rg.Plane.WorldXY)

max_x,max_y,max_z = brep_bounding_box.Max
min_x,min_y,min_z = brep_bounding_box.Min

brep_height = max_z-min_z
layer_thick = 1.2

brep_count = int(brep_height/layer_thick)
print brep_count

planes = []
int_crvs = []
for i in range(brep_count):
    int_plane = rg.Plane(rg.Point3d(0,0,i*layer_thick+min_z),rg.Vector3d.XAxis,rg.Vector3d.YAxis)
    
    intersection_event = rg.Intersect.Intersection.BrepPlane(brep,int_plane,1.0)
    
    if intersection_event[0]:
        for crv in intersection_event[1]:
            int_crvs.append(crv)
    print intersection_event[2]
    planes.append(int_plane)
# ---------- end python ----------
crv = Curve(python.int_crvs)
