# Grasshopper definition 211123_ElMehdiJoaquin_PA.ghx (Grasshopper 1.0.7)

geo = Geometry(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)
python = GhPythonScript(brep=geo)  # -> out, slicing_plane_Z, min_thickness, max_thickness, brep_height; inputs brep: Brep
# ---------- python: Python ----------
import Rhino.Geometry as rg




bb = brep.GetBoundingBox(rg.Plane.WorldXY) #rg.Brep.GetBoundingBox(brep, rg.Plane.WorldXY)

min_x, min_y, min_z = bb.Min #rg.BoundingBox.Min
max_x, max_y, max_z = bb.Max #rg.BoundingBox.Max

brep_height = max_z - min_z # Height dimension of the brep

min_thickness = 1
max_thickness = 2.5
print min_thickness
print max_thickness

average_thickness = (min_thickness + max_thickness)/2


layer_cnt = int(brep_height/min_thickness)

#### Loop to grenerate list oh z_hieght that we use for slizing the brep
slicing_plane_Z = []

for i in range (layer_cnt):
    slicing_plane_Z.append(i * average_thickness) 
    
    
print brep_height
# ---------- end python ----------
graph = GraphMapper(
    python.slicing_plane_Z,
    x0=0,
    x1=200,
    y0=0,
    y1=200,
    container_name="Sine",
    Equation_px=[0, 0.2918300331],
    Equation_py=[0, 0.9803890586])
python_2 = GhPythonScript(z_values=graph, brep_height=python.brep_height)  # -> out, distances; inputs z_values: list
# ---------- python_2: Python ----------
distances = []

for i in range(len(z_values)-1):
    dist = z_values[i+1] - z_values[i]
    distances.append(dist)


### last distance ####

second_last_dist = z_values[-1]
last_dist = brep_height-second_last_dist 

distances.append(last_dist)
# ---------- end python_2 ----------
bnd = Bounds(Numbers=python_2.distances)
dom = ConstructDomain(DomainStart=python.min_thickness, DomainEnd=python.max_thickness)
remap = RemapNumbers(Value=python_2.distances, Source=bnd, Target=dom)  # -> Mapped, Clipped
python_3 = GhPythonScript(brep=geo, z_values=remap.Mapped)  # -> out, intersection_crvs; inputs brep: Brep, z_values: list
# ---------- python_3: Python ----------
import Rhino.Geometry as rg




### Create our intersection planes and intersect them with the brep

intersection_crvs = []
height = 0

layer_thicknesses = []

for z in z_values:
    height += z
    intersection_plane = rg.Plane(rg.Point3d(0,0,height), rg.Vector3d.XAxis, rg.Vector3d.YAxis)
    
    intersection_events = rg.Intersect.Intersection.BrepPlane(brep, intersection_plane, 0.1)
    
    if intersection_events[0]:
        
        for crv in intersection_events[1]:
            intersection_crvs.append(crv)
            layer_thicknesses.append(z)
# ---------- end python_3 ----------
geo_2 = Geometry(python_3.intersection_crvs)
