# Grasshopper definition 211201_EulerAngles_PA.ghx (Grasshopper 1.0.7)

planes = GhPythonScript()  # -> out, plane_01, plane_02
# ---------- planes: Python ----------
import Rhino.Geometry as rg
import math as m


### Input planes
origin = rg.Point3d(0,0,0)

plane_01 = rg.Plane(origin, rg.Vector3d.XAxis, rg.Vector3d.YAxis)

plane_02 = plane_01.Clone()

plane_02.Rotate(m.radians(45), rg.Vector3d.XAxis)
plane_02.Rotate(m.radians(-45), rg.Vector3d.YAxis)
plane_02.Rotate(m.radians(45), rg.Vector3d.ZAxis)
# ---------- end planes ----------
geo = Geometry(planes.plane_02)
python = GhPythonScript(plane_01=planes.plane_01, plane_02=planes.plane_02)  # -> out, plane_02, work_plane, test_plane; inputs plane_01: Plane, plane_02: Plane
# ---------- python: Python ----------
import Rhino.Geometry as rg
import math as m


### compare x_vector in x, y, z 

transformation = rg.Transform.PlaneToPlane(plane_01,plane_02)

bool, x,y,z = transformation.GetYawPitchRoll()

print m.degrees(x)
print m.degrees(y)
print m.degrees(z)


roatation = rg.Transform.RotationZYX(x,y,z)

test_plane = rg.Plane(rg.Point3d(0,0,10), rg.Vector3d.XAxis, rg.Vector3d.YAxis)

test_plane.Transform(roatation)

""""
bool, x,y,z = transformation.GetEulerZYZ()

print m.degrees(x)
print m.degrees(y)
print m.degrees(z)

rotation = rg.Transform.RotationZYZ(x,y,z)


test_plane = rg.Plane(rg.Point3d(0,0,10), rg.Vector3d.XAxis, rg.Vector3d.YAxis)

test_plane.Transform(rotation)
"""
# ---------- end python ----------
geo_2 = Geometry(python.work_plane)
geo_3 = Geometry(python.test_plane)
python_2 = GhPythonScript()  # -> out, a
# ---------- python_2: Python ----------
import Rhino.Geometry as rg
import math as m
"""
We start from the plane we will use for printing (pl_in) and by rotating it one axis every time
(first x, then y, then z) in order to align it with the default plane (pl_d), we get the negative
value of the angle we need (negative because in practice we will start from pl_d and tranform to pl_in)
"""
pl_x_help = rg.Plane(pl_in.Origin, pl_in.ZAxis, pl_in.YAxis)
_,intx = rg.Intersect.Intersection.PlanePlane(pl_d, pl_x_help)
vec_x_help = rg.Vector3d(intx.To.X - intx.From.X, intx.To.Y - intx.From.Y, intx.To.Z - intx.From.Z)
angle_x = rg.Vector3d.VectorAngle(vec_x_help, pl_in.YAxis, pl_x_help)
if angle_x > m.pi:
    angle_x -= 2*m.pi
rot_x_matrix = rg.Transform.Rotation(angle_x,           # here was the problem, we should have to use -angle_x
                                     pl_in.XAxis,
                                     pl_in.Origin)
pl_in_x = pl_in.Clone()
pl_in_x.Transform(rot_x_matrix)
pl_y_help = rg.Plane(pl_in_x.Origin, pl_in_x.ZAxis, pl_in.XAxis)
_,inty = rg.Intersect.Intersection.PlanePlane(pl_d, pl_y_help)
vec_y_help = rg.Vector3d(inty.To.X - inty.From.X, inty.To.Y - inty.From.Y, inty.To.Z - inty.From.Z)
angle_y = rg.Vector3d.VectorAngle(vec_y_help, pl_in_x.XAxis, pl_y_help)
if angle_y > m.pi:
    angle_y -= 2*m.pi
rot_y_matrix = rg.Transform.Rotation(-angle_y,
                                     pl_in_x.YAxis,
                                     pl_in_x.Origin)
pl_in_y = pl_in_x.Clone()
pl_in_y.Transform(rot_y_matrix)
angle_z = rg.Vector3d.VectorAngle(pl_d.XAxis, pl_in_y.XAxis, pl_d)
if angle_z > m.pi:
    angle_z -= 2*m.pi
rot_z_matrix = rg.Transform.Rotation(-angle_z,
                                     pl_in_y.ZAxis,
                                     pl_in_y.Origin)
pl_in_z = pl_in_y.Clone()
pl_in_z.Transform(rot_z_matrix)
# ---------- end python_2 ----------
