# Grasshopper definition 211215_Catenary_PA.ghx (Grasshopper 1.0.7)

crv = Curve(<curve referenced from the Rhino model>)
divide = DivideCurve(Curve=crv, Count=Slider(8, range=0..10), Kinks=False)  # -> Points, Tangents, Parameters
pl = ConstructPlane(Origin=divide.Points, XAxis=Vector(1, 0, 0), YAxis=Vector(0, 1, 0))
python = GhPythonScript(target_deflection=Slider(43, range=0..100), planes=pl)  # -> out, layered_catenaries, layered_robot_planes, layered_robot_vel; inputs target_deflection: Int32, planes: list
# ---------- python: Python ----------
import Rhino.Geometry as rg
import ghpythonlib as gh




def generateCatenary(plane_1, plane_2, target_deflection):
    
    pt_0 = plane_1.Origin
    pt_1 = plane_2.Origin
    
    distance = pt_0.DistanceTo(pt_1)
    catenary_geuss = distance * 1.2
    
    catenary = gh.components.Catenary(pt_0, pt_1, catenary_geuss, rg.Vector3d(0,0,-1))
    mid_pt = catenary.PointAtNormalizedLength(0.5)
    deflection = pt_0.Z - mid_pt.Z
    
    for i in range (250):
        
        if deflection < target_deflection:
            catenary_geuss += 0.25
        else:
            catenary_geuss -= 0.25
        
        
        catenary = gh.components.Catenary(pt_0, pt_1, catenary_geuss, rg.Vector3d(0,0,-1))
        mid_pt = catenary.PointAtNormalizedLength(0.5)
        deflection = pt_0.Z - mid_pt.Z
    
    return catenary

def calcVel(pt1, pt2, catenary_len):
    
    extursion_vel = 9 # mm/s
    
    pt_0 = planes[i].Origin
    pt_1 = planes[i+1].Origin
    
    robot_distance = pt_0.DistanceTo(pt_1)
    robot_vel = robot_distance/catenary_len* extursion_vel
    
    return robot_vel
    

def genSegment(layer_cnt, target_deflection, plane_1, plane_2, first_section):
    ### test for 10 layers ####
    
    
    
    layer_thickness  = 1.8
    deflection_layer_thickness = 3
    robot_safe_vel = 20
    
    cat_vector = plane_2.Origin-plane_1.Origin
    cat_vector.Unitize()
    
    catenaries = []
    
    path_lengths = []
    
    robot_planes = []
    
    robot_velocities = []
    
    if first_section:
        for i in range (layer_cnt):
            temp_plane_1 = plane_1.Clone()
            temp_plane_1.Translate(rg.Vector3d(0,0,layer_thickness*i))
            
            robot_v = robot_safe_vel
            
            robot_velocities.append(robot_v)
            path_lengths.append(None)
            robot_planes.append(temp_plane_1)
    else:
        for i in range (layer_cnt):
            temp_plane_1 = plane_1.Clone()
            temp_plane_1.Translate(rg.Vector3d(0,0,layer_thickness*i))
            
            temp_plane_1_1 = plane_1.Clone()
            temp_plane_1_1.Translate((rg.Vector3d(0,0,layer_thickness*i)+cat_vector*i))
            
            temp_line_1 = rg.NurbsCurve.Create(False, 1, [temp_plane_1.Origin, temp_plane_1_1.Origin])
            
            temp_plane_2 = plane_2.Clone()
            temp_plane_2.Translate(rg.Vector3d(0,0,layer_thickness*i))
            
            temp_plane_2_1 = plane_2.Clone()
            temp_plane_2_1.Translate((rg.Vector3d(0,0,layer_thickness*i)-cat_vector*i))
            
            
            temp_line_2 = rg.NurbsCurve.Create(False, 1, [temp_plane_2.Origin, temp_plane_2_1.Origin])
            
            catenary = generateCatenary(temp_plane_1_1, temp_plane_2_1, target_deflection- (i*deflection_layer_thickness))
            
            test = rg.Curve.JoinCurves([temp_line_1, catenary, temp_line_2])
            
            crv = test[0]
            
            catenaries.append(crv) 
            path_length = crv.GetLength()
            
            robot_v = calcVel(temp_plane_1.Origin, temp_plane_2.Origin, path_length)
            
            robot_velocities.append(robot_v)
            
            path_lengths.append(path_length)
            
            robot_planes.append(temp_plane_2)
            
    return catenaries, robot_planes, robot_velocities
    
################################################################################

################################################################################



layer_cnt = 10


nested_catenaries = []
nested_robot_planes = []
nested_robot_vel= []

for i in range(len(planes)-1):
    if i == 0:
        first_section = True
        seg_catenaries, seg_robot_planes, seg_robot_vel = genSegment(layer_cnt, target_deflection, planes[i], planes[i+1], first_section)
        first_section = False
        seg_catenaries, seg_robot_planes, seg_robot_vel = genSegment(layer_cnt, target_deflection, planes[i], planes[i+1], first_section)
    else:
        first_section = False
        seg_catenaries, seg_robot_planes, seg_robot_vel = genSegment(layer_cnt, target_deflection, planes[i], planes[i+1], first_section)

    
        
    nested_robot_planes.append(seg_robot_planes)
    nested_catenaries.append(seg_catenaries)
    nested_robot_vel.append(seg_robot_vel)
    

################################################################################

################################################################################

### Change order ####
layered_catenaries = []
layered_robot_planes = []
layered_robot_vel= []



for i in range (len(nested_robot_planes[0])):
    layer_c = []
    layer_r_p = []
    layer_r_v = []
    
    for j in range(len(nested_robot_planes)):
        layer_c.append(nested_robot_planes[j][i])
        layer_r_p.append(nested_catenaries[j][i])
        layer_r_v.append(nested_robot_vel[j][i])
        
    layered_catenaries.append(layer_c)
    layered_robot_planes.append(layer_r_p)
    layered_robot_vel.append(layer_r_v)

layered_catenaries = gh.treehelpers.list_to_tree(layered_catenaries)
layered_robot_planes = gh.treehelpers.list_to_tree(layered_robot_planes)
layered_robot_vel = gh.treehelpers.list_to_tree(layered_robot_vel)
# ---------- end python ----------
geo = Geometry(python.layered_robot_planes)
panel = Panel(python.layered_robot_vel)
robotic_fabrication = GhPythonScript()  # -> out, a; unedited script template
