# Grasshopper definition 211216_CatenaryPlanesVelocity_PA.gh (Grasshopper 1.0.7)

crv = Curve(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)
divide = DivideCurve(Curve=crv, Count=Slider(8, range=0..10), Kinks=False)  # -> Points, Tangents, Parameters
pl = ConstructPlane(Origin=divide.Points, XAxis=Vector(1, 0, 0), YAxis=Vector(0, 1, 0))
item = ListItem(List=pl, Index=Slider(0, range=0..100), Wrap=True)
geo = Geometry(item)
merge = Merge(Data1=pl, Data2=geo)
debug = GhPythonScript(target_deflection=Slider(24, range=0..100), planes=merge)  # -> out, layered_catenaries, layered_robot_planes, layered_robot_vel; inputs target_deflection: Int32, planes: list
# ---------- debug: Python ----------
import Rhino.Geometry as rg
import ghpythonlib as gh

def generateCatenary(plane_1, plane_2, target_deflection):
    
    pt_0 = plane_1.Origin
    pt_1 = plane_2.Origin
    
    distance = pt_0.DistanceTo(pt_1)
    catenary_geuss = distance * 1.2 # large deflection needs a bigger value 
    
    catenary = gh.components.Catenary(pt_0, pt_1, catenary_geuss, rg.Vector3d(0,0,-1))
    mid_pt = catenary.PointAtNormalizedLength(0.5)
    deflection = pt_0.Z - mid_pt.Z
    
    for i in range (250):  # Amount of calculations small number - fast but imprecise high number slow but more precise
        
        if deflection < target_deflection:
            catenary_geuss += 0.25 # step size if you decrease the amount of calculations you might need to increase the steps
        else:
            catenary_geuss -= 0.25# step size if you decrease the amount of calculations you might need to increase the steps
        
        
        catenary = gh.components.Catenary(pt_0, pt_1, catenary_geuss, rg.Vector3d(0,0,-1))
        mid_pt = catenary.PointAtNormalizedLength(0.5)
        deflection = pt_0.Z - mid_pt.Z
    
    return catenary

def calcVel(pt1, pt2, catenary_len):
    
    extursion_vel = 9 # mm/s
    
    pt_0 = planes[i].Origin
    pt_1 = planes[i+1].Origin
    
    robot_distance = pt_0.DistanceTo(pt_1)
    robot_vel = robot_distance/catenary_len* extursion_vel
    
    return robot_vel

def genSegment(layer_cnt, target_deflection, plane_1, plane_2, first_section):
    ############################################################################
    # variables
    ############################################################################
    
    layer_thickness  = 1.8
    deflection_layer_thickness = 3
    robot_safe_vel = 10 #this is the robot velovity when it moves to the first plane (also for each new layer.)
    
    ############################################################################
    ############################################################################
    cat_vector = plane_2.Origin-plane_1.Origin  # offset vector for the catenary based on the planes possitions for each catenary instead of the world x cordinate. 
    cat_vector.Unitize()
    
    catenaries = []
    
    robot_planes = []
    
    robot_velocities = []
    

    for i in range (layer_cnt):
        temp_plane_1 = plane_1.Clone()
        temp_plane_1.Translate(rg.Vector3d(0,0,layer_thickness*i))
        
        temp_plane_1_1 = plane_1.Clone()
        temp_plane_1_1.Translate((rg.Vector3d(0,0,layer_thickness*i)+cat_vector*i))
        
        temp_line_1 = rg.NurbsCurve.Create(False, 1, [temp_plane_1.Origin, temp_plane_1_1.Origin])
        
        temp_plane_2 = plane_2.Clone()
        temp_plane_2.Translate(rg.Vector3d(0,0,layer_thickness*i))
        
        temp_plane_2_1 = plane_2.Clone()
        temp_plane_2_1.Translate((rg.Vector3d(0,0,layer_thickness*i)-cat_vector*i))
        
        temp_line_2 = rg.NurbsCurve.Create(False, 1, [temp_plane_2.Origin, temp_plane_2_1.Origin])
        
        catenary = generateCatenary(temp_plane_1_1, temp_plane_2_1, target_deflection- (i*deflection_layer_thickness))
        
        test = rg.Curve.JoinCurves([temp_line_1, catenary, temp_line_2])
        
        crv = test[0]
        
        catenaries.append(crv) 
        
        path_length = crv.GetLength()
        
        robot_v = calcVel(temp_plane_1.Origin, temp_plane_2.Origin, path_length)
        
        if first_section:
            robot_velocities.append(robot_safe_vel)
            robot_planes.append(temp_plane_1)
        
        else:
            robot_velocities.append(robot_v)
            robot_planes.append(temp_plane_2)
            
        
    return catenaries, robot_planes, robot_velocities
    
################################################################################
# GEnerates the the robotic way planes, robotiv velocity based on the catenary and 
################################################################################

layer_cnt = 10

nested_catenaries = []
nested_robot_planes = []
nested_robot_vel= []



for i in range(len(planes)-1):
    if i == 0:
        ### Adds the entry way_plane for the robot, a safe speed and 0 catenary. the safe speed and all other varables are set in genSegment
        
        first_section = True
        seg_catenaries, seg_robot_planes, seg_robot_vel = genSegment(layer_cnt, target_deflection, planes[i], planes[i+1], first_section) # target deflection could be a list of different targets
        nested_robot_planes.append(seg_robot_planes)
        nested_catenaries.append(seg_catenaries)
        nested_robot_vel.append(seg_robot_vel)
        
        ### Adds for the first segment the second way_plane, calculated speed and catenary. 
        
        first_section = False
        seg_catenaries, seg_robot_planes, seg_robot_vel = genSegment(layer_cnt, target_deflection, planes[i], planes[i+1], first_section)
        nested_robot_planes.append(seg_robot_planes)
        nested_catenaries.append(seg_catenaries)
        nested_robot_vel.append(seg_robot_vel)
        
    else:
        ### Segment from the previous way_plane to the second way_plane, calculated speed and catenary. 
        first_section = False
        seg_catenaries, seg_robot_planes, seg_robot_vel = genSegment(layer_cnt, target_deflection, planes[i], planes[i+1], first_section)
        
        nested_robot_planes.append(seg_robot_planes)
        nested_catenaries.append(seg_catenaries)
        nested_robot_vel.append(seg_robot_vel)
        
    

################################################################################
# order is changed from segment by segment to layer based
################################################################################

layered_catenaries = []
layered_robot_planes = []
layered_robot_vel= []

for i in range (len(nested_robot_planes[0])):
    layer_c = []
    layer_r_p = []
    layer_r_v = []
    
    for j in range(len(nested_robot_planes)):
        layer_c.append(nested_catenaries[j][i])
        layer_r_p.append(nested_robot_planes[j][i])
        layer_r_v.append(nested_robot_vel[j][i])
        
    layered_catenaries.append(layer_c)
    layered_robot_planes.append(layer_r_p)
    layered_robot_vel.append(layer_r_v)

layered_catenaries = gh.treehelpers.list_to_tree(layered_catenaries)
layered_robot_planes = gh.treehelpers.list_to_tree(layered_robot_planes)
layered_robot_vel = gh.treehelpers.list_to_tree(layered_robot_vel)
# ---------- end debug ----------
geo_2 = Geometry()
geo_3 = Geometry(debug.layered_catenaries)
geo_4 = Geometry(debug.layered_robot_planes)
panel = Panel(debug.layered_robot_vel)
panel_2 = Panel(debug.layered_robot_planes)
robotic_fabrication = GhPythonScript(robot_velocities=debug.layered_robot_vel, robot_planes=debug.layered_robot_planes)  # -> out, vel, way_planes; inputs robot_velocities: tree, robot_planes: tree
# ---------- robotic_fabrication: Python ----------
import Rhino.Geometry as rg
import ghpythonlib as gh


################################################################################
# This code flattens the threes into two lists. Should be easy to combine with the robotic fabrication code from before. 
################################################################################

robot_velocities = gh.treehelpers.tree_to_list(robot_velocities)
robot_planes = gh.treehelpers.tree_to_list(robot_planes)


way_planes = []
vel = []

for v_layer, p_layer in zip(robot_velocities, robot_planes):
    way_planes.extend(p_layer)
    vel.extend(v_layer)
# ---------- end robotic_fabrication ----------
geo_5 = Geometry(robotic_fabrication.way_planes)
panel_3 = Panel(robotic_fabrication.vel)
