# Grasshopper definition ATTRACTOR_INFILL_SOLVED.ghx (Grasshopper 1.0.7)

# ---- group: MULTIPLE ATTRACTORS
number_slider = Slider(20, range=0..100)
neg = Negative(Value=number_slider)
dom = ConstructDomain(DomainStart=neg, DomainEnd=number_slider)
box = DomainBox(Base=PlaneXY(0, 0, 0), X=dom, Y=dom, Z=dom)
pop3d = Populate3D(Region=box, Count=Slider(3, range=0..10), Seed=1)
pl = PlaneNormal(Origin=pop3d, ZAxis=pop3d)

# ----
dom_2 = ConstructDomain(DomainStart=Slider(0, range=0..100), DomainEnd=Slider(15, range=0..100))
dom_3 = ConstructDomain(DomainStart=Slider(2, range=-5..5), DomainEnd=Slider(1, range=-5..5))

# ---- group: ATTRACTORS
pt = ConstructPoint(XCoordinate=0, YCoordinate=0, ZCoordinate=0)
yz = YZPlane(Origin=Point(0, 0, 0))

# ---- group: TPMS ATTRACTOR
python = GhPythonScript(i=Slider(1, range=0..3), w=Slider(8, range=0..10), aObj=pl, dist=dom_2, targ=dom_3)  # -> out, d; inputs i: Int32, aObj: list of Point3d
# ---------- python: Python ----------
import math
import Rhino.Geometry as rg

def remap(val, min, max, minOut, maxOut):
    if val > max:
        val = max
    elif val < min:
        val = min
    span = max-min
    spanOut = maxOut - minOut
    thrust = (val-min)/abs(span)
    
    return minOut + (thrust*spanOut)

class Attractor(object):
    """
    this is the attractor class
    """
    def __init__(self,obj,dist,targ):
        self.obj = obj
        self.dist = dist
        self.targ = targ
    
    def getFactor(self,x,y,z):
        f = 1
        newPt = rg.Point3d(x,y,z)
        if type(self.obj) is list:
            distances = []
            factors = []
            for o in self.obj:
                if type(o) is rg.Point3d:
                    d = rg.Point3d.DistanceTo(o, newPt)
                    distances.append(d)
                    f = remap(d, self.dist[0], self.dist[1], self.targ[0], self.targ[1])
                    factors.append(f)
                elif type(o) is rg.Plane:
                    projectedPt = rg.Plane.ClosestPoint(o, newPt)
                    d = rg.Point3d.DistanceTo(projectedPt, newPt)
                    distances.append(d)
                    f = remap(d, self.dist[0], self.dist[1], self.targ[0], self.targ[1])
                    factors.append(f)
            
            m = min(distances)
            for d,newf in zip(distances, factors):
                if d == m:
                    f = newf
        else:
            if type(self.obj) is rg.Point3d:
                d = rg.Point3d.DistanceTo(self.obj, newPt)
                f = remap(d, self.dist[0], self.dist[1], self.targ[0], self.targ[1])
            elif type(self.obj) is rg.Plane:
                projectedPt = rg.Plane.ClosestPoint(self.obj, newPt)
                d = rg.Point3d.DistanceTo(projectedPt, newPt)
                f = remap(d, self.dist[0], self.dist[1], self.targ[0], self.targ[1])
        
        return f

class TPMS(object):
    def __init__(self, aObj, dist, targ, w=10.0):
        self.wl = w
        self.fact = self.wl/(math.pi)
        self.attractor = Attractor(aObj, dist, targ)
        self.dist = dist
        self.targ = targ
    
    def get_distance(self,x,y,z):
        f = self.attractor.getFactor(x,y,z)
#        px = (x*f)/self.fact
#        py = (y*f)/self.fact
#        pz = (z*f)/self.fact
        px = x/f
        py = y/f
        pz = z/self.fact
        return self.get_value(px,py,pz,f)

    def get_value(self,x,y,z):
        return 0

class Gyroid(TPMS):
    def get_value(self,px,py,pz,f):
#        return math.sin(px)*math.cos(py) + math.sin(py)*math.cos(pz) + math.sin(pz)*math.cos(px) + f
        return math.sin(px)*math.cos(py) + math.sin(py)*math.cos(pz) + math.sin(pz)*math.cos(px)

class SchwartzP(TPMS):
    def get_value(self,px,py,pz,f):
#        return math.cos(px)+math.cos(py)+math.cos(pz) + f
        return math.cos(px) + math.cos(py) + math.cos(pz)

class Diamond(TPMS):
    def get_value(self,px,py,pz,f):
        return (
            math.sin(px) * math.sin(py) * math.sin(pz) +
            math.sin(px) * math.cos(py) * math.cos(pz) +
            math.cos(px) * math.sin(py) * math.cos(pz) +
            math.cos(px) * math.cos(py) * math.sin(pz))

class FischerKoch(TPMS):
    def get_value(self,px,py,pz,f):
        return (
            math.cos(2*px) * math.sin(py) * math.cos(pz) +
            math.cos(2*py) * math.sin(pz) * math.cos(px) +
            math.cos(2*pz) * math.sin(px) * math.cos(py))

if __name__=="__main__":
    if i is None:
        i = 0
    if i>3 or i<0:
        i = 0
    if w is None:
        w = 10.0
    if dist is None:
        dist = rg.Interval(0,5)
    if targ is None:
        targ = rg.Interval(o,1)
    if aObj is not None:
        tpms = [
            Gyroid(aObj, dist, targ, w),
            SchwartzP(aObj, dist, targ, w),
            Diamond(aObj, dist, targ, w),
            FischerKoch(aObj, dist, targ, w)]
        d = tpms[i]
# ---------- end python ----------

# ---- group: OCTREE
python_2 = GhPythonScript(x=python.d, d=Slider(40, range=0..100), n=Slider(5, range=0..10))  # -> out, t, layerHeight; inputs p: Point3d, n: Int32
#   port x: the sdf object used for distance calculation
# ---------- python_2: Python ----------
import Rhino.Geometry as rg
import math

class OcTree(object):
    """
    sparse voxel octree (SVO) class for adaptive subdivision
    """
    def __init__(self, pt, ws):
        self.worldsize = float(ws)
        self.maxlevels = 3
        self.sqrt2 = math.sqrt(2.0)
        self.sqrt3 = math.sqrt(3.0)
        self.pos = pt
        self.rootnode = OctNode(pt.X,pt.Y,pt.Z, ws, 0)
        self.distobj = None
        self.leafs = []

    def set_level(self, n):
        self.maxlevels = int(n)

    def divide(self, node):
        if node.level < self.maxlevels:
            d = self.distobj.get_distance(node.pos.X, node.pos.Y, node.pos.Z)
            node.distance = d
            if abs(d) < self.sqrt2 * node.edge/1.5:
                node.divide_node()
                for b in node.branches:
                    self.divide(b)
        else:
            self.leafs.append(node)

class OctNode(object):
    """
    node of octree that is either leaf node
    or has 8 child nodes as branches
    """
    def __init__(self, x,y,z, s, l):
        self.pos = rg.Vector3f(x,y,z)
        self.edge = s
        self.level = l
        self.branches = None
        self.distance = 0.0

    def divide_node(self):
        self.branches = []
        qs = self.edge/4.0
        nl = self.level + 1
        self.branches.append(OctNode(self.pos.X-qs, self.pos.Y-qs, self.pos.Z-qs, qs*2, nl))
        self.branches.append(OctNode(self.pos.X+qs, self.pos.Y-qs, self.pos.Z-qs, qs*2, nl))
        self.branches.append(OctNode(self.pos.X-qs, self.pos.Y+qs, self.pos.Z-qs, qs*2, nl))
        self.branches.append(OctNode(self.pos.X+qs, self.pos.Y+qs, self.pos.Z-qs, qs*2, nl))
        self.branches.append(OctNode(self.pos.X-qs, self.pos.Y-qs, self.pos.Z+qs, qs*2, nl))
        self.branches.append(OctNode(self.pos.X+qs, self.pos.Y-qs, self.pos.Z+qs, qs*2, nl))
        self.branches.append(OctNode(self.pos.X-qs, self.pos.Y+qs, self.pos.Z+qs, qs*2, nl))
        self.branches.append(OctNode(self.pos.X+qs, self.pos.Y+qs, self.pos.Z+qs, qs*2, nl))

if __name__=="__main__":
    if x is not None:
        if p is None:
            p = rg.Point3f(0,0,0)
        if d is None:
            d = 6.0
        if n is None:
            n = 4
        
        t = OcTree(p,d)
        t.distobj = x
        t.set_level(n)
        t.divide(t.rootnode)
        
        layerHeight = d
        for i in range(n):
            layerHeight = layerHeight * .5
# ---------- end python_2 ----------

# ----
layer_height = Panel(python_2.layerHeight)

# ---- group: MARCHING SQUARES
python_3 = GhPythonScript(ot=python_2.t, tolerance=layer_height)  # -> out, simplify(curves_layers)
# ---------- python_3: Python ----------
import Rhino.Geometry as rg
import ghpythonlib.treehelpers as th

def make_square(vals, x1, y1, z, el, iso):
    x2 = x1 + el
    y2 = y1 + el
    casenumber = 0
    for i in range(3,-1,-1):
        if vals[i] > iso:
            casenumber += 1
        if i > 0:
            casenumber = casenumber << 1
    
    vertices = []
    offset = casenumber * 4
    for i in range(offset, offset+4):
        index = edge_table[i]
        if index > -1:
            p = None
            if index==0:
                p = rg.Point3d(x1 + v(vals[0], vals[1], iso) * el, y1, z)
            elif index==1:
                p = rg.Point3d(x2, y1 + v(vals[1], vals[2], iso) * el, z)
            elif index==2:
                p = rg.Point3d(x1 + v(vals[3], vals[2], iso) * el, y2, z)
            elif index==3:
                p = rg.Point3d(x1, y1 + v(vals[0], vals[3], iso) * el, z)
            vertices.append(p)
    
    lines = []
    for i in range(0,len(vertices),2):
        l = rg.LineCurve(vertices[i], vertices[i+1])
        lines.append(l)
    
    return lines, el

edge_table = [
-1, -1, -1, -1, 0, 3, -1, -1, 1, 0, -1, -1, 1, 3, -1, -1, 2,
1, -1, -1, 0, 3, 2, 1, 2, 0, -1, -1, 2, 3, -1, -1, 3, 2, -1,
-1, 0, 2, -1, -1, 1, 0, 3, 2, 1, 2, -1, -1, 3, 1, -1, -1, 0,
1, -1, -1, 3, 0, -1, -1, -1, -1, -1, -1]

def v(v1, v2, iso):
    if abs(v2-v1) < 0.000001:
        return 0
    
    return (iso - v1) / (v2 - v1)

def dispatchByHeight(c, lh, cl):
    c = c.ToNurbsCurve()
    p = c.PointAtNormalizedLength(0)
    for i,h in enumerate(lh):
        if p.Z == h:
            cl[i].append(c)

if __name__=='__main__':
    if not ot is None:
        curves = []
        layer_heights = []
        
        for l in ot.leafs:
            e = l.edge
            dv = []
            x = l.pos.X
            y = l.pos.Y
            z = l.pos.Z
            if not z in layer_heights:
                layer_heights.append(z)
            dv.append(ot.distobj.get_distance(x-e/2,y-e/2,z))
            dv.append(ot.distobj.get_distance(x+e/2,y-e/2,z))
            dv.append(ot.distobj.get_distance(x+e/2,y+e/2,z))
            dv.append(ot.distobj.get_distance(x-e/2,y+e/2,z))
            lines,diam = make_square(dv,x-e/2,y-e/2,z,e,0)
            curves.extend(lines)
        curves = rg.Curve.JoinCurves(curves)
        
        layer_heights = list(set(layer_heights))
        layer_heights.sort()
        curves_layers = [[] for i in range(len(layer_heights))]
        
        for i,curve in enumerate(curves):
            if not curve.IsClosed:
                if not len(rg.PolylineCurve.DuplicateSegments(curve)) <= 2:
                    startPt =rg.Curve.PointAtNormalizedLength(curve,0)
                    endPt = rg.Curve.PointAtNormalizedLength(curve,1)
                    if endPt.DistanceTo(startPt) <= tolerance:
                        pts = []
                        segments = curve.DuplicateSegments()
                        for segment in segments:
                            pts.append(segment.PointAtNormalizedLength(0))
                            pts.append(segment.PointAtNormalizedLength(1))
                        pts.append(endPt)
                        pts.append(startPt)
                        nCrv = rg.Polyline(pts)
                        dispatchByHeight(nCrv, layer_heights, curves_layers)
                    else:
                        dispatchByHeight(curve, layer_heights, curves_layers)
                else:
                    dispatchByHeight(curve, layer_heights, curves_layers)
            else:
                dispatchByHeight(curve, layer_heights, curves_layers)
        curves_layers = th.list_to_tree(curves_layers)
# ---------- end python_3 ----------
