# Grasshopper definition AXOLOTL_INFILL.ghx (Grasshopper 1.0.7)
# plug-ins: Axolotl Info

# ---- group: VARIABLES
objectradius = Slider(3.8, range=0..10)
objectheight = Slider(10, range=0..10)
layerheight = Slider(0.1, range=0..1)

# ----
addition = Addition(A=layerheight, B=objectradius)
merge = Merge(Data1=addition, Data2=objectradius)  # -> graft(Result)
division = Division(A=objectheight, B="2")
pt = ConstructPoint(XCoordinate=0, YCoordinate=0, ZCoordinate=division)
xy = XYPlane(Origin=pt)
division_2 = Division(A=layerheight, B="2")
division_3 = Division(A=objectheight, B=layerheight)

# ---- group: CSG
tpms = TPMS(Wavelength=Slider(1.6, range=0..10))
polygonextrusion = PolygonExtrusion(Radius=merge, SecondRadius=-1, Height=objectheight, Number=6, Plane=xy)
item = ListItem(List=flatten(polygonextrusion), Index=0, Wrap=True)  # -> Item, Item1
boolean_intersect = BooleanIntersect(DistanceObjectS=item.Item1, DistanceObject=tpms)
boolean_subtract = BooleanSubtract(DistanceObject=item.Item, DistanceObject_2=item.Item1)
boolean_union = BooleanUnion(DistanceObjectS=boolean_subtract, DistanceObject=boolean_intersect)

# ---- group: SLICING PLANES
series = Series(Start=division_2, Step=layerheight, Count=division_3)
pt_2 = ConstructPoint(XCoordinate=0, YCoordinate=0, ZCoordinate=series)
xy_2 = XYPlane(Origin=pt_2)

# ---- group: GENERATE CURVES
resolution = Slider(300, range=0..350)
slice2d = Slice2D(DistanceObject=boolean_union, NumberU=resolution, NumberV=resolution, DimensionX=10, DimensionY=10, Plane=xy_2)  # -> Values, Mesh, simplify(Contours)

# ---- group: CURVES CLEANING
explode = Explode(Curve=slice2d.Contours, Recursive=True)  # -> Segments, Vertices
cullpt = CullDuplicates(Points=explode.Vertices, Tolerance=layerheight, CullMode=3)  # -> Points, Indices, Valence
lng = ListLength(List=cullpt.Points)
equals = Equality(FirstNumber=lng, SecondNumber="1")  # -> Equality, Inequality
dispatch = Dispatch(List=cullpt.Points, DispatchPattern=equals.Equality)  # -> ListA, ListB
clean = CleanTree(RemoveNulls=True, RemoveInvalid=True, RemoveEmpty=True, Tree=dispatch.ListB)  # -> simplify(Tree)

# ---- group: REPEAT FIRST VERTEX
item_2 = ListItem(List=clean, Index=0, Wrap=True)
ins = InsertItems(List=clean, Item=item_2, Indices="-1", Wrap=True)  # -> simplify(List)

# ---- group: IO TRIGGER
lng_2 = ListLength(List=ins)
repeat = RepeatData(Data="True", Length=lng_2)
replace = ReplaceItems(List=repeat, Item="False", Indices="0", Wrap=False)  # -> flatten(List)

# ----
pline = PolyLine(Vertices=ins, Closed=False)
preview = CustomPreview(Geometry=pline, Material=ColourSwatch(SwatchColor=RGB(255, 255, 255)))

# ---- group: POINTS
pt_3 = Point(flatten(ins))
