# Grasshopper definition TOP_DOWN_GH_SLICER_SOLVED.ghx (Grasshopper 1.0.7)

# ---- group: LAYER HEIGHT
number_slider = Slider(3, range=0..10)

num = Number(number_slider)

# ----
number_slider_2 = Slider(50, range=0..100)
div_pt_count = Slider(60, range=0..60)
layer_height = Slider(10, range=0..10)
layer_count = Slider(30, range=0..100)
division = Division(A=number_slider, B="2")
series = Series(Start=0, Step=layer_height, Count=layer_count)
pt = ConstructPoint(XCoordinate=number_slider_2, YCoordinate=number_slider_2, ZCoordinate=division)
Z = UnitZ(Factor=series)
cir = Circle(Plane=pt, Radius=Slider(100, range=0..100))
move = Move(Geometry=cir, Motion=Z)  # -> Geometry, Transform
divide = DivideCurve(Curve=move.Geometry, Count=div_pt_count, Kinks=False)  # -> Points, Tangents, Parameters
area = Area(Geometry=move.Geometry)  # -> Area, graft(Centroid)

# ---- group: OVERALL SHAPE
radians = Slider(0, range=0..2)
pi = Pi(Factor=radians)
division_2 = Division(A=pi, B=layer_count)
series_2 = Series(Start=0, Step=division_2, Count=layer_count)
rotate = Rotate(Geometry=divide.Points, Angle=graft(series_2), Plane=area.Centroid)  # -> Geometry, Transform
dom = ConstructDomain(DomainStart=Slider(0.1, range=0..1), DomainEnd=1)
range = Range(Domain=dom, Steps=expr("x-1", layer_count))
graph = GraphMapper(
    range,
    x0=0,
    x1=1,
    y0=0,
    y1=1,
    amplitude=0.1434600353,
    container_name="Perlin",
    decay=0.4409280419,
    frequency=0.1,
    x_offset=0.5,
    y_offset=0.5)
dom_2 = ConstructDomain(DomainStart=0, DomainEnd=Slider(1.6, range=0..10))
remap = RemapNumbers(Value=graph, Source=Domain(0, 1), Target=dom_2)  # -> Mapped, Clipped
scale = Scale(Geometry=rotate.Geometry, Center=area.Centroid, Factor=graft(remap.Mapped))  # -> Geometry, Transform

# ---- group: SKIN
construct_domain = ConstructDomain(DomainStart=Slider(0, range=-10..0), DomainEnd=Slider(5.4, range=0..10))
lng = ListLength(List=flatten(scale.Geometry))
random = Random(Range=construct_domain, Number=lng, Seed=Slider(36, range=0..100))
vec2pt = Vector2Pt(PointA=area.Centroid, PointB=scale.Geometry, Unitize=False)  # -> Vector, Length
partition = PartitionList(List=random, Size=div_pt_count)
unit = UnitVector(Vector=vec2pt.Vector)
multiplication = Multiplication(A=partition, B=unit)

# ----
move_2 = Move(Geometry=scale.Geometry, Motion=multiplication)  # -> Geometry, Transform
intcrv = Interpolate(Vertices=move_2.Geometry, Degree=3, Periodic=True, KnotStyle=1)  # -> Curve, Length, Domain
loft = Loft(
    Curves=flatten(intcrv.Curve),
    Options={Adjust=False, Closed=False, LoftEnds=0, LoftSimp=0, LoftType=0, Rebuild=10, Refit=0.01})
cap = CapHoles(Brep=loft)

preview = CustomPreview(Geometry=cap, Material=ColourSwatch(SwatchColor=RGBA(255, 41, 41, 123)))

# ---- group: BASE POINT
pt_2 = Point(pt)

# ---- group: IMPORT ANY CLOSED GEOMETRY
brep = Brep(cap)

# ---- group: SAFE PLANE
item = ListItem(List=flatten(area.Centroid), Index="-1", Wrap=True)
pdecon = Deconstruct(Point=item)  # -> XComponent, YComponent, ZComponent
addition = Addition(A=pdecon.ZComponent, B=Slider(40, range=0..100))
pt_3 = ConstructPoint(XCoordinate=pdecon.XComponent, YCoordinate=pdecon.YComponent, ZCoordinate=addition)

# ---- group: SLICE YOUR OBJECT
xy = XYPlane(Origin=pt_2)
contour = Contour(Shape=brep, Point=xy, Direction=Vector(0, 0, 1), Distance=num)

# ---- group: SHIFT SEAM
lng_2 = ListLength(List=flatten(contour))
divide_2 = DivideCurve(Curve=contour, Count=Slider(60, range=0..100), Kinks=False)  # -> Points, Tangents, Parameters
series_3 = Series(Start=0, Step=1, Count=lng_2)
shift = ShiftList(List=divide_2.Points, Shift=graft(series_3), Wrap=True)  # -> simplify(List)
filter = StreamFilter(Gate=Toggle(True), Stream0=divide_2.Points, Stream1=shift)

# ---- group: BED SUPPORT
branch = TreeBranch(Tree=simplify(divide_2.Points), Path="0", MaintainPaths=True)
pline = PolyLine(Vertices=branch, Closed=True)
series_4 = Series(Start=num, Step=num, Count=Slider(10, range=0..10))
rev = ReverseList(List=series_4)
offset = OffsetCurve(Curve=pline, Distance=rev, Plane=PlaneXY(0, 0, 0), Corners=1)
explode = Explode(Curve=offset, Recursive=True)  # -> Segments, Vertices

# ---- group: COMBINE SUPPORT AND OBJECT
ins = InsertItems(List=flatten(filter), Item=flatten(explode.Vertices), Indices="0", Wrap=True)
pline_2 = PolyLine(Vertices=flatten(ins), Closed=False)

# ----
explode_2 = Explode(Curve=pline_2, Recursive=True)  # -> Segments, Vertices

# ---- group: PARTITION PLANES
partition_2 = PartitionList(List=explode_2.Vertices, Size=Slider(1000, range=0..1000))
branch_2 = TreeBranch(Tree=simplify(partition_2), Path=Slider(0, range=0..6), MaintainPaths=True)

# ----
preview_2 = CustomPreview(Geometry=pline_2, Material=ColourSwatch(SwatchColor=RGB(255, 255, 255)))

# ---- group: INSERT SAFE PLANE
panel = Panel("""0
-1""")
ins_2 = InsertItems(List=branch_2, Item=pt_3, Indices=panel, Wrap=True)

# ---- group: IO TRIGGER
lng_3 = ListLength(List=branch_2)
repeat = RepeatData(Data="True", Length=lng_3)
ins_3 = InsertItems(List=repeat, Item="False", Indices=panel, Wrap=True)
panel_2 = Panel(ins_3)

# ---- group: PREVISUALIZATION
pline_3 = PolyLine(Vertices=ins_2, Closed=False)
xy_2 = XYPlane(Origin=ins_2)

# ----
preview_3 = CustomPreview(Geometry=pline_3, Material=ColourSwatch(SwatchColor=RGB(255, 255, 255)))
