# Grasshopper definition TOP_DOWN_GH_SLICER_SOLVED_PA.gh (Grasshopper 1.0.7)

# ---- group: LAYER HEIGHT
number_slider = Slider(3, range=0..10)

# ----
geo = Geometry(<brep referenced from the Rhino model>)  # disabled

# ---- group: LAYER HEIGHT
num = Number(number_slider)

# ----
contour = GhPythonScript()  # -> Out, A; disabled
number_slider_2 = Slider(60, range=0..100)  # disabled
swatch = ColourSwatch(SwatchColor=RGB(255, 255, 255))  # disabled
swatch_2 = ColourSwatch(SwatchColor=RGB(255, 255, 255))  # disabled

number_slider_3 = Slider(50, range=0..100)
div_pt_count = Slider(60, range=0..60)
layer_height = Slider(10, range=0..10)
layer_count = Slider(30, range=0..100)
division = Division(A=number_slider, B="2")
series = Series(Start=0, Step=layer_height, Count=layer_count)
pt = ConstructPoint(XCoordinate=number_slider_3, YCoordinate=number_slider_3, ZCoordinate=division)
Z = UnitZ(Factor=series)
cir = Circle(Plane=pt, Radius=Slider(100, range=0..100))
move = Move(Geometry=cir, Motion=Z)  # -> Geometry, Transform
divide = DivideCurve(Curve=move.Geometry, Count=div_pt_count, Kinks=False)  # -> Points, Tangents, Parameters
area = Area(Geometry=move.Geometry)  # -> Area, graft(Centroid)

# ---- group: OVERALL SHAPE
radians = Slider(0, range=0..2)
pi = Pi(Factor=radians)
division_2 = Division(A=pi, B=layer_count)
series_2 = Series(Start=0, Step=division_2, Count=layer_count)
dom = ConstructDomain(DomainStart=Slider(0.1, range=0..1), DomainEnd=1)
rotate = Rotate(Geometry=divide.Points, Angle=graft(series_2), Plane=area.Centroid)  # -> Geometry, Transform
range = Range(Domain=dom, Steps=expr("x-1", layer_count))
graph = GraphMapper(
    range,
    x0=0,
    x1=1,
    y0=0,
    y1=1,
    amplitude=0.1434600353,
    container_name="Perlin",
    decay=0.4409280419,
    frequency=0.1,
    x_offset=0.5,
    y_offset=0.5)
dom_2 = ConstructDomain(DomainStart=0, DomainEnd=Slider(1.6, range=0..10))
remap = RemapNumbers(Value=graph, Source=Domain(0, 1), Target=dom_2)  # -> Mapped, Clipped
scale = Scale(Geometry=rotate.Geometry, Center=area.Centroid, Factor=graft(remap.Mapped))  # -> Geometry, Transform

# ---- group: SKIN
construct_domain = ConstructDomain(DomainStart=Slider(0, range=-10..0), DomainEnd=Slider(5.4, range=0..10))
lng = ListLength(List=flatten(scale.Geometry))
random = Random(Range=construct_domain, Number=lng, Seed=Slider(36, range=0..100))
vec2pt = Vector2Pt(PointA=area.Centroid, PointB=scale.Geometry, Unitize=False)  # -> Vector, Length
partition = PartitionList(List=random, Size=div_pt_count)
unit = UnitVector(Vector=vec2pt.Vector)
multiplication = Multiplication(A=partition, B=unit)

# ----
move_2 = Move(Geometry=scale.Geometry, Motion=multiplication)  # -> Geometry, Transform
intcrv = Interpolate(Vertices=move_2.Geometry, Degree=3, Periodic=True, KnotStyle=1)  # -> Curve, Length, Domain
loft = Loft(
    Curves=flatten(intcrv.Curve),
    Options={Adjust=False, Closed=False, LoftEnds=0, LoftSimp=0, LoftType=0, Rebuild=10, Refit=0.01})
cap = CapHoles(Brep=loft)

preview = CustomPreview(Geometry=cap, Material=ColourSwatch(SwatchColor=RGBA(255, 41, 41, 123)))

# ---- group: BASE POINT
pt_2 = Point(pt)

# ---- group: IMPORT ANY CLOSED GEOMETRY
brep = Brep(cap)

# ----
python = GhPythonScript(brep=brep)  # -> out, graft(intersection_curves), pts; inputs brep: Brep; disabled
# ---------- python: Python ----------
import Rhino.Geometry as rg
import ghpythonlib.treehelpers as ght


def slice(brep, layer_thickness):
    ##First get the min_z, max_z and height
    
    brep_bounding_box = brep.GetBoundingBox(rg.Plane.WorldXY)

    max_x, max_y, max_z = brep_bounding_box.Max
    min_x, min_y, min_z = brep_bounding_box.Min
    
    brep_height = max_z - min_z
    
    ### Intersect brep with a series of planes 
    
    intersection_curves = []
    
    height = min_z
    
    for i in range (1000):
        height += layer_thickness
        if height < max_z:
            intersection_plane = rg.Plane(rg.Point3d(0,0, height), rg.Vector3d.XAxis, rg.Vector3d.YAxis)
            intersection_events = rg.Intersect.Intersection.BrepPlane(brep, intersection_plane, 1)
            
            if intersection_events[0]:
                
                for crv in intersection_events[1]:
                    intersection_curves.append(crv)
            else:
                print "brep and plane are not interecting! You are doing something wrong!"
        else:
            break
    return intersection_curves


intersection_curves = slice(brep,10)

pts =  []

for crv in intersection_curves:
    
    params = crv.DivideByCount(20, True)
    layer_pts = []
    for p in params:
        pt = crv.PointAt(p)
        layer_pts.append(pt)
    pts.append(layer_pts)
# ---------- end python ----------
python_2 = GhPythonScript(brep=brep)  # -> out, graft(intersection_curves), pts; inputs brep: Brep, list: list
# ---------- python_2: Python ----------
import Rhino.Geometry as rg
import ghpythonlib.treehelpers as ght


def slice(brep, layer_thickness):
    ##First get the min_z, max_z and height
    
    brep_bounding_box = brep.GetBoundingBox(rg.Plane.WorldXY)

    max_x, max_y, max_z = brep_bounding_box.Max
    min_x, min_y, min_z = brep_bounding_box.Min
    
    brep_height = max_z - min_z
    
    ### Intersect brep with a series of planes 
    
    intersection_curves = []
    
    height = min_z
    
    for i in range (1000):
        height += layer_thickness
        if height < max_z:
            intersection_plane = rg.Plane(rg.Point3d(0,0, height), rg.Vector3d.XAxis, rg.Vector3d.YAxis)
            intersection_events = rg.Intersect.Intersection.BrepPlane(brep, intersection_plane, 1)
            
            if intersection_events[0]:
                
                for crv in intersection_events[1]:
                    intersection_curves.append(crv)
            else:
                print "brep and plane are not interecting! You are doing something wrong!"
        else:
            break
    return intersection_curves


intersection_curves = slice(brep,10)

pts =  []


for crv in intersection_curves:
    orientation = crv.ClosedCurveOrientation()
    if (orientation == rg.CurveOrientation.CounterClockwise):
        crv.Reverse()
    
    params = crv.DivideByCount(20, True)
    layer_pts = []
    
    
    for p in params:
        pt = crv.PointAt(p)
        layer_pts.append(pt)
        
    pts.append(layer_pts)
# ---------- end python_2 ----------
geo_2 = Geometry(python.intersection_curves)  # disabled
geo_3 = Geometry(python_2.intersection_curves)
python_3 = GhPythonScript(pts=python.pts)  # -> out, first_pts; inputs pts: list; disabled
# ---------- python_3: Python ----------
import Rhino.Geometry as rg

first_pts = []
cnt = 0
for layer in pts:
    new_layer = layer[cnt:]+layer[:cnt]
    first_pts.append(new_layer[0])
    cnt +=1
    if cnt >len(layer):
       cnt-= len(layer)
# ---------- end python_3 ----------
python_4 = GhPythonScript(pts=python_2.pts)  # -> out, first_pts; inputs pts: list
# ---------- python_4: Python ----------
import Rhino.Geometry as rg

first_pts = []

for i,layer in enumerate (pts):
    k = i % len(layer)
    new_layer = layer[k:]+layer[:k]
    first_pts.append(new_layer[0])
# ---------- end python_4 ----------

# ---- group: SAFE PLANE
panel = Panel("-1")  # disabled
item = ListItem(List=flatten(area.Centroid), Index=panel, Wrap=True)  # disabled
number_slider_4 = Slider(40, range=0..100)  # disabled
pdecon = Deconstruct(Point=item)  # -> XComponent, YComponent, ZComponent; disabled
addition = Addition(A=pdecon.ZComponent, B=number_slider_4)  # disabled
pt_3 = ConstructPoint(XCoordinate=pdecon.XComponent, YCoordinate=pdecon.YComponent, ZCoordinate=addition)  # disabled

# ----
geo_4 = Geometry(python_4.first_pts)

# ---- group: SLICE YOUR OBJECT
xy = XYPlane(Origin=pt_2)  # disabled
contour_2 = Contour(Shape=brep, Point=xy, Direction=Vector(0, 0, 1), Distance=num)  # disabled

# ---- group: SHIFT SEAM
lng_2 = ListLength(List=flatten(contour_2))  # disabled
divide_2 = DivideCurve(Curve=contour_2, Count=number_slider_2, Kinks=False)  # -> Points, Tangents, Parameters; disabled
series_3 = Series(Start=0, Step=1, Count=lng_2)  # disabled
toggle = BooleanToggle(True)  # disabled
shift = ShiftList(List=divide_2.Points, Shift=graft(series_3), Wrap=True)  # -> simplify(List); disabled
filter = StreamFilter(Gate=toggle, Stream0=divide_2.Points, Stream1=shift)  # disabled

# ---- group: BED SUPPORT
panel_2 = Panel("0")  # disabled
branch = TreeBranch(Tree=simplify(divide_2.Points), Path=panel_2, MaintainPaths=True)  # disabled
number_slider_5 = Slider(10, range=0..10)  # disabled
pline = PolyLine(Vertices=branch, Closed=True)  # disabled
series_4 = Series(Start=num, Step=num, Count=number_slider_5)  # disabled
rev = ReverseList(List=series_4)  # disabled
offset = OffsetCurve(Curve=pline, Distance=rev, Plane=PlaneXY(0, 0, 0), Corners=1)  # disabled
explode = Explode(Curve=offset, Recursive=True)  # -> Segments, Vertices; disabled

# ---- group: COMBINE SUPPORT AND OBJECT
panel_3 = Panel("0")  # disabled
ins = InsertItems(List=flatten(filter), Item=flatten(explode.Vertices), Indices=panel_3, Wrap=True)  # disabled
pline_2 = PolyLine(Vertices=flatten(ins), Closed=False)  # disabled

# ----
explode_2 = Explode(Curve=pline_2, Recursive=True)  # -> Segments, Vertices; disabled

# ---- group: PARTITION PLANES
number_slider_6 = Slider(1000, range=0..1000)  # disabled
partition_2 = PartitionList(List=explode_2.Vertices, Size=number_slider_6)  # disabled
number_slider_7 = Slider(0, range=0..6)  # disabled
branch_2 = TreeBranch(Tree=simplify(partition_2), Path=number_slider_7, MaintainPaths=True)  # disabled

# ----
preview_2 = CustomPreview(Geometry=pline_2, Material=swatch)  # disabled

# ---- group: INSERT SAFE PLANE
panel_4 = Panel("""0
-1""")  # disabled
ins_2 = InsertItems(List=branch_2, Item=pt_3, Indices=panel_4, Wrap=True)  # disabled

# ---- group: IO TRIGGER
lng_3 = ListLength(List=branch_2)  # disabled
panel_5 = Panel("True")  # disabled
repeat = RepeatData(Data=panel_5, Length=lng_3)  # disabled
panel_6 = Panel("False")  # disabled
ins_3 = InsertItems(List=repeat, Item=panel_6, Indices=panel_4, Wrap=True)  # disabled
panel_7 = Panel(ins_3)  # disabled

# ---- group: PREVISUALIZATION
pline_3 = PolyLine(Vertices=ins_2, Closed=False)  # disabled
xy_2 = XYPlane(Origin=ins_2)  # disabled

# ----
preview_3 = CustomPreview(Geometry=pline_3, Material=swatch_2)  # disabled
