# Grasshopper definition TOP_DOWN_GH_SLICER_TODO.ghx (Grasshopper 1.0.7)

# ---- group: LAYER HEIGHT
number_slider = Slider(3, range=0..10)

num = Number(number_slider)

# ----
number_slider_2 = Slider(50, range=0..100)
div_pt_count = Slider(60, range=0..60)
layer_height = Slider(10, range=0..10)
layer_count = Slider(30, range=0..100)
division = Division(A=number_slider, B="2")
series = Series(Start=0, Step=layer_height, Count=layer_count)
pt = ConstructPoint(XCoordinate=number_slider_2, YCoordinate=number_slider_2, ZCoordinate=division)
Z = UnitZ(Factor=series)
cir = Circle(Plane=pt, Radius=Slider(100, range=0..100))
move = Move(Geometry=cir, Motion=Z)  # -> Geometry, Transform
divide = DivideCurve(Curve=move.Geometry, Count=div_pt_count, Kinks=False)  # -> Points, Tangents, Parameters
area = Area(Geometry=move.Geometry)  # -> Area, graft(Centroid)

# ---- group: OVERALL SHAPE
radians = Slider(0, range=0..2)
pi = Pi(Factor=radians)
division_2 = Division(A=pi, B=layer_count)
series_2 = Series(Start=0, Step=division_2, Count=layer_count)
rotate = Rotate(Geometry=divide.Points, Angle=graft(series_2), Plane=area.Centroid)  # -> Geometry, Transform
dom = ConstructDomain(DomainStart=Slider(0.1, range=0..1), DomainEnd=1)
range = Range(Domain=dom, Steps=expr("x-1", layer_count))
graph = GraphMapper(
    range,
    x0=0,
    x1=1,
    y0=0,
    y1=1,
    amplitude=0.1434600353,
    container_name="Perlin",
    decay=0.4409280419,
    frequency=0.1,
    x_offset=0.5,
    y_offset=0.5)
dom_2 = ConstructDomain(DomainStart=0, DomainEnd=Slider(1.6, range=0..10))
remap = RemapNumbers(Value=graph, Source=Domain(0, 1), Target=dom_2)  # -> Mapped, Clipped
scale = Scale(Geometry=rotate.Geometry, Center=area.Centroid, Factor=graft(remap.Mapped))  # -> Geometry, Transform

# ---- group: SKIN
construct_domain = ConstructDomain(DomainStart=Slider(0, range=-10..0), DomainEnd=Slider(5.4, range=0..10))
lng = ListLength(List=flatten(scale.Geometry))
random = Random(Range=construct_domain, Number=lng, Seed=Slider(36, range=0..100))
vec2pt = Vector2Pt(PointA=area.Centroid, PointB=scale.Geometry, Unitize=False)  # -> Vector, Length
partition = PartitionList(List=random, Size=div_pt_count)
unit = UnitVector(Vector=vec2pt.Vector)
multiplication = Multiplication(A=partition, B=unit)

# ----
move_2 = Move(Geometry=scale.Geometry, Motion=multiplication)  # -> Geometry, Transform
intcrv = Interpolate(Vertices=move_2.Geometry, Degree=3, Periodic=True, KnotStyle=1)  # -> Curve, Length, Domain
loft = Loft(
    Curves=flatten(intcrv.Curve),
    Options={Adjust=False, Closed=False, LoftEnds=0, LoftSimp=0, LoftType=0, Rebuild=10, Refit=0.01})
cap = CapHoles(Brep=loft)

# ---- group: SAFE PLANE
item = ListItem(List=flatten(area.Centroid), Index="-1", Wrap=True)
pdecon = Deconstruct(Point=item)  # -> XComponent, YComponent, ZComponent
addition = Addition(A=pdecon.ZComponent, B=Slider(40, range=0..100))
pt_2 = ConstructPoint(XCoordinate=pdecon.XComponent, YCoordinate=pdecon.YComponent, ZCoordinate=addition)

# ---- group: BASE POINT
pt_3 = Point(pt)

# ----
preview = CustomPreview(Geometry=cap, Material=ColourSwatch(SwatchColor=RGBA(255, 41, 41, 123)))
