# Grasshopper definition planar_slicing_URfabrication.gh (Grasshopper 1.0.7)

data_folder_name = Panel("C:\Users\apetrus\Documents\MAS-2122\09_GKR_T2\tutorials\01_compas_slicer\01_planar_slicing\data\output")

# ----
# Output
# Input
py = PythonScript()  # -> path
# ---------- py: Python ----------
import sys
import os

ghComp = ghenv.Component
ghDoc = ghComp.OnPingDocument()

# the full path of the gh file
path = ghDoc.FilePath
# the current directory 
path = os.path.abspath(os.path.join(path, ".."))

print path
# ---------- end py ----------

# ---- group: Folder name
data = Data(data_folder_name)

# ----
# Load Printpoints
panel = Panel("out_printpoints_nested.json")
load_frames = BooleanToggle(False)
load_layer_heights = BooleanToggle(False)
load_up_vectors = BooleanToggle(False)
load_normals = BooleanToggle(False)
load_closest_support_pt = BooleanToggle(False)
load_velocities = BooleanToggle(True)
load_wait_times = BooleanToggle(False)
load_blend_radiuses = BooleanToggle(False)
load_extruder_toggles = BooleanToggle(True)
csloadprintpoints = CsLoadPrintpoints(
    recompute=Button(),
    json_name=panel,
    path=py,
    folder_name=data,
    load_frames=load_frames,
    load_layer_heights=load_layer_heights,
    load_up_vectors=load_up_vectors,
    load_normals=load_normals,
    load_closest_support_pt=load_closest_support_pt,
    load_velocities=load_velocities,
    load_wait_times=load_wait_times,
    load_blend_radiuses=load_blend_radiuses,
    load_extruder_toggles=load_extruder_toggles)  # -> out, layers; inputs recompute: Boolean
# ---------- csloadprintpoints: Python ----------
"""
Loads a dictionaly of Printpoints from a json file in the 'output' folder.

"""

import compas_slicer_ghpython.visualization as gh_compas_slicer
gh_compas_slicer = reload(gh_compas_slicer)


if path and folder_name and json_name:
    layers = gh_compas_slicer.load_nested_printpoints(path, folder_name, json_name, load_frames, load_layer_heights, load_up_vectors,
                            load_normals, load_closest_support_pt, load_velocities, load_wait_times,
                            load_blend_radiuses, load_extruder_toggles)
    
else:
    gh_compas_slicer.missing_input()
# ---------- end csloadprintpoints ----------

# ---- group: Path cross-section
# Visualization
xz = XZPlane(Origin=Point(0, 0, 0))
rectangle = Rectangle(Plane=xz, XSize=Slider(2.5, range=0..10), YSize=Slider(1, range=0..10), Radius=Slider(0.43, range=0..1))  # -> Rectangle, Length

# ----
# Load Slicer
panel_2 = Panel("slicer_data.json")
# In order for the components in this file to work, you need to have the COMPAS SLICER Grasshopper components installed. These are automatically installed with the compas_rhino installation:
# 
# conda activate my-project
# python -m compas_rhino.install -v 7.0
# 
# Also see:
# 
# https://compas.dev/compas_slicer/latest/installation.html#step-2-optional-installation-steps-1
button = Button()
csloadslicer = CsLoadSlicer(recompute=button, json_name=panel_2, path=py, folder_name=data)  # -> out, mesh, paths, are_closed, all_points; inputs recompute: Boolean
# ---------- csloadslicer: Python ----------
"""
Loads a Slicer class from its json file in the 'output' folder.

"""

import compas_slicer_ghpython.visualization as gh_compas_slicer
gh_compas_slicer = reload(gh_compas_slicer)


if path and folder_name and json_name:
    mesh, paths, are_closed, all_points = gh_compas_slicer.load_slicer(path, folder_name, json_name)
    
else:
    gh_compas_slicer.missing_input()
# ---------- end csloadslicer ----------

enable_visualization = BooleanToggle(False)
panel_3 = Panel(csloadprintpoints.out)

# ---- group: Visualization settings
layer_index_start = Slider(0, range=0..1000)
layer_index_end = Slider(114, range=0..200)
pt_index_end = Slider(19, range=0..100)

# ---- group: Visualization settings / true/false to display all/only selected printpoitns
display_all = BooleanToggle(False)

# ----
mesh = Mesh(csloadslicer.mesh)
paths = Curve(csloadslicer.paths)
all_points = Point(csloadslicer.all_points)

python = GhPythonScript(
    layers=csloadprintpoints.layers,
    layer_index_start=layer_index_start,
    layer_index_end=layer_index_end,
    pt_index_end=pt_index_end,
    display_all=display_all)  # -> out, geometry, points, frames, layer_heights, up_vectors, mesh_normals, closest_support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; inputs layers: list, layer_index_start: Int32, layer_index_end: Int32, pt_index_end: Int32, display_all: Boolean
# ---------- python: Python ----------
"""
Visualizes PrintPoints information of compas_slicer paths.
"""

import compas_slicer_ghpython.visualization as gh_compas_slicer
gh_compas_slicer = reload(gh_compas_slicer)

points = []
frames = []
layer_heights = []
up_vectors = []
mesh_normals = []
closest_support = []

velocities = []
wait_times = []
blend_radiuses = []
extruder_toggles = []

if layer_index_start >= len(layers) - 2:
    layer_index_start = len(layers) -2
   
    
if layer_index_end >= len(layers):
    layer_index_end = len(layers)
    
if layer_index_start > layer_index_end:
    layer_index_start = layer_index_end
    
print('layer_index_start = ' + str(layer_index_start))
print('layer_index_end = ' + str(layer_index_end))
    

if len(layers) > 0:
    # display all
    if display_all:
        for layer in layers:
            for path in layer.paths:
                for ppt in path.ppts:
                    
                    points.append(ppt.pt)
                    frames.append(ppt.frame)
                    layer_heights.append(ppt.layer_height)
                    up_vectors.append(ppt.up_vector)
                    mesh_normals.append(ppt.mesh_normal)
                    closest_support.append(ppt.closest_support_pt)
                    
                    velocities.append(ppt.velocity)
                    wait_times.append(ppt.wait_time)
                    blend_radiuses.append(ppt.blend_radius)
                    extruder_toggles.append(ppt.extruder_toggle)
        
    else:
        # display selection
        for i, layer in enumerate(layers[layer_index_start:layer_index_end]):
            if i < layer_index_end-layer_index_start -1:
                # fully displayed layers
                for path in layer.paths:
                    for ppt in path.ppts:
                        points.append(ppt.pt)
                        frames.append(ppt.frame)
                        layer_heights.append(ppt.layer_height)
                        up_vectors.append(ppt.up_vector)
                        mesh_normals.append(ppt.mesh_normal)
                        closest_support.append(ppt.closest_support_pt)
                        
                        velocities.append(ppt.velocity)
                        wait_times.append(ppt.wait_time)
                        blend_radiuses.append(ppt.blend_radius)
                        extruder_toggles.append(ppt.extruder_toggle)
            else:
                # partly displayed layers (using pt_index_end)
                count = 0
                for path in layer.paths:
                    for ppt in path.ppts:
                        if count < pt_index_end:
                            points.append(ppt.pt)
                            frames.append(ppt.frame)
                            layer_heights.append(ppt.layer_height)
                            up_vectors.append(ppt.up_vector)
                            mesh_normals.append(ppt.mesh_normal)
                            closest_support.append(ppt.closest_support_pt)
                            
                            velocities.append(ppt.velocity)
                            wait_times.append(ppt.wait_time)
                            blend_radiuses.append(ppt.blend_radius)
                            extruder_toggles.append(ppt.extruder_toggle)
                            
                            count += 1
# ---------- end python ----------

# ---- group: Slicer data
len = Length(Curve=flatten(paths))
lng = ListLength(List=flatten(paths))
ma = MassAddition(Input=len)  # -> Result, PartialResults
total_path_length = Panel(ma.Result)
total_number_of_paths = Panel(lng)

# ----
panel_4 = Panel(python.out)

mesh_normals = Vector(python.mesh_normals)
points = Point(python.points)
frames = Plane(python.frames)
layer_heights = Number(python.layer_heights)
up_vectors = Vector(python.up_vectors)
cpts = Point(python.closest_support)

frames_2 = Plane(frames)
pflip = FlipPlane(Plane=frames_2, ReverseX=False, ReverseY=False, SwapAxes=True)

mesh_normals_2 = Vector(mesh_normals)
points_2 = Point(points)
section = Curve(rectangle.Rectangle)

print_planes = Plane(pflip)
tool_mesh = Mesh(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)

# ----
# Tool Visualization
number_slider = Slider(1494, range=0..2000)
tool_origin = Panel("""0
0
99.507""")
cstoolviz = CsToolViz(origin_coords=tool_origin, mesh=tool_mesh, planes=print_planes, index=number_slider)  # -> out, mesh, passed_path; inputs origin_coords: list, mesh: Mesh, planes: list, index: Int32
# ---------- cstoolviz: Python ----------
"""
Example visualization of tool motion during the print.

"""

import compas_slicer_ghpython.visualization as gh_compas_slicer
gh_compas_slicer = reload(gh_compas_slicer)

if origin_coords and mesh and planes and (index or index==0):
    mesh, passed_path = gh_compas_slicer.tool_visualization(origin_coords, mesh, planes, index)
else:
    gh_compas_slicer.missing_input()
# ---------- end cstoolviz ----------

mesh_2 = Mesh(cstoolviz.mesh)
geo = Geometry(cstoolviz.passed_path)
preview = CustomPreview(Geometry=mesh_2, Material=ColourSwatch(SwatchColor=RGB(171, 171, 171)))
preview_2 = CustomPreview(Geometry=geo, Material=ColourSwatch(SwatchColor=RGB(255, 156, 36)))

extruder_toggles = Number(python.extruder_toggles)
velocities = Number(python.velocities)
wait_times = Number(python.wait_times)
blend_radiuses = Number(python.blend_radiuses)

# ----
# Ligthweight Path Visualization
number_slider_2 = Slider(1, range=0..10)
extruder_toggles_2 = Number(extruder_toggles)
points_3 = Point(points)
cslightpathviz = CsLightPathViz(show=enable_visualization, points=points_3, extruder_toggles=extruder_toggles_2, pipe_diameter=number_slider_2)  # -> out, print_path_pipes, travel_path_lines; inputs points: list of Point3d, extruder_toggles: list of Boolean
# ---------- cslightpathviz: Python ----------
"""
Creates a lightweight visualization of the print paths. Segments with extruder_toggle=True are visualized as pipes, 
segments with extruder_toggle=False are visualized as lines.
Loads files from the 'output' folder.

"""

import compas_slicer_ghpython.visualization as gh_compas_slicer
gh_compas_slicer = reload(gh_compas_slicer)

pipe_resolution = 14

if show:
    if points:
        # assign default values to parameters where possible. 
        if not extruder_toggles:
            extruder_toggles = [False for i in range(len(points))]
        if not pipe_diameter:
            pipe_diameter = 2.0
            
        print_path_pipes, travel_path_lines = \
            gh_compas_slicer.lightweight_path_visualization(points, extruder_toggles, pipe_diameter, pipe_resolution)
        
    else:
        gh_compas_slicer.missing_input()
else:
    print("Visualization disabled")
# ---------- end cslightpathviz ----------

# ----
# Render Path Visualization
extruder_toggles_3 = Number(extruder_toggles)
layer_heights_2 = Number(layer_heights)
up_vectors_2 = Vector(up_vectors)
python_2 = CsRenderPathViz(
    points=points_2,
    mesh_normals=mesh_normals_2,
    layer_heights=layer_heights_2,
    up_vectors=up_vectors_2,
    extruder_toggles=extruder_toggles_3,
    cross_section=section,
    planar_printing=Toggle(True),
    compute=Toggle(True))  # -> out, loft_surfaces, travel_path_lines; inputs points: list of Point3d, mesh_normals: list of Vector3d, layer_heights: list, up_vectors: list of Vector3d, extruder_toggles: list of Boolean, cross_section: Curve, planar_printing: Boolean, compute: Boolean
# ---------- python_2: Python ----------
"""
Creates a render visualization of the print paths with loft surfaces where extruder_toggle=True.
For large number of points, this can take a while to compute, so keep it turned off unless you need it.
Loads files from the 'output' folder.

"""

import compas_slicer_ghpython.visualization as gh_compas_slicer
gh_compas_slicer = reload(gh_compas_slicer)

pipe_resolution = 14

if points and mesh_normals and layer_heights and extruder_toggles and cross_section:
    if compute:
        loft_surfaces, travel_path_lines = \
            gh_compas_slicer.render_path_visualization(points, mesh_normals, layer_heights, up_vectors, extruder_toggles, cross_section, planar_printing)
    else:
        print('Compute is set to False')
else:
    gh_compas_slicer.missing_input()
# ---------- end python_2 ----------

panel_5 = Panel(cslightpathviz.out)

# ---- group: Color output
geo_2 = Geometry(python_2.travel_path_lines)
geo_3 = Geometry(python_2.loft_surfaces)
preview_3 = CustomPreview(Geometry=geo_3, Material=ColourSwatch(SwatchColor=RGB(222, 222, 222)))
preview_4 = CustomPreview(Geometry=geo_2, Material=ColourSwatch(SwatchColor=RGB(255, 156, 36)))

geo_4 = Geometry(cslightpathviz.print_path_pipes)
geo_5 = Geometry(cslightpathviz.travel_path_lines)
preview_5 = CustomPreview(Geometry=geo_4, Material=ColourSwatch(SwatchColor=RGB(199, 199, 199)))
preview_6 = CustomPreview(Geometry=geo_5, Material=ColourSwatch(SwatchColor=RGB(255, 156, 36)))

# ----
vdis = VectorDisplay(Anchor=points, Vector=expr("x*5", up_vectors))
pline = PolyLine(Vertices=points, Closed=False)

# ---- group: Select parameter to display
list = ValueList({"Velocity": 0, "Wait time": 1, "Blend radius": 2, "Extruder Toggle": 3}, selected="Extruder Toggle")

# ----
filter = StreamFilter(Gate=list, Stream0=velocities, Stream1=wait_times, Stream2=blend_radiuses, Stream3=extruder_toggles)
num = Number(filter)

# ---- group: Visualize parameter with color
bnd = Bounds(Numbers=num)
avr = Average(Input=num)
dedomain = DeconstructDomain(Domain=bnd)  # -> Start, End
average = Panel(avr)
gradient = Gradient(
    LowerLimit=dedomain.Start,
    UpperLimit=dedomain.End,
    Parameter=num,
    stops=[0: RGB(0, 128, 0), 0.5: RGB(255, 255, 0), 1: RGB(255, 0, 0)])
pt = Point(points)
cloud = CloudDisplay(Points=pt, Colours=gradient, Size=Slider(1, range=0..10), SpriteType=0)

# ---- group: Visualize parameter with text
tag_offset = Slider(1, range=0..100)
pdecon = Deconstruct(Point=points)  # -> XComponent, YComponent, ZComponent
addition = Addition(A=pdecon.ZComponent, B=tag_offset)
pt_2 = ConstructPoint(XCoordinate=pdecon.XComponent, YCoordinate=pdecon.YComponent, ZCoordinate=addition)
tag = TextTag(Location=pt_2, Text=num, Colour=ColourSwatch(SwatchColor=RGB(50, 130, 186)))

# ----
min = Panel(dedomain.Start)
max = Panel(dedomain.End)
fabrication = GhPythonScript(
    points=python.points,
    velosities=velocities,
    blend_radiuses=blend_radiuses,
    extruder_toggles=extruder_toggles,
    send_to_robot=Button(),
    print_to_file=Button())  # -> out, rhino_base_way_planes, robot_planes, script; inputs points: list, velosities: list, blend_radiuses: list, extruder_toggles: list
# ---------- fabrication: Python ----------
from compas_rhino import unload_modules
unload_modules('simple_ur_script')
unload_modules('simple_comm')

import Rhino.Geometry as rg
import simple_comm as c
import simple_ur_script as ur

import math as m


def tcp(script):
    """ This funktion sets tcp 
    """
    script += ur.set_tcp_by_angles(
        float(0.0), float(0.0), float(0.0), m.radians(0.0), m.radians(180.0), m.radians(180))
    return script

def set_robot_base_plane_from_pts():    

    pt_0 = rg.Point3d(350, 230, 0)  # base plane origin
    pt_1 = rg.Point3d(499, 230, 0) # point on base plane positive x direction
    pt_2 = rg.Point3d(499, 499, 0)  # point on base plane positive xy

    robot_base = rg.Plane(pt_0, pt_1-pt_0, pt_2-pt_0)
    return robot_base

def rhino_to_robot_space(rhino_plane):
    """ this funktion translates planes from the rhino cordinate system to
    the robot cordinate system 
    """
    robot_plane = rhino_plane.Clone()
    _r_matrix = rg.Transform.PlaneToPlane(
        rg.Plane.WorldXY, set_robot_base_plane_from_pts())
    
    robot_plane.Transform(_r_matrix)
    return robot_plane
    

def point_to_rhino_plane(point):
    rhino_plane = rg.Plane(point, rg.Vector3d.XAxis, rg.Vector3d.YAxis)
    return rhino_plane

def extrude(plane, vel, blend_radi, extr, script):
    
    vel = vel/1000
    blend_radi = blend_radi/1000
    script += ur.move_l_blend(plane, vel, blend_radi)
    
    if extr ==1:
        extr = False 
    else:
        extr = True
    script += ur.set_digital_out(5, extr)
    return script 


""" Robotic fabrication procedure
"""
script = ""

script = tcp(script)


"""Create rhino planes
"""

rhino_base_way_planes = []
for point in points:
    rhino_base_way_planes.append(point_to_rhino_plane(point))

"""Translate rhino planes to robot_plabe 
"""

robot_planes = []

for rhino_plane in (rhino_base_way_planes):
    robot_planes.append(rhino_to_robot_space(rhino_plane))
    
"""Create comands
"""

for plane, velocity, blend_radi, extruder_toggle in zip(robot_planes, velosities,blend_radiuses, extruder_toggles):
       script = extrude(plane, velocity, blend_radi, extruder_toggle, script)

if send_to_robot:
    # Sends the script directly to the robot 
    script = c.concatenate_script(script)
    c.send_script(script, "192.168.10.10")
    
if print_to_file:
    # if you have a large aount of waypoints to send to the robot. Store the file on a USB stick and upload it manually to the UR robot
    f = open("c:/Users/apetrus/Documents/MAS-2021/08_mini_project/fabrication.txt", "w")   # This path need to be set according to your computer
    f.write(script)  
    f.close()
# ---------- end fabrication ----------
