# Grasshopper definition 05_Class_Brep.ghx (Grasshopper 1.0.7)

brep = Brep(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)
brep_2 = Brep(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)
brep_3 = Brep(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)
pt = Point(Point(21.43303635, 17.56511116, 38.81082318))
crv = Curve(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)
crv_2 = Curve(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)
brep_4 = Brep(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)
pt_2 = Point(Point(49.15799993, -55.31289324, 73.49838071))
pt_3 = Point(Point(93.46721733, -19.73124897, 73.49838071))
crv_3 = Curve(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)
brep_5 = Surface(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)
pt_4 = Point([Point(0, 90.67527761, 26.73773433), Point(-0.03747662324, 86.01270347, 36.93139992), Point(0, 98.44927005, 41.52728092), Point(0.09830026176, 102.905095, 32.80524063), Point(0, 95.98434562, 28.82343962), Point(0, 93.14020204, 35.45977463)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])
brep_6 = Brep(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)
brep_7 = Brep(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)
brep_8 = Brep(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)
brep_9 = Brep(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)
surface = GhPythonScript(
    input_brep1=brep,
    input_brep2=brep_2,
    input_brep3=brep_3,
    input_pt=pt,
    input_crv1=crv,
    input_crv2=crv_2,
    input_brep4=brep_4,
    input_pt1=pt_2,
    input_pt2=pt_3,
    input_crv3=crv_3,
    input_brep5=brep_5,
    input_pts=pt_4,
    input_brep6=brep_6,
    input_brep7=brep_7,
    input_brep8=brep_8,
    input_brep9=brep_9)  # -> out, brep1, brep4, brep5, brep6, brep7, contour, brep9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; inputs input_brep1: Brep, input_brep2: Brep, input_brep3: Brep, input_pt: Point3d, input_crv1: Curve, input_crv2: Curve, input_brep4: Brep, input_pt1: Point3d, input_pt2: Point3d, input_crv3: Curve, input_brep5: Brep, input_pts: list of Point3d, input_brep6: Brep, input_brep7: Brep, input_brep8: Brep, input_brep9: Brep
# ---------- surface: Python ----------
__author__ = "trtku"
__version__ = "2021.11.09"

'''
This is a basic documentation about Brep class in Rhino.Geometry
'''

import Rhino.Geometry as rg



# 0. First of all, there are two different types of representation in rhinocommon: one is class and another one is structure.
#    Basically, structure is memory efficient. See source below if you are curious.
#    https://www.grasshopper3d.com/forum/topics/rhinocommon-structure-types



# 1. Brep Class
#    https://developer.rhino3d.com/api/RhinoCommon/html/T_Rhino_Geometry_Brep.htm



# 2. Brep constructor
#    https://developer.rhino3d.com/api/RhinoCommon/html/Overload_Rhino_Geometry_Brep__ctor.htm
'''Practically, we dont use Surface constructor in python. Need to use create methods'''



# 3. Brep methods
#    https://developer.rhino3d.com/api/RhinoCommon/html/Methods_T_Rhino_Geometry_Brep.htm
'''I skipped similar methods to structure like ClosestPoint (see 02_Structure_Primitives.ghx)'''
'''I skipped barely used methods as well'''

'''create methods'''
# CreateBaseballSphere
import Rhino.RhinoMath as rm
center =  rg.Point3d.Origin
radius = 10.
tolerance = rm.ZeroTolerance
brep1 = rg.Brep.CreateBaseballSphere(center, radius, tolerance)

# CreateBooleanDifference
firstBrep = input_brep1
secondBrep = input_brep2
brep4 = rg.Brep.CreateBooleanDifference(input_brep1, input_brep2, tolerance)

# CreateBooleanIntersection
brep5 = rg.Brep.CreateBooleanIntersection(input_brep1, input_brep2, tolerance)

# CreateBooleanSplit
brep6 = rg.Brep.CreateBooleanSplit(input_brep1, input_brep2, tolerance)

# CreateBooleanUnion
breps = [input_brep1, input_brep2]
brep7 = rg.Brep.CreateBooleanUnion(breps, tolerance)

# CreateContourCurves
brepToContour = input_brep3
contourStart = input_pt.Clone()
contourStart.Z = 0
contourEnd = input_pt
interval = 1.
contour = rg.Brep.CreateContourCurves(brepToContour, contourStart, contourEnd, interval)


## CreateCurvatureAnalysisMesh
#import Rhino.ApplicationSettings.CurvatureAnalysisSettingsState as cass
#CurvatureAnalysisSettingsState = cass.GaussRange
#instance = None#object
#value = interval
#CurvatureAnalysisSettingsState.__set__(instance, value)
#print type(CurvatureAnalysisSettingsState)
#mesh = rg.Brep.CreateCurvatureAnalysisMesh(input_brep3, CurvatureAnalysisSettingsState)

# CreateDevelopableLoft
crv0 = input_crv1
crv1 = input_crv2
reverse0 = False
reverse1 = False
density = 1
brep9 = rg.Brep.CreateDevelopableLoft(crv0, crv1, reverse0, reverse1, density)

# CreateEdgeSurface
curves = [input_crv1, input_crv2]
brep10 = rg.Brep.CreateEdgeSurface(curves)

# CreateFilletEdges
from System import Array
edgeIndices = Array[int]([1])
startRadii = Array[float]([5])
endRadii = Array[float]([5])
blendType = rg.BlendType.Fillet
railType = rg.RailType.RollingBall
brep11 = rg.Brep.CreateFilletEdges(input_brep4, edgeIndices, startRadii, endRadii, blendType, railType, tolerance)

# CreateFilletSurface
#faces = input_brep4.Faces
#face0 = faces[0]
#uv0 = rg.Point2d(face0.PointAt(0, 0))# : Point2d
#face1 = faces[1]
#uv1 = rg.Point2d(face1.PointAt(1, 1))# : Point2d
#radius = 5.
#trim = True
#extend = True
#brep12 = rg.Brep.CreateFilletSurface(face0, uv0, face1, uv1, radius, trim, extend, tolerance)
#print(brep12)

# CreateFrom series...

# CreateOffsetBrep
distance = 10.
solid = False
extend = True
shrink = True
breps = rg.Brep.CreateOffsetBrep(input_brep3, distance, solid, shrink, tolerance)
brep14 = breps[0][0]

# CreatePipe
rail = input_crv1
radius = 5
localBlending = True
cap = rg.PipeCapMode.Round
fitRail = True
absoluteTolerance = tolerance
angleToleranceRadians = rm.DefaultAngleTolerance
brep16 = rg.Brep.CreatePipe(rail, radius, localBlending, cap, fitRail, absoluteTolerance, angleToleranceRadians)

# CreatePlanarBreps
inputLoop = input_crv3
brep17 = rg.Brep.CreatePlanarBreps(inputLoop, tolerance)

# CreatePlanarDifference
b0 = brep17[0]
b1 = input_brep5
plane = rg.Plane.WorldXY
brep18 = rg.Brep.CreatePlanarDifference(b0, b1, plane, tolerance)

# CreatePlanarIntersection
brep19 = rg.Brep.CreatePlanarIntersection(b0, b1, plane, tolerance)

# CreatePlanarUnion
brep20 = rg.Brep.CreatePlanarUnion(b0, b1, plane, tolerance)

# CreateQuadSphere
sphere = rg.Sphere(rg.Point3d.Origin, 20)
brep21 = rg.Brep.CreateQuadSphere(sphere)

# CreateShell
brep = input_brep3
facesToRemove = [0]#: IEnumerable[int]
distance = 5
brep22 = rg.Brep.CreateShell(input_brep1, facesToRemove, distance, tolerance)

# CreateThickPipe
rail = rail
radius0 = 5
radius1 = 4
localBlending = True
cap = rg.PipeCapMode.Round
fitRail = True
absoluteTolerance = rm.ZeroTolerance
angleToleranceRadians = rm.DefaultAngleTolerance
brep23 = rg.Brep.CreateThickPipe(rail, radius0, radius1, localBlending, cap, fitRail, absoluteTolerance, angleToleranceRadians)

# CreateTrimmedPlane
plane = rg.Plane.WorldXY
curves = [input_crv3]#: IEnumerable[Curve]
brep24 = rg.Brep.CreateTrimmedPlane(plane, curves)

'''analysis methods'''
# GetArea
area = input_brep3.GetArea(tolerance, tolerance)
print('area', type(area), area)

# GetBoundingBox
bbox = input_brep3.GetBoundingBox(rg.Plane.WorldXY)

# GetPointInside
pts_inside = brep7[0].GetPointInside(tolerance)
judge = pts_inside[0]
pts = pts_inside[1]
print('judge', type(judge), judge)

# GetVolume
volume = brep7[0].GetVolume(tolerance, tolerance)
print('volume', type(volume), volume)

# GetWireframe
density = 1
wire = brep7[0].GetWireframe(density)

# IsPointInside
success = brep7[0].IsPointInside(input_pt2, tolerance, True)
print('success', type(success), success)

'''edit methods'''
# CapPlanarHoles
capped = input_brep6.CapPlanarHoles(tolerance)
print(capped)

# Join
judge = rg.Brep.Join(input_brep7, input_brep8, tolerance, True)
print('judge', type(judge), judge)

# JoinBreps
joined = rg.Brep.JoinBreps([input_brep7, input_brep8], tolerance)

# Split
splitted = input_brep9.Split(input_brep3, tolerance)

# Trim
trimmed = input_brep9.Trim(input_brep3, tolerance)

'''other methods'''
# DuplicateEdgeCurves
dup_curves = input_brep3.DuplicateEdgeCurves(True)

# DuplicateNakedEdgeCurves
naked = input_brep4.DuplicateNakedEdgeCurves(True, True)

# DuplicateVertices
vertices = input_brep4.DuplicateVertices()

# 4. Brep properties
#    https://developer.rhino3d.com/api/RhinoCommon/html/Properties_T_Rhino_Geometry_Brep.htm
'''I skipped same name properties to structure (see 02_Structure_Primitives.ghx)'''
# ---------- end surface ----------
panel = Panel("Brep Class")
brep_10 = Brep(surface.brep5)
brep_11 = Brep(surface.brep10)
brep_12 = Brep(surface.brep11)
brep_13 = Brep(surface.brep14)
brep_14 = Brep(surface.brep16)
brep_15 = Brep(surface.brep17)
brep_16 = Brep(surface.brep24)
crv_4 = Curve(surface.wire)
brep_17 = Brep(surface.trimmed)
crv_5 = Curve(surface.dup_curves)
pt_5 = Point(surface.vertices)
brep_18 = Brep(surface.brep1)
brep_19 = Brep(surface.brep4)
brep_20 = Brep(surface.brep6)
brep_21 = Brep(surface.brep7)
crv_6 = Curve(surface.contour)
brep_22 = Brep(surface.brep9)
brep_23 = Brep(surface.brep18)
brep_24 = Brep(surface.brep19)
brep_25 = Brep(surface.brep20)
brep_26 = Brep(surface.brep21)
brep_27 = Brep(surface.brep22)
brep_28 = Brep(surface.brep23)
brep_29 = Brep(surface.brep25)
box = Box(surface.bbox)
pt_6 = Point(surface.pts)
brep_30 = Brep(surface.capped)
brep_31 = Brep(surface.joined)
brep_32 = Brep(surface.splitted)
crv_7 = Curve(surface.naked)
