# Grasshopper definition face_area.ghx (Grasshopper 1.0.7)

mplane = MeshPlane(Boundary={Plane=PlaneXY(0, 0, 0), Size=Domain2(u=-10..10, v=-10..10)}, WidthCount=10, HeightCount=10)  # -> Mesh, Area
python = GhPythonScript(m=mplane.Mesh)  # -> out, area_total, area_list; inputs m: Mesh
# ---------- python: Python ----------
import Rhino.Geometry as rg
import math

def MeshFacesArea(mesh):
    area_total = 0
    area_list =[]
    for i in range(mesh.Faces.Count):
        f = mesh.Faces[i]
        if f.IsTriangle:
            # calculate triangle area
            tri_area = TriangleArea(m.Vertices[f.A], m.Vertices[f.B], m.Vertices[f.C])
            if not tri_area: return None
            area_total += tri_area
            area_list.append(tri_area)
        
        elif mesh.Faces[0].IsQuad:
            # calculate quadrangle area
            quad_area = QuadrangleArea(m.Vertices[f.A], m.Vertices[f.B], m.Vertices[f.C], m.Vertices[f.D])
            if not quad_area: return None
            area_total += quad_area
            area_list.append(quad_area)
            
    if area_total > 0:
        print area_total
        return area_total, area_list
    else:
        print "Error calculating area"

def TriangleArea(A, B, C):
    """area of a 3D triangle"""
    a = B.DistanceTo(C)
    b = A.DistanceTo(C)
    c = A.DistanceTo(B)
    
    p = (a + b + c) 
    s = (p * 0.5)
    if s == 0: return None
    
    return math.sqrt(s * (s - a) * (s - b) * (s - c))

def QuadrangleArea(A, B, C, D):
    """area of a 3D quad"""
    ac = A.DistanceTo(C)
    bd = D.DistanceTo(B)
    
    if ac > bd:
        a0 = TriangleArea(A, B, D)
        a1 = TriangleArea(B, C, D)
    else:
        a0 = TriangleArea(A, B, C)
        a1 = TriangleArea(C, D, A)
        
    if a0 == None or a1 == None: return None
    return a0 + a1

area_total, area_list = MeshFacesArea(m)
# ---------- end python ----------
panel = Panel(python.area_list)
panel_2 = Panel(python.area_total)
