# Grasshopper definition split_curve.ghx (Grasshopper 1.0.7)

crv = Curve(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)
crv_2 = Curve(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)
crv_3 = Curve(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)
crv_4 = Curve(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)
python = GhPythonScript(x=crv, y=crv_2)  # -> out, segment1_x, segment2_x, segment1_y, segment2_y; inputs x: Curve, y: Curve
# ---------- python: Python ----------
import Rhino.Geometry as rg

# get a intersection event
event = rg.Intersect.Intersection.CurveCurve(x, y, .01, .01)

# extract parameter from event
items = []
params_x = []
params_y = []

for i in event.Item:
    items.append(i)
    param_x = i.ParameterA
    param_y = i.ParameterB
    params_x.append(param_x)
    params_y.append(param_y)
print(params_x, params_y)

# split the curves using parameter
segments_x = x.Split(params_x)
segment1_x = segments_x[0]
segment2_x = segments_x[1]
segments_y = y.Split(params_y)
segment1_y = segments_y[0]
segment2_y = segments_y[1]
# ---------- end python ----------
python_2 = GhPythonScript(x=crv_3, y=crv_4)  # -> out, intersection; inputs x: Curve, y: Curve
# ---------- python_2: Python ----------
import Rhino.Geometry as rg

c = rg.Curve.CreateBooleanIntersection(x, y, .01)
intersection = c[0]
print(c[0])
# ---------- end python_2 ----------
crv_5 = Curve(python.segment1_x)
crv_6 = Curve(python.segment2_x)
crv_7 = Curve(python.segment1_y)
crv_8 = Curve(python.segment2_y)
crv_9 = Curve(python_2.intersection)
