# Grasshopper definition surface_surface.ghx (Grasshopper 1.0.7)

srf = Surface(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)
srf_2 = Surface(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)
python = GhPythonScript(x=srf, y=srf_2)  # -> out, a; inputs x: Surface, y: Surface
# ---------- python: Python ----------
import rhinoscriptsyntax as rs
import Rhino.Geometry.Intersect as rgi
import Rhino.Geometry as rg
import clr
import System

curve = clr.StrongBox[System.Array[rg.Curve]]()
points = clr.StrongBox[System.Array[rg.Point3d]]()
result = rgi.Intersection.SurfaceSurface(x, y, 0.01, curve, points)
#result, a, b = rgi.Intersection.BrepBrep(x, y, 0.01)
print result
print curve.Value
print curve.Count

a = curve.Item[0]
# ---------- end python ----------
